# Dynamo graph Script2.dyn (Dynamo 2.16.4.10216)
# Part 2 v2 - Connector parameter sync with WinForms family move dialog.
# packages: Data-Shapes 2026.4.2

# group: File Selection
string = StringInput("Select/Browse Matrix Excel File")
string_2 = StringInput("Select/Browse Matrix Excel File")
filepath_data = Custom[FilePath Data](InputName=string, ButtonText=string_2)  # package Data-Shapes; Create filepath input for UI.MultipleInputForm ++ . Check out www.data-shapes.net for more infos !
relocate_connectors = BoolSelector(true)  # graph input
multipleinputform = Custom[MultipleInputForm ++](Inputs=filepath_data, Toggle=relocate_connectors)  # package Data-Shapes; Create a form with multiple inputs. see www.data-shapes.net for tutorials and infos!
firstItem = List.FirstItem(list=multipleinputform.User_Inputs)

# group: Info Extractor Configure
# Explanation:
# Tells the graph which Excel sheet to read, which columns to grab, and which rows to ignore. Only pulls rows with a recognized Connection ID and skips anything marked Obsolete.
extractor_config = CodeBlock()
# ---------- extractor_config.designscript (86 lines) ----------
// ═══════════════════════════════════════════════════════════════════════════════
// GRAPH 2 — EXTRACTOR CONFIGURATION
//
// Feeds the Excel Data Extractor node with:
//   OUT[0] Sheet name           → Extractor.IN[1]
//   OUT[1] Excel→Revit mapping  → Extractor.IN[2]
//            Full set matching the UM-Revit Mapping sheet.
//            "Frequency" and "Short Circuit Rating" excluded — not in Main sheet.
//   OUT[2] Header row index (4) → Extractor.IN[3]
//   OUT[3] Primary filter       → Extractor.IN[4]
//            Filters rows to known service abbreviations only.
//   OUT[4] Supplementary filter → Extractor.IN[5]
//            Excludes rows marked Obsolete.
// ═══════════════════════════════════════════════════════════════════════════════

"Main";
 // OUT[0] → Extractor.IN[1];

// OUT[1] → Extractor.IN[2]
// All columns present in the Main sheet that have a UM-Revit Mapping entry.
// The second element of each pair is the Revit parameter name — used only as
// a fallback label. The writer resolves all param names from the UM-Revit
// Mapping sheet at runtime, so this list drives WHAT to pull from Excel.
[
    ["Equipment ID",                       "Equipment ID"],
    ["Equipment Description",              "Equipment Description"],
    ["Connection ID",                      "Connection ID"],
    ["Equipment Condition",                "Condition"],
    ["Equipment Type",                     "Equipment Type"],
    ["Functional Area",                    "Functional Area"],
    ["Line Number",                        "Line Designator"],
    ["Manufacturer",                       "OEM"],
    ["Model Number",                       "Model Number"],
    ["Vendor Drawing",                     "OEM Drawing"],
    ["Power Source (Control Panel)",       "Power Source Control Panel"],
    ["Connection Type",                    "Connection Type"],
    ["Connection Size",                    "Nominal Diameter,Connection Size"],
    ["Service Abbreviation",               "Service"],
    ["Service Category",                   "System Type"],
    ["OEM Device ID",                      "OEM Device ID"],
    ["OEM Device Description",             "OEM Device Description"],
    ["Installation Notes",                 "Installation Notes"],
    ["Utility Status",                     "Utility Status"],
    ["Mech - Diversity",                   "Mechanical Demand Factor"],
    ["Mech - Fed From",                    "Fed From"],
    ["Flow",                               "Flow-Unitless"],
    ["Flow Unit",                          "Flow Unit"],
    ["Temp (F°)",                          "Operating Temperature"],
    ["Pressure",                           "Pressure-Unitless"],
    ["Pressure Unit",                      "Pressure Unit"],
    ["Isolation Valve Supplied By",        "Isolation Valve"],
    ["Filter Regulator Supplied By",       "Filter Regulator"],
    ["Air Handling- Intake Source Room",   "Source"],
    ["Air Handling - Operation Mode",      "Air Operation Mode"],
    ["Air Handling - Termination",         "Termination"],
    ["Apparent Load (FLA)",                "Full Load Current"],
    ["Elec - Diversity",                   "Elec Demand Factor"],
    ["Horsepower",                         "Design Total Power"],
    ["LMD Supplied By",                    "Local Motor Disconnect"],
    ["Maximum Overcurrent Protection (A)", "Maximum Overcurrent Protection"],
    ["Tele - IP Address",                  "Network Address"],
    ["Tele - Subnet",                      "Subnet"],
    ["Voltage & Phase",                    "Family Type,Neutral Required"],
    ["Weight - Non-Operating (lbs)",       "Weight"],
    ["Weight - Operating (lbs)",           "Operating Weight"]
];
 // OUT[1] → Extractor.IN[2];

4;
 // OUT[2] → Extractor.IN[3]  (header row is row 4 in the Main sheet);

// OUT[3] → Extractor.IN[4]  Primary filter: service abbreviation whitelist
["Connection ID",
    [
        "CA", "DRN", "EL", "EX", "HH",
        "INT", "PCW", "PHW", "TD"
    ]
];
 // OUT[3];

// OUT[4] → Extractor.IN[5]  Supplementary filter: exclude obsolete rows
{
    "logic": "AND",
    "filters": [["Obsolete", [""]]]
};
 // OUT[4];
# ----------------------------------------
excel_data_extractor = Python(IN[0]=firstItem, IN[1]=extractor_config.out0, IN[2]=extractor_config.out1, IN[3]=extractor_config.out2, IN[4]=extractor_config.out3, IN[5]=extractor_config.out4)  # CPython3
# ---------- excel_data_extractor.python (194 lines) ----------
# Excel Data Extractor ## Revit 2023 / Dynamo 2.16 / CPython3

# Developed By - Chris Staker
# v2.0.0 - Semantic Versioning. Output structured as a Dictionary for seamless downstream consumption. Fixed column name casing bug.

import sys
import os
import ctypes

# Add custom Python support packages path
# v1.0.0 (Kevin branch) - fixed sys.path for multi-machine support
_pkg_paths = [
    r"C:\Dynamo\2.16\Python Support Pckg",
    r"K:\CAD\_Revit2023\Add_Ins\Python Support Pckg",
]
for _p in _pkg_paths:
    import os as _os
    if _os.path.isdir(_p) and _p not in sys.path:
        sys.path.insert(0, _p)
        break

try:
    from openpyxl import load_workbook
except ImportError:
    raise ImportError(
        "openpyxl not found. The Python Support Package must be installed at one of:\n"
        "  C:\\Dynamo\\2.16\\Python Support Pckg\n"
        "  K:\\CAD\\_Revit2023\\Add_Ins\\Python Support Pckg\n"
        "Ask your BIM manager to set up the Python Support Package on this machine."
    )

# Get inputs from Dynamo
file_path = IN[0]
table_name = IN[1]
excel_to_revit_mapping_list = IN[2]
header_row_index_input = IN[3] if len(IN) > 3 else None
primary_filter_input = IN[4] if len(IN) > 4 else None
supplementary_filter_input = IN[5] if len(IN) > 5 else None

def show_popup_message(title, message, icon_type=0, button_type=0):
    try:
        return ctypes.windll.user32.MessageBoxW(0, message, title, icon_type | button_type)
    except:
        return 1

def matches_filter_value(cell_value, filter_value):
    if cell_value is None:
        cell_str = ""
    else:
        cell_str = str(cell_value).strip().lower()
    filter_str = str(filter_value).strip().lower()
    return filter_str in cell_str

def check_supplementary_filters(record, supp_filter_config, column_indices):
    if not supp_filter_config or 'filters' not in supp_filter_config:
        return True 
    
    logic = supp_filter_config.get('logic', 'AND').upper()
    filters = supp_filter_config['filters']
    matches = []
    
    for filter_column, filter_values in filters:
        column_lower = filter_column.strip().lower()
        if column_lower not in column_indices:
            matches.append(False)
            continue
        
        cell_value = record.get(column_lower)
        column_match = any(matches_filter_value(cell_value, fv) for fv in filter_values)
        matches.append(column_match)
    
    return all(matches) if logic == 'AND' else any(matches)

def group_data_by_filters(data, primary_filter_config, supp_filter_config, column_indices):
    if not primary_filter_config or len(primary_filter_config) != 2:
        return {'All': data}
    
    primary_column, primary_values = primary_filter_config
    primary_column_lower = primary_column.strip().lower()
    
    if primary_column_lower not in column_indices:
        return {'All': data}
    
    grouped = {filter_val: [] for filter_val in primary_values}
    grouped['Other'] = []
    
    for record in data:
        cell_value = record.get(primary_column_lower)
        matched_group = None
        
        for filter_val in primary_values:
            if matches_filter_value(cell_value, filter_val):
                matched_group = filter_val
                break
        
        if matched_group is None:
            grouped['Other'].append(record)
            continue
        
        if check_supplementary_filters(record, supp_filter_config, column_indices):
            grouped[matched_group].append(record)
        else:
            grouped['Other'].append(record)
            
    return grouped

def build_output_structure(grouped_data, formatted_mapping):
    flat_data = []
    log_entries = []
    
    sorted_groups = sorted([k for k in grouped_data.keys() if k != 'Other'])
    if 'Other' in grouped_data:
        sorted_groups.append('Other')
    
    for idx, group_name in enumerate(sorted_groups):
        group_data = grouped_data[group_name]
        if group_data:
            flat_data.extend(group_data)
            log_entries.append({
                'Group': group_name,
                'Count': len(group_data),
                'Output Index': idx
            })
            
    # Output cleanly as a dictionary for downstream nodes
    return {
        "GroupedData": grouped_data,
        "FlatData": flat_data,
        "Mapping": formatted_mapping,
        "Log": log_entries
    }

def read_excel_data(file_path, table_name, mapping_list, header_row_input=None, primary_filter=None, supp_filter=None):
    if not os.path.exists(file_path):
        return {"Error": f"File not found at {file_path}"}
    
    while True:
        workbook = None
        try:
            try:
                workbook = load_workbook(file_path, read_only=True, keep_vba=True, data_only=True)
                if table_name not in workbook.sheetnames:
                    return {"Error": f"'{table_name}' sheet not found."}
                            
                worksheet = workbook[table_name]

                def coerce_header_row_index(val):
                    if val is None: return 1
                    try:
                        idx = int(float(str(val).strip()))
                        return max(idx, 1)
                    except: return 1

                header_row_index = coerce_header_row_index(header_row_input)
                max_rows = worksheet.max_row if worksheet.max_row is not None else 1
                if header_row_index > max_rows: header_row_index = 1
                            
                headers = [str(cell.value).strip().lower() if cell.value else None for cell in worksheet[header_row_index]]
                excel_columns = [item[0] for item in mapping_list]
                column_indices = {}
                            
                for col in excel_columns:
                    try:
                        column_indices[col] = headers.index(col.strip().lower())
                    except ValueError:
                        return {"Error": f"Column '{col}' not found."}
                
                all_column_indices = {header: idx for idx, header in enumerate(headers) if header}
                data = []
                
                for row_num, row in enumerate(worksheet.iter_rows(min_row=header_row_index + 1), start=header_row_index + 1):
                    record = {}
                    for col_name, col_idx in all_column_indices.items():
                        if col_idx < len(row):
                            record[col_name] = row[col_idx].value
                            
                    if any(record.get(headers[column_indices[col]]) is not None for col in excel_columns if col in column_indices):
                        data.append(record)
                                
            finally:
                if workbook: workbook.close()
            
            grouped_data = group_data_by_filters(data, primary_filter, supp_filter, all_column_indices)
            formatted_mapping = [{'Excel Header': pair[0], 'Revit Parameter': pair[1]} for pair in mapping_list]
            return build_output_structure(grouped_data, formatted_mapping)
        
        except (PermissionError, OSError):
            res = show_popup_message("File Access Error", f"Excel file '{os.path.basename(file_path)}' is open.", 0, 53)
            if res == 4: continue
            else: return {"Error": "Operation cancelled by user."}
        except Exception as e:
            return {"Error": str(e)}

OUT = read_excel_data(file_path, table_name, excel_to_revit_mapping_list, header_row_index_input, primary_filter_input, supplementary_filter_input)
# ----------------------------------------

# group: Revit Parameter Writer
# Param Writer + Config
# Opens a dialog on run where you select which connector families to move and which to update — independently. For selected Move families, repositions each connector onto its parent Data Cube, evenly spaced along the cube's longest axis. For selected Update families, reads the UM-Revit Mapping sheet directly from the Utility Matrix Excel file to determine which parameters apply to which family, then writes values from the Excel data to matched Revit elements keyed by Connection ID. If a parameter is read-only (type parameter), it finds and swaps to the matching family type instead of writing directly. Config supplies the Revit categories to collect from and the key parameter (Connection ID).
pw_config = CodeBlock()
# ---------- pw_config.designscript (26 lines) ----------
// Graph 2 - Parameter Writer Config

// OUT[0]: Categories
[
    "Electrical Equipment",
    "Data Devices",
    "Mechanical Equipment",
    "Generic Models"
];

// OUT[1]: Key parameter
"Connection ID";

// OUT[2]: Mapping
[
    ["Equipment ID",          "Equipment ID"],
    ["Equipment Description", "Equipment Description"],
    ["Connection ID",         "Connection ID"],
    ["Equipment Condition",   "Condition"],
    ["Voltage & Phase",       "System Voltage"],
    ["Connection Size",       "Nominal Diameter"],
    ["Connection Size",       "Connection Size"],
    ["Functional Area",       "Functional Area"],
    ["Line Number",           "Line Designator"],
    ["Service",               "Service"]
];
# ----------------------------------------
parameter_writer = Python(IN[0]=excel_data_extractor, IN[1]=pw_config.out2, IN[2]=pw_config.out0, IN[3]=pw_config.out1, IN[4]=firstItem)  # CPython3
# ---------- parameter_writer.python (1049 lines) ----------
# Revit Parameter Writer
# Revit 2023 / Dynamo 2.16 / CPython3
# Developed By - Chris Staker & Kevin Levasseur
# v9.8.0 - Fixed element_lookup: use existing_connectors instead of all_elements.
#           Prevents Data Cubes (or any non-connector element with Connection ID set)
#           from overwriting connector entries and blocking all parameter writes.

# ═══════════════════════════════════════════════════════════════════════════════
# SECTION 1 — IMPORTS & CLR REFERENCES
# ═══════════════════════════════════════════════════════════════════════════════

import sys
import clr

clr.AddReference('RevitAPI')
from Autodesk.Revit.DB import (
    FilteredElementCollector, StorageType, LocationPoint, XYZ,
    BuiltInParameter, BuiltInCategory
)

clr.AddReference('RevitServices')
import RevitServices
from RevitServices.Persistence import DocumentManager
from RevitServices.Transactions import TransactionManager

clr.AddReference('System.Windows.Forms')
clr.AddReference('System.Drawing')
import System.Windows.Forms as WinForms
import System.Drawing as Drawing

# ═══════════════════════════════════════════════════════════════════════════════
# SECTION 2 — INPUTS
#
#   IN[0] extractor_output  — structured dict from Excel Data Extractor node
#   IN[1] (unused)          — legacy raw_mapping_table, superseded by UM-Revit Mapping
#   IN[2] categories_input  — list of Revit category name strings to collect from
#   IN[3] key_parameter     — Revit parameter name used as the match key (Connection ID)
#   IN[4] excel_file_path   — path to the Utility Matrix .xlsx file
# ═══════════════════════════════════════════════════════════════════════════════

doc              = DocumentManager.Instance.CurrentDBDocument
extractor_output = IN[0]
# IN[1] intentionally not consumed — UM-Revit Mapping is read directly from Excel
categories_input = IN[2]
key_parameter    = IN[3]
excel_file_path  = IN[4] if len(IN) > 4 else None

# ═══════════════════════════════════════════════════════════════════════════════
# SECTION 3 — UTILITY HELPER FUNCTIONS
# ═══════════════════════════════════════════════════════════════════════════════

def safe_get(obj, key, default=None):
    """Key-safe getter for Python dicts, IronPython dicts, and Dynamo dicts."""
    try:
        if hasattr(obj, "get"):
            val = obj.get(key)
            return val if val is not None else default
        elif hasattr(obj, "ContainsKey"):
            if obj.ContainsKey(key):
                val = obj[key]
                return val if val is not None else default
        elif hasattr(obj, "Keys"):
            for k in obj.Keys:
                if str(k) == str(key):
                    val = obj.GetValueAtKey(k) if hasattr(obj, "GetValueAtKey") else obj[k]
                    return val if val is not None else default
    except:
        pass
    return default

def get_param_value(elem, name):
    """Returns raw parameter value (Double, Integer, or String)."""
    p = elem.LookupParameter(name)
    if not p: return None
    if p.StorageType == StorageType.Double:   return p.AsDouble()
    elif p.StorageType == StorageType.Integer: return p.AsInteger()
    else:                                      return p.AsString()

def get_param_display_value(param):
    """Returns the display string for a Revit parameter."""
    if not param: return ""
    st = param.StorageType
    if st == StorageType.String:
        return param.AsString() or ""
    elif st == StorageType.Double:
        try:
            v = param.AsValueString()
            if v: return v
        except:
            pass
        return str(round(param.AsDouble(), 4)) if param.AsDouble() is not None else ""
    elif st == StorageType.Integer:
        return str(param.AsInteger())
    elif st == StorageType.ElementId:
        return str(param.AsElementId().IntegerValue)
    return ""

def check_param_match(param, target_val):
    """Returns True if the Revit parameter's current value matches target_val."""
    if not param or target_val is None: return False
    st         = param.StorageType
    target_str = str(target_val).strip()
    if st == StorageType.String:
        return (param.AsString() or "").strip().upper() == target_str.upper()
    elif st == StorageType.Double:
        revit_str = param.AsValueString()
        if revit_str:
            if revit_str == target_str:        return True
            if revit_str == target_str + '"':  return True
            if revit_str == target_str + "'":  return True
        try:
            if param.AsDouble() is not None and abs(param.AsDouble() - float(target_val)) < 0.0001:
                return True
        except:
            pass
        return False
    elif st == StorageType.Integer:
        try:   return param.AsInteger() == int(float(target_val))
        except: return False
    return False

def compare_and_set_param(param, value):
    """
    Idempotent parameter setter. Compares using Revit's own stored value as
    ground truth — writes the value then reads back to confirm whether Revit's
    internal representation actually changed. This guarantees that running the
    same Excel data twice produces zero updates on the second pass.

    Returns (was_changed: bool, after_display_value: str).
    """
    if not param or param.IsReadOnly or value is None:
        return False, get_param_display_value(param)

    st        = param.StorageType
    value_str = str(value).strip()

    try:
        if st == StorageType.String:
            # Normalize to stripped uppercase — that is exactly what we store.
            before_norm = (param.AsString() or "").strip().upper()
            target_norm = value_str.upper()
            if before_norm == target_norm:
                # Already exactly correct — no write needed.
                return False, param.AsString() or ""
            param.Set(target_norm)
            # Read back what Revit actually stored (should be target_norm).
            return True, param.AsString() or ""

        elif st == StorageType.Double:
            # Use Revit's own AsDouble() before/after as the ground truth.
            # SetValueString handles unit strings (e.g. "2\"", "3/4\"") natively.
            before = param.AsDouble()
            if param.SetValueString(value_str):
                after = param.AsDouble()
                changed = (before is None) or (abs(before - after) > 0.0001)
                return changed, get_param_display_value(param)
            # SetValueString failed — try raw float (unitless params).
            try:
                target_float = float(value)
                if before is not None and abs(before - target_float) < 0.0001:
                    return False, get_param_display_value(param)
                param.Set(target_float)
                after = param.AsDouble()
                changed = (before is None) or (abs(before - after) > 0.0001)
                return changed, get_param_display_value(param)
            except:
                return False, get_param_display_value(param)

        elif st == StorageType.Integer:
            try:
                target_int = int(float(value))
                if param.AsInteger() == target_int:
                    return False, get_param_display_value(param)
                param.Set(target_int)
                changed = param.AsInteger() == target_int
                return changed, get_param_display_value(param)
            except:
                return False, get_param_display_value(param)

        return False, get_param_display_value(param)
    except:
        return False, get_param_display_value(param)

def extract_flat_data(data_input):
    """Flattens Extractor output dict or nested list into a flat list of row dicts."""
    flat_data = safe_get(data_input, "FlatData")
    if flat_data is not None:
        return flat_data
    is_list_like = (
        isinstance(data_input, list) or
        (hasattr(data_input, '__iter__') and
         not isinstance(data_input, str) and
         not hasattr(data_input, 'ContainsKey') and
         not hasattr(data_input, 'keys'))
    )
    if is_list_like:
        flat = []
        for item in data_input:
            is_item_list = (
                isinstance(item, list) or
                (hasattr(item, '__iter__') and
                 not isinstance(item, str) and
                 not hasattr(item, 'ContainsKey') and
                 not hasattr(item, 'keys'))
            )
            if is_item_list:
                flat.extend(extract_flat_data(item))
            elif safe_get(item, "Excel Header") is None and safe_get(item, "Log") is None:
                flat.append(item)
        return flat
    return (
        [data_input]
        if (hasattr(data_input, 'keys') or hasattr(data_input, 'ContainsKey'))
        else []
    )

def get_family_name(elem):
    """Returns the Revit family name string for a family instance."""
    try:
        fn_p = elem.Symbol.get_Parameter(BuiltInParameter.SYMBOL_FAMILY_NAME_PARAM)
        return fn_p.AsString() if fn_p else ""
    except:
        return ""

def build_param_map(elem_or_type):
    """Returns a lowercase-name → parameter dict for an element or type."""
    pm = {}
    try:
        for p in elem_or_type.Parameters:
            try: pm[p.Definition.Name.strip().lower()] = p
            except: pass
    except:
        pass
    return pm

def get_representative_display(param_names, inst_param_map, type_param_map, preferred_name=None):
    """
    Return the best display value for a mapped Excel column from the current
    Revit element/type state.

    preferred_name is used first when provided, then we fall back to the first
    non-empty mapped parameter display, then finally the first mapped param.
    """
    ordered_names = []
    if preferred_name:
        ordered_names.append(preferred_name.strip().lower())
    ordered_names.extend(
        n.strip().lower() for n in param_names
        if n and n.strip().lower() not in ordered_names
    )

    first_display = ""
    for name in ordered_names:
        param = inst_param_map.get(name) or type_param_map.get(name)
        display = get_param_display_value(param) if param is not None else ""
        if first_display == "":
            first_display = display
        if str(display).strip() != "":
            return display
    return first_display

# ═══════════════════════════════════════════════════════════════════════════════
# SECTION 4 — UM-REVIT MAPPING READER
#
#   Reads the "UM-Revit Mapping" sheet from the Utility Matrix Excel file.
#
#   Sheet layout (1-indexed rows):
#     Row 1-2 : notes / warnings
#     Row 3   : column headers →
#                 [Utility Matrix Column] [Revit Parameter]
#                 [Process Data Cube - Generic] [Process Pipe Connector]
#                 [Process Duct Connector - Round] [Process Electrical Connector]
#     Row 4+  : data rows, one per Excel column
#
#   Returns a dict keyed by lowercase Excel column name:
#     {
#       "connection size": {
#           "params":   ["Nominal Diameter", "Connection Size"],
#           "families": ["Process Pipe Connector", "Process Duct Connector - Round", ...]
#       }, ...
#     }
#   "families" lists the family column headers where the row has "Yes".
#   An empty "families" list means no restriction — applies to all.
# ═══════════════════════════════════════════════════════════════════════════════

def read_um_revit_mapping(file_path):
    um_map = {}
    if not file_path:
        return um_map
    try:
        _pkg_paths = [
            r"C:\Dynamo\2.16\Python Support Pckg",
            r"K:\CAD\_Revit2023\Add_Ins\Python Support Pckg",
        ]
        for _p in _pkg_paths:
            import os as _os
            if _os.path.isdir(_p) and _p not in sys.path:
                sys.path.insert(0, _p)
                break
        from openpyxl import load_workbook
        wb = load_workbook(file_path, read_only=True, data_only=True)
        if 'UM-Revit Mapping' not in wb.sheetnames:
            wb.close()
            return um_map

        ws = wb['UM-Revit Mapping']

        # Row 3 (1-indexed) = header row — read family column names from cols 3+
        header_row  = [c.value for c in next(ws.iter_rows(min_row=3, max_row=3))]
        family_cols = [str(h).strip() for h in header_row[2:] if h]  # e.g. ["Process Data Cube...", ...]

        # Rows 4+ are data
        for row in ws.iter_rows(min_row=4, values_only=True):
            excel_col   = row[0]
            revit_param = row[1]
            if not excel_col or not revit_param:
                continue

            key         = str(excel_col).strip().lower()
            params_list = [p.strip() for p in str(revit_param).strip().split(',') if p.strip()]

            # Applicable families: columns where cell value is "Yes" (case-insensitive)
            applicable = []
            for i, fam_name in enumerate(family_cols):
                col_idx = i + 2
                if col_idx < len(row):
                    cell_val = row[col_idx]
                    if cell_val and str(cell_val).strip().lower() == "yes":
                        applicable.append(fam_name)

            # Skip rows where no connector family has "Yes"
            # (e.g. Short Circuit Rating — all No or NaN — should never be written)
            if not applicable:
                continue

            if key not in um_map:
                um_map[key] = {"params": [], "families": set()}
            for p in params_list:
                if p not in um_map[key]["params"]:
                    um_map[key]["params"].append(p)
            for f in applicable:
                um_map[key]["families"].add(f)

        wb.close()
        for k in um_map:
            um_map[k]["families"] = list(um_map[k]["families"])

    except Exception:
        pass  # Fall back to direct param name matching if sheet can't be read

    return um_map


def family_is_applicable(elem_family_name, applicable_families):
    """
    Returns True if elem_family_name matches any entry in applicable_families
    (substring match, case-insensitive).
    NOTE: applicable_families is never empty for valid mapping entries —
    entries with no 'Yes' family are excluded by read_um_revit_mapping.
    """
    if not applicable_families:
        return True
    efn = elem_family_name.strip().lower()
    for fam in applicable_families:
        fam_lower = fam.strip().lower()
        if fam_lower in efn or efn in fam_lower:
            return True
    return False


# ═══════════════════════════════════════════════════════════════════════════════
# SECTION 5 — REVIT ELEMENT COLLECTION
#
#   Collects all family instances from the specified Revit categories,
#   then filters to connector families only (family name contains "Connector").
# ═══════════════════════════════════════════════════════════════════════════════

all_doc_categories    = {c.Name: c for c in doc.Settings.Categories}
categories_to_process = categories_input if isinstance(categories_input, list) else [categories_input]

all_elements = []
for item in categories_to_process:
    cat_obj = None
    if hasattr(item, 'Id'):
        cat_obj = item
    elif isinstance(item, str) and item in all_doc_categories:
        cat_obj = all_doc_categories[item]
    if cat_obj:
        collector = (FilteredElementCollector(doc)
                     .OfCategoryId(cat_obj.Id)
                     .WhereElementIsNotElementType()
                     .ToElements())
        all_elements.extend(collector)

# Only process connector family instances
existing_connectors = [
    e for e in all_elements
    if e.Symbol and "Connector" in (e.Symbol.Family.Name or "")
]

# ═══════════════════════════════════════════════════════════════════════════════
# SECTION 6 — FAMILY SELECTION DIALOG
#
#   WinForms dialog with two independent checklist sections:
#     MOVE   — reposition connector to its parent Data Cube location
#     UPDATE — write Utility Matrix parameter values to Revit
#   All items are unchecked by default. User can check any combination.
#   Clicking Run returns (move_families: set, update_families: set).
#   Clicking Cancel returns (None, None) and exits the script.
# ═══════════════════════════════════════════════════════════════════════════════

# Build family name → instance count map from collected connectors
family_count = {}
for ec in existing_connectors:
    try:
        fn_p = ec.Symbol.get_Parameter(BuiltInParameter.SYMBOL_FAMILY_NAME_PARAM)
        fn   = fn_p.AsString() if fn_p else "Unknown"
        family_count[fn] = family_count.get(fn, 0) + 1
    except:
        pass

def show_family_selection_dialog(family_names_with_counts):
    DEF_FONT   = Drawing.SystemFonts.DefaultFont.FontFamily
    DARK_BG    = Drawing.Color.FromArgb(45, 45, 48)
    DARKER_BG  = Drawing.Color.FromArgb(37, 37, 38)
    DIVIDER    = Drawing.Color.FromArgb(80, 80, 80)
    SECTION_BG = Drawing.Color.FromArgb(55, 55, 60)
    WHITE      = Drawing.Color.White
    GREY       = Drawing.Color.FromArgb(180, 180, 180)
    BLUE       = Drawing.Color.FromArgb(0, 122, 204)
    GREEN      = Drawing.Color.FromArgb(0, 153, 76)
    RED        = Drawing.Color.FromArgb(160, 50, 50)
    MID_GREY   = Drawing.Color.FromArgb(80, 80, 80)

    ROW_H   = 22
    MAX_VIS = 8
    N       = len(family_names_with_counts)
    CLB_H   = min(N, MAX_VIS) * ROW_H + 4
    FORM_W  = 520
    INNER_W = FORM_W - 32

    form = WinForms.Form()
    form.Text            = "ConMan Part 2 — Connector Options"
    form.Width           = FORM_W
    form.StartPosition   = WinForms.FormStartPosition.CenterScreen
    form.FormBorderStyle = WinForms.FormBorderStyle.FixedDialog
    form.MaximizeBox     = False
    form.MinimizeBox     = False
    form.BackColor       = DARK_BG

    y = 14

    def add_label(text, font_size, bold, color, y_pos, height=20, indent=16):
        lbl           = WinForms.Label()
        lbl.Text      = text
        lbl.ForeColor = color
        lbl.Font      = Drawing.Font(
            DEF_FONT, font_size,
            Drawing.FontStyle.Bold if bold else Drawing.FontStyle.Regular
        )
        lbl.Location = Drawing.Point(indent, y_pos)
        lbl.Size     = Drawing.Size(INNER_W, height)
        form.Controls.Add(lbl)

    def add_separator(y_pos):
        sep           = WinForms.Panel()
        sep.BackColor = DIVIDER
        sep.Location  = Drawing.Point(16, y_pos)
        sep.Size      = Drawing.Size(INNER_W, 1)
        form.Controls.Add(sep)

    def add_section_header(text, y_pos):
        bg           = WinForms.Panel()
        bg.BackColor = SECTION_BG
        bg.Location  = Drawing.Point(0, y_pos)
        bg.Size      = Drawing.Size(FORM_W, 28)
        form.Controls.Add(bg)
        lbl           = WinForms.Label()
        lbl.Text      = text
        lbl.ForeColor = WHITE
        lbl.Font      = Drawing.Font(DEF_FONT, 9, Drawing.FontStyle.Bold)
        lbl.Location  = Drawing.Point(12, 5)
        lbl.Size      = Drawing.Size(INNER_W, 18)
        lbl.BackColor = Drawing.Color.Transparent
        bg.Controls.Add(lbl)
        return y_pos + 28

    def add_clb(y_pos):
        clb              = WinForms.CheckedListBox()
        clb.Location     = Drawing.Point(16, y_pos)
        clb.Width        = INNER_W
        clb.Height       = CLB_H
        clb.BackColor    = DARKER_BG
        clb.ForeColor    = WHITE
        clb.Font         = Drawing.Font(DEF_FONT, 9)
        clb.BorderStyle  = getattr(WinForms.BorderStyle, "None")
        clb.CheckOnClick = True
        for fam_name, count in family_names_with_counts:
            clb.Items.Add("  {} ({} in model)".format(fam_name, count), False)
        form.Controls.Add(clb)
        return clb

    def add_all_none_buttons(y_pos, target_clb):
        def on_all(s, e):
            for i in range(target_clb.Items.Count):
                target_clb.SetItemChecked(i, True)
        def on_none(s, e):
            for i in range(target_clb.Items.Count):
                target_clb.SetItemChecked(i, False)

        for label, x_pos, color, handler in [
            ("All",  16,  BLUE,     on_all),
            ("None", 94,  MID_GREY, on_none),
        ]:
            btn                           = WinForms.Button()
            btn.Text                      = label
            btn.Location                  = Drawing.Point(x_pos, y_pos)
            btn.Size                      = Drawing.Size(70, 24)
            btn.FlatStyle                 = WinForms.FlatStyle.Flat
            btn.BackColor                 = color
            btn.ForeColor                 = WHITE
            btn.Font                      = Drawing.Font(DEF_FONT, 8)
            btn.FlatAppearance.BorderSize = 0
            btn.Click                    += handler
            form.Controls.Add(btn)
        return y_pos + 30

    # — Section 1: MOVE ────────────────────────────────────────────────────────
    y = add_section_header("  ↕  MOVE — Reposition connectors to their Data Cube?", y)
    add_label("Checked families will be repositioned. Unchecked stay in place.", 8, False, GREY, y + 4, height=16)
    y += 22
    clb_move = add_clb(y)
    y += CLB_H + 4
    y = add_all_none_buttons(y, clb_move)

    add_separator(y + 4)
    y += 14

    # — Section 2: UPDATE ──────────────────────────────────────────────────────
    y = add_section_header("  ✎  UPDATE — Write Utility Matrix data to Revit parameters?", y)
    add_label("Checked families will have parameters written from the Matrix. Unchecked are skipped.", 8, False, GREY, y + 4, height=16)
    y += 22
    clb_update = add_clb(y)
    y += CLB_H + 4
    y = add_all_none_buttons(y, clb_update)

    add_separator(y + 4)
    y += 14

    # — Run / Cancel ───────────────────────────────────────────────────────────
    for label, x_pos, width, color, dr in [
        ("Run",    16,  230,           GREEN, WinForms.DialogResult.OK),
        ("Cancel", 254, FORM_W - 270,  RED,   WinForms.DialogResult.Cancel),
    ]:
        btn                           = WinForms.Button()
        btn.Text                      = label
        btn.Location                  = Drawing.Point(x_pos, y)
        btn.Size                      = Drawing.Size(width, 36)
        btn.FlatStyle                 = WinForms.FlatStyle.Flat
        btn.BackColor                 = color
        btn.ForeColor                 = WHITE
        btn.Font                      = Drawing.Font(
            DEF_FONT, 10,
            Drawing.FontStyle.Bold if label == "Run" else Drawing.FontStyle.Regular
        )
        btn.FlatAppearance.BorderSize = 0
        btn.DialogResult              = dr
        form.Controls.Add(btn)
        if label == "Run":    form.AcceptButton = btn
        if label == "Cancel": form.CancelButton = btn

    form.Height = y + 36 + 52
    dialog_result = form.ShowDialog()

    if dialog_result != WinForms.DialogResult.OK:
        return None, None

    move_sel = {
        family_names_with_counts[i][0]
        for i in range(clb_move.Items.Count)
        if clb_move.GetItemChecked(i)
    }
    update_sel = {
        family_names_with_counts[i][0]
        for i in range(clb_update.Items.Count)
        if clb_update.GetItemChecked(i)
    }
    return move_sel, update_sel


sorted_families = sorted(family_count.items(), key=lambda x: x[0])

if sorted_families:
    moveable_families, update_families = show_family_selection_dialog(sorted_families)
    if moveable_families is None:
        OUT = [["Cancelled by user."]], [["Key Value", "Status"]], [], []
        sys.exit()
else:
    moveable_families = set()
    update_families   = set()


# ═══════════════════════════════════════════════════════════════════════════════
# SECTION 7 — DATA CUBE LOOKUP
#
#   Collects all "Process Data Cube - Generic" instances and builds a dict:
#     Equipment ID (uppercase) → Revit element
#   Used by Move Logic to determine the target world-space location for
#   each connector being repositioned.
# ═══════════════════════════════════════════════════════════════════════════════

data_cubes = [
    c for c in (
        FilteredElementCollector(doc)
        .OfCategory(BuiltInCategory.OST_GenericModel)
        .WhereElementIsNotElementType()
        .ToElements()
    )
    if c.Symbol and "Process Data Cube - Generic" in c.Symbol.Family.Name
]

cube_lookup = {}
for cube in data_cubes:
    eid = get_param_value(cube, "Equipment ID")
    if eid:
        cube_lookup[str(eid).strip().upper()] = cube


# ═══════════════════════════════════════════════════════════════════════════════
# SECTION 8 — MOVE LOGIC
#
#   For each Equipment ID that has connectors in a selected Move family:
#     1. Looks up its parent Data Cube element by Equipment ID.
#     2. Reads the cube's Offset Front/Back/Left/Right/Top parameters to
#        determine the connector placement region in local cube space.
#     3. Distributes connectors evenly along the cube's longest horizontal axis.
#     4. Transforms computed local points to world space via the cube transform.
#     5. Sets each connector's LocationPoint to its computed world position.
#   Connectors whose family is not in the Move selection are logged as Skipped.
# ═══════════════════════════════════════════════════════════════════════════════

def set_location(elem, new_xyz):
    """Moves elem to new_xyz if it isn't already there. Returns (moved: bool, old_loc_str)."""
    try:
        loc = elem.Location
        if isinstance(loc, LocationPoint):
            old_pt  = loc.Point
            old_str = "X:{:.2f}, Y:{:.2f}, Z:{:.2f}".format(old_pt.X, old_pt.Y, old_pt.Z)
            if not old_pt.IsAlmostEqualTo(new_xyz, 0.0026):
                loc.Point = new_xyz
                return True, old_str
            return False, old_str
        return False, "N/A"
    except:
        return False, "Error"

move_report = []  # Each row: [elem_id, conn_id, equip_id, action, old_loc, new_loc]

if moveable_families:
    # Group connectors by Equipment ID for spacing calculation
    conns_by_eid = {}
    for ec in existing_connectors:
        eid = get_param_value(ec, "Equipment ID")
        if eid:
            conns_by_eid.setdefault(str(eid).strip().upper(), []).append(ec)

    TransactionManager.Instance.EnsureInTransaction(doc)

    for eid_key, conns in conns_by_eid.items():
        cube = cube_lookup.get(eid_key)
        if not cube:
            continue

        # Read Data Cube offset parameters (Revit internal units = feet)
        f  = get_param_value(cube, "Offset Front") or 0.0
        bk = get_param_value(cube, "Offset Back")  or 0.0
        l  = get_param_value(cube, "Offset Left")  or 0.0
        r  = get_param_value(cube, "Offset Right") or 0.0
        t  = get_param_value(cube, "Offset Top")   or 0.0

        length_dim = abs(f) + abs(bk)
        width_dim  = abs(l) + abs(r)
        lx         = (r - l) / 2.0
        ly         = (f - bk) / 2.0
        lz         = t

        total_n      = len(conns)
        is_len       = length_dim >= width_dim
        axis_dim     = length_dim if is_len else width_dim
        spacing      = max(0.333, axis_dim / (total_n + 1))
        start_offset = -((total_n - 1) * spacing) / 2.0
        trans        = cube.GetTransform()

        for i, ec in enumerate(conns):
            fn      = get_family_name(ec)
            conn_id = get_param_value(ec, "Connection ID") or ""
            eid_raw = get_param_value(ec, "Equipment ID") or eid_key

            step     = start_offset + (i * spacing)
            local_pt = XYZ(lx, ly + step, lz) if is_len else XYZ(lx + step, ly, lz)
            world_pt = trans.OfPoint(local_pt)
            new_loc  = "X:{:.2f}, Y:{:.2f}, Z:{:.2f}".format(world_pt.X, world_pt.Y, world_pt.Z)

            if fn in moveable_families:
                moved, old_loc = set_location(ec, world_pt)
                action = "Moved" if moved else "No Change"
            else:
                loc = ec.Location
                old_loc = (
                    "X:{:.2f}, Y:{:.2f}, Z:{:.2f}".format(loc.Point.X, loc.Point.Y, loc.Point.Z)
                    if isinstance(loc, LocationPoint) else "N/A"
                )
                action  = "Skipped (Family Not Selected)"
                new_loc = old_loc

            move_report.append([str(ec.Id), conn_id, str(eid_raw), action, old_loc, new_loc])

    TransactionManager.Instance.TransactionTaskDone()
    doc.Regenerate()

# Build Connection ID (upper) → move action and locations for use in write report
move_action_lookup = {
    str(r[1]).strip().upper(): r[3]
    for r in move_report if len(r) >= 4
}
move_loc_lookup = {
    str(r[1]).strip().upper(): (r[4], r[5])  # (old_loc, new_loc)
    for r in move_report if len(r) >= 6
}


# ═══════════════════════════════════════════════════════════════════════════════
# SECTION 9 — PARAMETER WRITE LOGIC
#
#   For each row in the Excel flat data:
#     1. Match to a Revit connector element by Connection ID.
#     2. Skip the element if its family is not in update_families.
#     3. For each Excel column:
#          a. Look up the Revit parameter name(s) in the UM-Revit Mapping.
#          b. Check family applicability — skip if mapping says "No" for this family.
#          c. Skip columns with empty / null / "-" Excel values.
#          d. For instance parameters: write directly via compare_and_set_param.
#          e. For type parameters: iterate family symbols to find a matching type
#             (handles Voltage & Phase → Family Type swap).
#
#   Report header:
#     [Revit Element ID] [Connection ID] [Family] [Update Status] [Moved]
#     [Original: <col>] [Updated: <col>]  ← one pair per writable Excel column
# ═══════════════════════════════════════════════════════════════════════════════

def write_parameters_to_revit(data_input, key_param_name, file_path):
    data = extract_flat_data(data_input)
    if not data or not key_param_name:
        return [["Error: Inputs are empty."]], [], 0, 0

    # Load UM-Revit Mapping (includes family applicability per column)
    um_revit_map = read_um_revit_mapping(file_path)

    # Build element lookup: Connection ID lowercase → connector element
    # Use existing_connectors (not all_elements) — Data Cubes and other
    # non-connector elements can have Connection ID set (Script 1), and if
    # they land last in iteration they overwrite connector entries in the dict.
    # The write loop then finds a Data Cube, sees it is not in update_families,
    # sets update_allowed=False, and writes nothing. Connectors are missed entirely.
    element_lookup = {}
    for el in existing_connectors:
        p = el.LookupParameter(key_param_name)
        if p:
            val = get_param_display_value(p)
            if val:
                element_lookup[val.strip().lower()] = el

    # Recover display-case column names from extractor mapping metadata
    col_case_map = {}
    mapping_entries = safe_get(data_input, "Mapping")
    if mapping_entries:
        try:
            for entry in mapping_entries:
                orig = safe_get(entry, "Excel Header") or ""
                if orig:
                    col_case_map[str(orig).strip().lower()] = str(orig).strip()
        except:
            pass

    # Build ordered list of Excel columns to process.
    # IMPORTANT: restrict to only columns in the explicit mapping list (col_case_map).
    # The extractor reads ALL sheet columns into each row dict, so raw passthrough
    # columns (e.g. the bare "Service" column when "Service Abbreviation" is the
    # mapped one) would otherwise sneak in here and trigger spurious writes.
    # Order is preserved from the Mapping list to keep the report column order stable.
    all_excel_cols = []
    seen_lower     = set()
    for mapped_lower, mapped_display in col_case_map.items():
        if mapped_lower not in seen_lower:
            seen_lower.add(mapped_lower)
            all_excel_cols.append(mapped_display)

    key_col_lower  = key_param_name.strip().lower()
    writable_cols  = [c for c in all_excel_cols if c.strip().lower() != key_col_lower]
    not_found_keys = set()
    params_written = 0
    params_skipped = 0

    # Build report header
    # "Original: Location" / "Updated: Location" give the ExcelGen a proper
    # before/after pair for moves, so the change is visible and highlighted.
    header_row = ["Revit Element ID", "Connection ID", "Family", "Update Status",
                  "Moved", "Parameters Changed", "Original: Location", "Updated: Location"]
    for col in writable_cols:
        header_row.extend(["Original: " + col, "Updated: " + col])
    processed_report = [header_row]

    TransactionManager.Instance.EnsureInTransaction(doc)

    for data_row in data:
        key_value = safe_get(data_row, key_col_lower)
        if key_value is None:
            continue

        element = element_lookup.get(str(key_value).strip().lower())
        if not element:
            not_found_keys.add(key_value)
            continue

        elem_fn        = get_family_name(element)
        update_allowed = elem_fn in update_families if update_families else False
        el_type        = doc.GetElement(element.GetTypeId())
        conn_id_upper  = str(key_value).strip().upper()
        moved_status   = move_action_lookup.get(conn_id_upper, "Not Processed")
        old_loc, new_loc = move_loc_lookup.get(conn_id_upper, ("", ""))

        inst_param_map = build_param_map(element)
        type_param_map = build_param_map(el_type) if el_type else {}

        element_was_updated = False
        changed_excel_cols = []
        values_row = [element.Id.ToString(), str(key_value), elem_fn, "Unchanged",
                      moved_status, "", old_loc, new_loc]

        for col in writable_cols:
            col_lower = col.strip().lower()
            new_val   = safe_get(data_row, col_lower)

            # — Resolve Revit parameter name(s) and family applicability ──────
            mapping_entry = um_revit_map.get(col_lower)

            if mapping_entry:
                revit_param_names   = mapping_entry["params"]
                applicable_families = mapping_entry["families"]
            else:
                # No UM-Revit entry — try direct name match on the element
                if col_lower in inst_param_map or col_lower in type_param_map:
                    revit_param_names   = [col]
                    applicable_families = []  # no restriction
                else:
                    values_row.extend(["", ""])
                    continue  # Column not found anywhere — skip

            # — Check family applicability ─────────────────────────────────────
            if applicable_families and not family_is_applicable(elem_fn, applicable_families):
                # Family not listed in UM-Revit Mapping (e.g. "Process Data Connector"
                # mapped from TD- prefix in Script 1). Fall back: if the mapped
                # parameter(s) physically exist on this element, allow the write.
                # Parameter presence is the ground truth — family-specific params
                # (e.g. Full Load Current on Electrical only) will simply not exist
                # on unlisted families and will be skipped naturally.
                param_exists_on_elem = any(
                    inst_param_map.get(rpn.strip().lower()) is not None or
                    type_param_map.get(rpn.strip().lower()) is not None
                    for rpn in revit_param_names
                )
                if not param_exists_on_elem:
                    values_row.extend(["", ""])
                    continue  # Param does not exist on element — genuinely not applicable
                # else: param exists — fall through and write it

            # ─────────────────────────────────────────────────────────────────
            # Per-column write logic:
            #
            #   Step 1 — Pre-read the BEFORE value for every mapped Revit param.
            #            Done before any write so we always have the true pre-run state.
            #
            #   Step 2 — Short-circuit for empty Excel value or unselected family.
            #            No write, before == after, cell stays white.
            #
            #   Step 3 — Write to ALL mapped params. For each one, record whether
            #            it actually changed (compare_and_set_param is idempotent).
            #            Track the first param that genuinely changed.
            #
            #   Step 4 — Choose display values for the report:
            #            • If a param changed  → use THAT param's before/after.
            #              This is critical for multi-param columns (e.g. Connection
            #              Size → [Nominal Diameter, Connection Size]) where the
            #              primary Double param may be unchanged while the secondary
            #              String param was updated. Without this, the report would
            #              show identical before/after even though Update Status=Updated.
            #            • If nothing changed  → use primary param's current value
            #              for both sides so the ExcelGen sees no diff → no highlight.
            # ─────────────────────────────────────────────────────────────────

            # Step 1 — pre-read before-values for all mapped params
            param_records = []  # (rpn_lower, param_obj, tp_obj, before_display)
            for rpn in revit_param_names:
                rpn_lower = rpn.strip().lower()
                p  = inst_param_map.get(rpn_lower)
                tp = type_param_map.get(rpn_lower)
                before = (get_param_display_value(p)  if p  is not None else
                          get_param_display_value(tp) if tp is not None else "")
                param_records.append((rpn_lower, p, tp, before))

            # Default display source: first param that exists on this element
            primary_before = param_records[0][3] if param_records else ""
            any_updated    = False

            # Step 2 — short-circuit: empty Excel value or family not selected
            if new_val is None or str(new_val).strip() in ("", "-", "None", "null"):
                values_row.extend([primary_before, primary_before])
                params_skipped += 1
                continue

            if not update_allowed:
                values_row.extend([primary_before, primary_before])
                continue

            # Step 3 — write to all mapped params, track the first actual change
            first_changed_before = None
            first_changed_param  = None

            col_was_updated = False
            for rpn_lower, param_to_set, tp_match, before_display in param_records:

                if param_to_set is not None and not param_to_set.IsReadOnly:
                    changed, _ = compare_and_set_param(param_to_set, new_val)
                    if changed:
                        if first_changed_before is None:
                            first_changed_before = before_display
                            first_changed_param  = rpn_lower
                        any_updated    = True
                        col_was_updated = True
                        params_written += 1
                    else:
                        params_skipped += 1

                elif tp_match is not None:
                    # Type parameter — search family symbols for matching type
                    if check_param_match(tp_match, new_val):
                        params_skipped += 1
                    else:
                        family = el_type.Family
                        for sym_id in family.GetFamilySymbolIds():
                            sym    = doc.GetElement(sym_id)
                            sym_pm = build_param_map(sym)
                            sym_p  = sym_pm.get(rpn_lower)
                            if sym_p and check_param_match(sym_p, new_val):
                                if not sym.IsActive: sym.Activate()
                                element.ChangeTypeId(sym_id)
                                if first_changed_before is None:
                                    first_changed_before = before_display
                                    first_changed_param  = rpn_lower
                                any_updated    = True
                                col_was_updated = True
                                el_type        = sym
                                type_param_map = build_param_map(el_type)
                                params_written += 1
                                break

            # Step 4 — choose display values for the report
            if any_updated:
                element_was_updated = True
                doc.Regenerate()

            current_type = doc.GetElement(element.GetTypeId())
            current_inst_param_map = build_param_map(element)
            current_type_param_map = build_param_map(current_type) if current_type else {}
            current_display = get_representative_display(
                revit_param_names,
                current_inst_param_map,
                current_type_param_map,
                preferred_name=first_changed_param,
            )

            if first_changed_before is not None:
                original_val_str = first_changed_before
                final_val_str    = current_display
            else:
                original_val_str = primary_before
                final_val_str    = current_display if str(current_display).strip() != "" else primary_before

            if col_was_updated:
                changed_excel_cols.append(col)

            values_row.extend([original_val_str, final_val_str])

        if element_was_updated:
            values_row[3] = "Updated"
        values_row[5] = ", ".join(changed_excel_cols)

        processed_report.append(values_row)

    TransactionManager.Instance.TransactionTaskDone()

    not_found_report = [["Key Value", "Status"]]
    for key in sorted(not_found_keys):
        not_found_report.append([key, "Element Not Found in Revit"])

    if len(processed_report) <= 1:
        processed_report = [["No matching elements were found to process."]]

    return processed_report, not_found_report, params_written, params_skipped


param_results = write_parameters_to_revit(extractor_output, key_parameter, excel_file_path)


# ═══════════════════════════════════════════════════════════════════════════════
# SECTION 10 — OUTPUT ASSEMBLY
#
#   OUT[0] — Connector update report  → ExcelGen "Connector Updates" sheet
#            List-of-lists. Header row, then one row per matched connector.
#            Columns: Revit Element ID, Connection ID, Family, Update Status,
#                     Moved, then Original/Updated pairs for each Excel column.
#
#   OUT[1] — Not-found report         → ExcelGen "Metrics" sheet
#            List-of-lists. Connectors whose Connection ID had no Revit match.
#
#   OUT[2] — Move detail report       → Watch node / optional downstream use
#            List of rows: [elem_id, conn_id, equip_id, action, old_loc, new_loc]
#
#   OUT[3] — Run metrics summary      → optional Watch node
#            Key/value summary of counts for the run.
# ═══════════════════════════════════════════════════════════════════════════════

moved_count  = sum(1 for r in move_report if r[3] == "Moved")
no_chg_count = sum(1 for r in move_report if r[3] == "No Change")
skip_fam     = sum(1 for r in move_report if r[3] == "Skipped (Family Not Selected)")

move_metrics = [
    ["Metric",                                            "Value"],
    ["Total Connectors Scanned",                          str(len(existing_connectors))],
    ["Families Selected for Move",                        str(len(moveable_families))],
    ["Families Selected for Update",                      str(len(update_families))],
    ["Connectors Moved",                                  str(moved_count)],
    ["Connectors Already In Place",                       str(no_chg_count)],
    ["Connectors Skipped (Family Not Selected for Move)", str(skip_fam)],
    ["Parameters Written",                                str(param_results[2]) if len(param_results) > 2 else "N/A"],
    ["Parameters Already Matched / Skipped",              str(param_results[3]) if len(param_results) > 3 else "N/A"],
]

OUT = [param_results[0], param_results[1], move_report, move_metrics]
# ----------------------------------------
watch_pw_output = Watch(parameter_writer)

# group: Excel Report generator
# ExcelGen + Config
# Takes the Param Writer's output and generates a formatted multi-sheet Excel report. Automatically adds a second "All Updates Only" sheet filtering to only rows where something actually changed — either a parameter was written or the connector was moved. Cells highlight yellow on a per-column basis: only the specific Original/Updated pairs that actually changed turn yellow, not the whole row. The Moved and Update Status columns highlight independently. Falls back to Desktop if the save path is invalid, saves a timestamped copy if the file is locked. Config supplies the save path (Update_Data_Report.xlsx), sheet names (Connector Updates, Metrics), and color theme (Blue).
report_config = CodeBlock()
# ---------- report_config.designscript (10 lines) ----------
// Graph 2 - Report Configuration

["Connector Updates","Metrics"];
 // OUT[0] -> ExcelGen.IN[1];

"Update_Data_Report.xlsx";
 // OUT[1] -> ExcelGen.IN[0];

"Blue";
 // OUT[2] -> ExcelGen.IN[2];
# ----------------------------------------
index_x_0 = CodeBlock(x=parameter_writer) { x[0]; }
index_x_1 = CodeBlock(x=parameter_writer) { x[1]; }
excelGen = Python(IN[0]=report_config.out1, IN[1]=report_config.out0, IN[2]=report_config.out2, IN[3]=index_x_0, IN[4]=index_x_1)  # CPython3
# ---------- excelGen.python (899 lines) ----------
# ExcelGen
# Excel Report Generator
# Revit 2023 / Dynamo 2.16 / CPython3
# Developed By - Chris Staker
# v1.9.3 - Fixed Moved cell false-positive highlight:
#            Moved cell now only turns yellow when connector was actually Moved.
#            Previously, Moved cell was yellow on ANY row change (param write or move).
#          - Removed Moved from anchor col set; handled per-cell with row_was_moved check.
#          - Connection ID + Original/Updated Equipment ID: yellow on any row change.
#          - All other changed Original/Updated pairs: yellow via changed_cols.
#          - Everything else: explicit white.

# ═══════════════════════════════════════════════════════════════════════════════
# SECTION 1 — CONFIGURATION CONSTANTS
# ═══════════════════════════════════════════════════════════════════════════════

DEPENDENCY_FOLDER_NAME = "Python Support Pckg"
LOCAL_LIBRARY_PATH     = r"C:\Dynamo\2.16\Python Support Pckg"
NETWORK_LIBRARY_PATH   = r"K:\CAD\_Revit2023\Add_Ins\Python Support Pckg"

# ═══════════════════════════════════════════════════════════════════════════════
# SECTION 2 — STANDARD LIBRARY IMPORTS & LOGGER
# ═══════════════════════════════════════════════════════════════════════════════

import sys
import os
import platform
import time
from datetime import datetime
from pathlib import Path
import re
import traceback
import colorsys


class Logger:
    def __init__(self):
        self.messages  = []
        self.start_time = time.time()

    def _record(self, message, level):
        timestamp = datetime.now().strftime("%H:%M:%S")
        elapsed   = round(time.time() - self.start_time, 2)
        try:
            msg_str = str(message).encode('utf-8', 'replace').decode('utf-8')
            self.messages.append("[{}][{}s][{}] {}".format(timestamp, elapsed, level, msg_str))
        except Exception:
            self.messages.append("[{}][{}s][ERROR] Error formatting log message.".format(timestamp, elapsed))

    def log(self, message):     self._record(message, "INFO")
    def error(self, message):   self._record(message, "ERROR")
    def warning(self, message): self._record(message, "WARN")
    def get_messages(self):     return self.messages

# ═══════════════════════════════════════════════════════════════════════════════
# SECTION 3 — DEPENDENCY PATH SETUP
# ═══════════════════════════════════════════════════════════════════════════════

def setup_library_paths(logger):
    logger.log("--- Running Dependency Check ---")
    for path, label in [(LOCAL_LIBRARY_PATH, "Local C Drive"), (NETWORK_LIBRARY_PATH, "Network Drive")]:
        logger.log("Checking {} for libraries...".format(label))
        if os.path.isdir(path):
            logger.log("Found library path on {}: {}".format(label, path))
            if path not in sys.path:
                sys.path.insert(0, path)
            return True, path, label
    logger.error("FAILURE: Could not find the required library folder.")
    return False, None, None


logger   = Logger()
logger.log("ExcelGen v1.8.0 Started")
path_found, found_path, location_name = setup_library_paths(logger)

if not path_found:
    OUT = ["FATAL ERROR: Could not find 'openpyxl' library.", logger.get_messages(), "0"]
else:
    try:
        import openpyxl
        from openpyxl.styles import PatternFill, Font, Alignment
        from openpyxl.utils import get_column_letter
        from openpyxl.worksheet.table import Table, TableStyleInfo
        logger.log("Successfully imported 'openpyxl' from {}.".format(location_name))
    except ImportError as e:
        OUT = ["FATAL ERROR: Import failed from '{}'. Details: {}".format(found_path, e),
               logger.get_messages(), "0"]
    else:

# ═══════════════════════════════════════════════════════════════════════════════
# SECTION 4 — CONSTANTS & THEME HELPERS
# ═══════════════════════════════════════════════════════════════════════════════

        MAX_SHEET_NAME_LENGTH = 31
        MAX_COLUMN_WIDTH      = 120

        # Highlighting colors
        CHANGED_COLOR_A = "FFFFFF99"  # Soft yellow — changed rows (even)
        CHANGED_COLOR_B = "FFFFFFCC"  # Lighter yellow — changed rows (odd)
        BASE_TABLE_STYLE = "TableStyleMedium2"

        def create_theme_shades(hex_color):
            try:
                hex_color = hex_color.lstrip('#')
                r, g, b   = (int(hex_color[i:i+2], 16) / 255.0 for i in (0, 2, 4))
                h, l, s   = colorsys.rgb_to_hls(r, g, b)
                # Summary block: lighter shade of theme color
                sum_l      = l + (1 - l) * 0.70
                sr, sg, sb = [int(c * 255) for c in colorsys.hls_to_rgb(h, sum_l, s)]
                # Stripe shade (used by Simple reports)
                str_l      = l + (1 - l) * 0.90
                str_s      = s * 0.5
                xr, xg, xb = [int(c * 255) for c in colorsys.hls_to_rgb(h, str_l, str_s)]
                return {
                    "summary": "FF{:02X}{:02X}{:02X}".format(sr, sg, sb),
                    "stripe":  "FF{:02X}{:02X}{:02X}".format(xr, xg, xb),
                }
            except Exception:
                return {"summary": "FFF0F0F0", "stripe": "FFF9F9F9"}

        def get_theme_config(theme_input, logger):
            THEMES = {
                "blue": "4472C4", "green": "70AD47", "red": "C5504B",
                "purple": "7030A0", "orange": "ED7D31", "teal": "264653"
            }
            theme_str = str(theme_input).lower().strip() if theme_input else "blue"
            hex_color = THEMES.get(theme_str)
            if not hex_color:
                hex_color = theme_str.lstrip('#')
                if not (len(hex_color) == 6 and all(c in '0123456789abcdef' for c in hex_color)):
                    logger.warning("Invalid theme '{}'. Using 'blue'.".format(theme_str))
                    hex_color = THEMES["blue"]
            shades = create_theme_shades(hex_color)
            return {
                "header_color":       "FF" + hex_color.upper(),
                "summary_background": shades["summary"],
                "stripe_background":  shades["stripe"],
                "log_header_color":   "FF" + hex_color.upper(),
            }

# ═══════════════════════════════════════════════════════════════════════════════
# SECTION 5 — HELPER FUNCTIONS
# ═══════════════════════════════════════════════════════════════════════════════

        def safe_cell_value(value):
            if value is None: return ""
            try:    str_value = str(value)
            except: str_value = repr(value)
            str_value = re.sub(r'[\x00-\x08\x0B\x0C\x0E-\x1F\x7F]', '', str_value)
            return str_value[:32767]

        def create_safe_table_name(sheet_name):
            safe_name = re.sub(r'[^\w]', '', sheet_name)
            if not safe_name or not safe_name[0].isalpha():
                safe_name = "Table" + safe_name
            return safe_name[:250] + "Data"

        def should_center_align(value):
            if value is None or value == "": return True
            return len(str(value).strip()) <= 35

        def validate_filepath(filepath, logger):
            is_valid = False
            if filepath and isinstance(filepath, str) and filepath.strip():
                filepath = filepath.strip()
                dir_name = os.path.dirname(filepath)
                if dir_name and os.path.isdir(dir_name):
                    is_valid = True
                    logger.log("Using provided filepath: '{}'".format(filepath))
            if not is_valid:
                logger.log("Creating default save path on Desktop...")
                try:
                    home_dir     = os.path.expanduser("~")
                    desktop_path = os.path.join(home_dir, "Desktop")
                    for item in os.listdir(home_dir):
                        if "onedrive" in item.lower():
                            od = os.path.join(home_dir, item, "Desktop")
                            if os.path.isdir(od):
                                desktop_path = od
                                break
                    base_name = (os.path.basename(filepath.strip())
                                 if filepath and isinstance(filepath, str) and filepath.strip()
                                 else "")
                    if not base_name:
                        base_name = "Multi_Sheet_Report_{}.xlsx".format(
                            datetime.now().strftime('%Y%m%d_%H%M%S'))
                    if not base_name.lower().endswith('.xlsx'):
                        base_name = os.path.splitext(base_name)[0] + ".xlsx"
                    filepath = os.path.join(desktop_path, base_name)
                    logger.log("Generated Desktop path: {}".format(filepath))
                except Exception as e:
                    logger.error("Could not create default path: {}".format(e))
                    return False, None, True
            if not filepath.lower().endswith('.xlsx'):
                filepath += '.xlsx'
            return True, filepath, not is_valid

        def validate_sheet_name(sheet_name, logger):
            if not sheet_name:
                return "Report Sheet"
            sheet_name = re.sub(r'[\\/?*\[\]:]', '_', str(sheet_name)).strip("'\"")
            if len(sheet_name) > MAX_SHEET_NAME_LENGTH:
                sheet_name = sheet_name[:MAX_SHEET_NAME_LENGTH]
                logger.warning("Sheet name truncated to {} chars.".format(MAX_SHEET_NAME_LENGTH))
            return sheet_name

        def normalize_data_package(package, logger):
            """Converts any supported data shape to (headers_list, columns_list, error)."""
            # List of lists (table format — primary format from parameter writer)
            if (isinstance(package, list) and len(package) > 0 and
                    all(isinstance(row, list) for row in package)):
                logger.log("Detected list-of-lists (table) format.")
                headers    = package[0]
                data_rows  = package[1:]
                n_headers  = len(headers)
                sanitized  = []
                for i, row in enumerate(data_rows):
                    n = len(row)
                    if n < n_headers:
                        sanitized.append(row + [''] * (n_headers - n))
                    elif n > n_headers:
                        sanitized.append(row[:n_headers])
                    else:
                        sanitized.append(row)
                if not sanitized:
                    return headers, [[] for _ in headers], None
                data_columns = list(map(list, zip(*sanitized)))
                return headers, data_columns, None

            # Legacy [headers_list, data_dict]
            if (isinstance(package, list) and len(package) == 2 and
                    isinstance(package[0], list) and isinstance(package[1], dict)):
                logger.log("Detected legacy [headers, dict] format.")
                headers      = package[0]
                data_columns = [package[1].get(h, []) for h in headers]
                return headers, data_columns, None

            # Column-oriented dict
            if isinstance(package, dict):
                logger.log("Detected column-oriented dict format.")
                if not package: return [], [], None
                headers      = list(package.keys())
                data_columns = [v if isinstance(v, list) else [v] for v in package.values()]
                return headers, data_columns, None

            # Row-oriented list of dicts
            if isinstance(package, list) and (not package or all(isinstance(i, dict) for i in package)):
                logger.log("Detected row-oriented list-of-dicts format.")
                if not package: return [], [], None
                ordered_headers = []
                header_set      = set()
                for row in package:
                    for key in row.keys():
                        if key not in header_set:
                            header_set.add(key)
                            ordered_headers.append(key)
                data_columns = [[row.get(h) for row in package] for h in ordered_headers]
                return ordered_headers, data_columns, None

            # Simple list
            if isinstance(package, list):
                logger.log("Detected simple list format.")
                return ["Value"], [package], None

            err = "Data package has an unrecognized format or is null."
            logger.error(err)
            return None, None, err

# ═══════════════════════════════════════════════════════════════════════════════
# SECTION 6 — COMPARISON REPORT DATA PROCESSOR
#
#   Identifies "Original:" / "Updated:" column pairs, compares values row by row,
#   and returns per-row change metadata alongside aggregate statistics.
# ═══════════════════════════════════════════════════════════════════════════════

        def process_comparison_data(data_columns, headers, logger):
            """
            Processes the writer's report (list-of-columns) to identify which
            Original/Updated cell pairs actually changed.

            Returns:
              report_data — list of {data, changed, changed_cols} per row
                            data rows are NOT modified (no extra column appended)
              stats       — {total, changed, no_change, errors}

            has_changed is sourced from the writer's "Update Status" column
            ("Updated" / "Unchanged") which is authoritative. changed_cols
            tracks which 0-based column indices hold changed Original/Updated
            values so ExcelGen can highlight exactly those cells.
            """
            report_data = []
            stats       = {"total": 0, "changed": 0, "no_change": 0, "errors": 0}
            if not data_columns or not any(data_columns):
                return report_data, stats

            # Locate the writer's authoritative status columns
            update_status_idx = next(
                (i for i, h in enumerate(headers)
                 if str(h).strip().lower() == 'update status'),
                None
            )
            params_changed_idx = next(
                (i for i, h in enumerate(headers)
                 if str(h).strip().lower() == 'parameters changed'),
                None
            )

            # Build Original/Updated column index pairs from header names
            original_cols, updated_cols = {}, {}
            for idx, header in enumerate(headers):
                h_lower = str(header).lower()
                for prefix in ('original:', 'original '):
                    if h_lower.startswith(prefix):
                        original_cols[h_lower[len(prefix):].strip()] = idx
                for prefix in ('updated:', 'updated '):
                    if h_lower.startswith(prefix):
                        updated_cols[h_lower[len(prefix):].strip()] = idx

            comparison_pairs = [
                (original_cols[k], updated_cols[k])
                for k in original_cols if k in updated_cols
            ]

            n_rows = len(data_columns[0]) if data_columns and data_columns[0] else 0
            for i in range(n_rows):
                stats["total"] += 1
                try:
                    row_data = [(col[i] if i < len(col) else "") for col in data_columns]

                    # Find changed Original/Updated pairs.
                    # A pair is "changed" only when the values genuinely differ AND
                    # it's not just two empty strings (non-applicable column for this family).
                    changed_pair_indices = set()
                    for orig_idx, upd_idx in comparison_pairs:
                        orig_val = str(row_data[orig_idx]).strip()
                        upd_val  = str(row_data[upd_idx]).strip()
                        if orig_val == upd_val:
                            continue  # identical — no change
                        if orig_val == "" and upd_val == "":
                            continue  # both empty — column not applicable to this family
                        changed_pair_indices.add(orig_idx)
                        changed_pair_indices.add(upd_idx)

                    # Also trust the writer's authoritative "Parameters Changed"
                    # list so the highlight remains correct even when the visible
                    # before/after strings normalize to the same display text.
                    if params_changed_idx is not None and params_changed_idx < len(row_data):
                        changed_names = [
                            name.strip().lower()
                            for name in str(row_data[params_changed_idx]).split(',')
                            if str(name).strip()
                        ]
                        for changed_name in changed_names:
                            if changed_name in original_cols and changed_name in updated_cols:
                                changed_pair_indices.add(original_cols[changed_name])
                                changed_pair_indices.add(updated_cols[changed_name])

                    # has_changed drives anchor highlighting and the stats counter.
                    # Use the writer's authoritative columns: Update Status and Moved.
                    was_updated = (update_status_idx is not None and
                                   str(row_data[update_status_idx]).strip() == "Updated")
                    moved_idx_  = next(
                        (i for i, h in enumerate(headers) if str(h).strip().lower() == 'moved'),
                        None
                    )
                    was_moved   = (moved_idx_ is not None and
                                   str(row_data[moved_idx_]).strip() == "Moved")
                    has_changed = was_updated or was_moved

                    stats["changed" if has_changed else "no_change"] += 1
                    # Do NOT append any extra column — row_data stays exactly as received
                    report_data.append({
                        'data':         row_data,
                        'changed':      has_changed,
                        'changed_cols': changed_pair_indices,
                    })
                except Exception as e:
                    stats["errors"] += 1
                    logger.error("Error processing row {}: {}".format(i, e))
                    report_data.append({'data': [], 'changed': False, 'changed_cols': set()})

            logger.log("Comparison processing done: {}".format(stats))
            return report_data, stats

# ═══════════════════════════════════════════════════════════════════════════════
# SECTION 7 — SHEET CREATOR
#
#   Creates and formats a single worksheet. Handles three report types:
#
#   Comparison  — Connector Updates style.
#                 • Summary block (rows 1-6) with run stats.
#                 • Data table starting at row 8.
#                 • Pin columns (ID, Connection ID, Family, Status, Moved):
#                   always light theme tint.
#                 • Changed Original/Updated pairs: soft yellow.
#                 • All other data cells: explicit white.
#
#   Simple      — Key/value or plain table. Optional summary header block.
#                 Alternating row striping.
#
#   Error       — Placeholder sheet written when data is null/invalid.
# ═══════════════════════════════════════════════════════════════════════════════

        def process_and_create_sheet(wb, sheet_config, logger, used_table_names,
                                     theme_config, total_changed_counter):
            validated_name = ""
            try:
                config_name  = sheet_config.get('name', 'Report Sheet')
                report_type  = sheet_config.get('type')
                validated_name = validate_sheet_name(config_name, logger)
                logger.log("--- Processing Sheet: '{}' (Type: {}) ---".format(
                    validated_name, report_type or 'Unknown'))
                ws = wb.create_sheet(title=validated_name)

                # ── Error placeholder ─────────────────────────────────────────
                if report_type == 'Error':
                    ws['A1'] = "Data Error"
                    ws['A1'].font = Font(bold=True, size=16, color="C00000")
                    ws['A2'] = sheet_config.get('error_message', 'Unspecified error.')
                    ws.column_dimensions['A'].width = 100
                    ws['A2'].alignment = Alignment(wrap_text=True, vertical='top')
                    return True

                data_headers = sheet_config.get('headers', [])
                data_columns = sheet_config.get('columns', [])

                # Build fill/font palettes
                fills = {
                    "header":  PatternFill(start_color=theme_config['header_color'],      fill_type='solid'),
                    "summary": PatternFill(start_color=theme_config['summary_background'], fill_type='solid'),
                    "stripe":  PatternFill(start_color=theme_config['stripe_background'],  fill_type='solid'),
                    "white":   PatternFill(start_color="FFFFFFFF",                        fill_type='solid'),
                }
                fonts = {
                    "header": Font(bold=True, color="FFFFFF"),
                    "bold":   Font(bold=True),
                    "italic": Font(italic=True),
                }
                center_align = Alignment(horizontal='center', vertical='center')
                right_align  = Alignment(horizontal='right',  vertical='center')

                # ── Simple report ─────────────────────────────────────────────
                if report_type == 'Simple':
                    summary_header_data = sheet_config.get('summary_header')
                    start_col   = 2 if summary_header_data else 1
                    data_start  = 8 if summary_header_data else 1

                    if summary_header_data:
                        title_cell = ws.cell(row=1, column=1, value="Execution Summary")
                        title_cell.font      = fonts['bold']
                        title_cell.alignment = center_align
                        ws.merge_cells(start_row=1, start_column=1, end_row=1, end_column=2)
                        for r_idx, (key, value) in enumerate(summary_header_data.items(), 2):
                            ws.cell(row=r_idx, column=1, value=key).font = fonts['bold']
                            ws.cell(row=r_idx, column=2, value=safe_cell_value(value))
                        for row in ws.iter_rows(min_row=1,
                                                max_row=len(summary_header_data) + 1,
                                                min_col=1, max_col=2):
                            for cell in row: cell.fill = fills['summary']

                    if data_headers:
                        for i, value in enumerate(data_headers, start_col):
                            c           = ws.cell(row=data_start, column=i, value=value)
                            c.font      = fonts['header']
                            c.fill      = fills['header']
                            c.alignment = center_align

                        n_rows = len(data_columns[0]) if data_columns and data_columns[0] else 0
                        for i in range(n_rows):
                            for j, col in enumerate(data_columns, start_col):
                                cell_value  = safe_cell_value(col[i] if i < len(col) else "")
                                cell        = ws.cell(row=data_start + 1 + i, column=j, value=cell_value)
                                if should_center_align(cell_value):
                                    cell.alignment = center_align

                        end_col = start_col + len(data_headers) - 1
                        if n_rows > 0:
                            for i, row_obj in enumerate(ws.iter_rows(
                                    min_row=data_start + 1, max_row=data_start + n_rows,
                                    min_col=start_col, max_col=end_col)):
                                if (i + 1) % 2 == 0:
                                    for cell in row_obj: cell.fill = fills['stripe']

                        range_str      = "{}{}:{}{}".format(
                            get_column_letter(start_col), data_start,
                            get_column_letter(end_col), data_start + n_rows)
                        safe_tbl_name  = create_safe_table_name(validated_name)
                        tbl            = Table(displayName=safe_tbl_name, ref=range_str)
                        tbl.tableStyleInfo = TableStyleInfo(
                            name=BASE_TABLE_STYLE,
                            showFirstColumn=False, showLastColumn=False,
                            showRowStripes=False,  showColumnStripes=False)
                        ws.add_table(tbl)

                # ── Comparison report ─────────────────────────────────────────
                elif report_type == 'Comparison':
                    report_data, stats = process_comparison_data(data_columns, data_headers, logger)
                    # report_headers = data_headers exactly — writer already includes
                    # "Update Status" at position 3. Do NOT append a duplicate column.
                    report_headers = data_headers
                    total_changed_counter[0] += stats['changed']

                    # Summary block (rows 1-6)
                    ws['A1'] = "Report Summary"
                    ws['A1'].font      = fonts['bold']
                    ws['A1'].alignment = center_align
                    ws.merge_cells('A1:B1')
                    for cell in ws['A1:A1'][0]: cell.fill = fills['summary']
                    for cell in ws['B1:B1'][0]: cell.fill = fills['summary']

                    summary_rows = {
                        "Total Rows:":  stats['total'],
                        "Changed:":     stats['changed'],
                        "No Change:":   stats['no_change'],
                        "Errors:":      stats['errors'],
                    }
                    for i, (key, value) in enumerate(summary_rows.items(), 2):
                        ws.cell(row=i, column=1, value=key).font = fonts['bold']
                        ws.cell(row=i, column=2, value=value).alignment = right_align
                    timestamp_str = datetime.now().strftime("%Y-%m-%d %H:%M:%S")
                    ws.merge_cells('A6:B6')
                    ws['A6'].value     = "Generated: {}".format(timestamp_str)
                    ws['A6'].font      = fonts['italic']
                    ws['A6'].alignment = center_align
                    for row in ws['A1:B6']:
                        for cell in row: cell.fill = fills['summary']

                    data_start = 8

                    # Header row
                    for i, value in enumerate(report_headers, 1):
                        cell           = ws.cell(row=data_start, column=i, value=value)
                        cell.font      = fonts['header']
                        cell.fill      = fills['header']
                        cell.alignment = center_align

                    # Data rows — write values
                    for i, row_info in enumerate(report_data):
                        for j, value in enumerate(row_info['data'], 1):
                            ws.cell(row=data_start + 1 + i, column=j,
                                    value=safe_cell_value(value)).alignment = center_align

                    # ── Highlighting rules (v1.9.2) ───────────────────────────
                    # A row is only highlighted if something actually changed.
                    # "Changed" = Update Status == "Updated" OR Moved == "Moved".
                    # When a row HAS changes:
                    #   - Connection ID column                    → yellow
                    #   - Update Status column                    → yellow when == "Updated"
                    #   - Moved column                            → yellow
                    #   - Original/Updated Equipment ID           → yellow
                    #   - Original/Updated Location (if moved)    → yellow via changed_cols
                    #   - All other changed Original/Updated pairs → yellow via changed_cols
                    # When a row has NO changes → everything white, no exceptions.
                    CHANGED_FILL = PatternFill(start_color="FFFF00", fill_type='solid')

                    # ID anchor columns that get highlighted whenever the row has changes
                    # Anchor col indices: Connection ID + Equip ID pair
                    # (highlighted yellow whenever the row has ANY change)
                    # 'Moved' is handled per-cell below (only yellow if == 'Moved')
                    id_anchor_col_indices = {
                        idx + 1
                        for idx, h in enumerate(report_headers)
                        if str(h).strip().lower() in (
                            'connection id',
                            'original: equipment id', 'updated: equipment id'
                        )
                    }

                    # Find the 1-based column index for 'Update Status' / 'Moved'
                    update_status_col_1based = next(
                        (idx + 1 for idx, h in enumerate(report_headers)
                         if str(h).strip().lower() == 'update status'),
                        None
                    )
                    moved_col_1based = next(
                        (idx + 1 for idx, h in enumerate(report_headers)
                         if str(h).strip().lower() == 'moved'),
                        None
                    )

                    if report_data:
                        for i, row_obj in enumerate(ws.iter_rows(
                                min_row=data_start + 1, max_row=ws.max_row,
                                min_col=1, max_col=len(report_headers))):
                            if i >= len(report_data): break
                            row_info     = report_data[i]
                            changed_cols = row_info.get('changed_cols', set())
                            row_changed  = row_info.get('changed', False)
                            row_data_vals = row_info.get('data', [])

                            # Pre-compute: did this row actually update / move?
                            update_status_col_0 = (
                                update_status_col_1based - 1
                                if update_status_col_1based else None
                            )
                            row_was_updated = (
                                update_status_col_0 is not None and
                                update_status_col_0 < len(row_data_vals) and
                                str(row_data_vals[update_status_col_0]).strip() == 'Updated'
                            )
                            moved_col_0 = (moved_col_1based - 1) if moved_col_1based else None
                            row_was_moved = (
                                moved_col_0 is not None and
                                moved_col_0 < len(row_data_vals) and
                                str(row_data_vals[moved_col_0]).strip() == 'Moved'
                            )

                            for cell in row_obj:
                                col_0 = cell.column - 1  # 0-based

                                if row_changed and cell.column in id_anchor_col_indices:
                                    # Connection ID + Equipment ID pair: yellow on any change
                                    cell.fill = CHANGED_FILL
                                elif update_status_col_1based and cell.column == update_status_col_1based:
                                    # Update Status cell: yellow ONLY if this connector was actually updated
                                    cell.fill = CHANGED_FILL if row_was_updated else fills['white']
                                elif moved_col_1based and cell.column == moved_col_1based:
                                    # Moved cell: yellow ONLY if this connector was actually moved
                                    cell.fill = CHANGED_FILL if row_was_moved else fills['white']
                                elif col_0 in changed_cols:
                                    # This specific Original/Updated pair changed
                                    cell.fill = CHANGED_FILL
                                else:
                                    # No change here — white
                                    cell.fill = fills['white']

                        # Freeze panes below summary + header
                        ws.freeze_panes = ws.cell(row=data_start + 1, column=1)

                        # Excel table
                        range_str     = "A{}:{}{}".format(
                            data_start,
                            get_column_letter(len(report_headers)),
                            data_start + len(report_data))
                        safe_tbl_name = create_safe_table_name(validated_name)
                        ctr = 1
                        while safe_tbl_name in used_table_names:
                            safe_tbl_name = "{}{}".format(
                                create_safe_table_name(validated_name), ctr)
                            ctr += 1
                        used_table_names.add(safe_tbl_name)
                        tbl = Table(displayName=safe_tbl_name, ref=range_str)
                        tbl.tableStyleInfo = TableStyleInfo(
                            name=BASE_TABLE_STYLE,
                            showFirstColumn=False, showLastColumn=False,
                            showRowStripes=False,  showColumnStripes=False)
                        ws.add_table(tbl)

                # ── Column auto-sizing ────────────────────────────────────────
                col_widths = {}
                for row in ws.rows:
                    for cell in row:
                        if cell.value:
                            adjusted = (len(str(cell.value)) * 1.15) + 1
                            col_widths[cell.column] = max(col_widths.get(cell.column, 0), adjusted)
                for col_idx, max_len in col_widths.items():
                    ws.column_dimensions[get_column_letter(col_idx)].width = min(max_len, MAX_COLUMN_WIDTH)

                logger.log("Sheet '{}' created successfully.".format(validated_name))
                return True

            except Exception as e:
                logger.error("Failed to process sheet '{}': {}\n{}".format(
                    validated_name or 'Unknown', e, traceback.format_exc()))
                return False

# ═══════════════════════════════════════════════════════════════════════════════
# SECTION 8 — WORKBOOK ORCHESTRATOR
# ═══════════════════════════════════════════════════════════════════════════════

        def create_multi_sheet_excel_report(filepath, sheet_configs, logger,
                                            theme_config, total_changed_counter):
            is_path_valid, validated_filepath, is_default_path = validate_filepath(filepath, logger)
            if not is_path_valid:
                return False, "Filepath validation failed."
            try:
                wb = openpyxl.Workbook()
                wb.remove(wb.active)
                used_sheet_names = set()
                used_table_names = set()
                sheet_count      = 0

                for config in sheet_configs:
                    orig_name  = config.get('name', 'Report Sheet')
                    valid_name = validate_sheet_name(orig_name, logger)
                    final_name = valid_name
                    ctr        = 1
                    while final_name in used_sheet_names:
                        suffix     = "_{}".format(ctr)
                        final_name = valid_name[:MAX_SHEET_NAME_LENGTH - len(suffix)] + suffix
                        ctr       += 1
                    if final_name != orig_name:
                        logger.warning("Sheet '{}' renamed to '{}'.".format(orig_name, final_name))
                    config['name'] = final_name
                    used_sheet_names.add(final_name)

                    if process_and_create_sheet(wb, config, logger, used_table_names,
                                               theme_config, total_changed_counter):
                        sheet_count += 1

                if sheet_count == 0:
                    logger.warning("No data sheets were created.")

                # ── Script Log sheet ──────────────────────────────────────────
                log_ws = wb.create_sheet(title="Script Log")
                log_ws.append(["Timestamp", "Elapsed (s)", "Level", "Message"])
                pattern   = re.compile(r"\[(.*?)\]\[(.*?)s\]\[(.*?)\] (.*)", re.DOTALL)
                hdr_fill  = PatternFill(start_color=theme_config['log_header_color'], fill_type='solid')
                stripe_f  = PatternFill(start_color='FFEAEAEA', fill_type='solid')
                error_f   = PatternFill(start_color='FFFFC7CE', fill_type='solid')
                warn_f    = PatternFill(start_color='FFFFEB9C', fill_type='solid')
                hdr_font  = Font(bold=True, color="FFFFFF")
                center_a  = Alignment(horizontal='center', vertical='center')
                wrap_a    = Alignment(horizontal='left', vertical='top', indent=1, wrap_text=True)

                for msg in logger.get_messages():
                    m = pattern.match(msg)
                    if m: log_ws.append([m.group(1), float(m.group(2)), m.group(3), m.group(4)])
                    else:  log_ws.append(["", "", "", msg])

                for cell in log_ws["1:1"]:
                    cell.font, cell.fill, cell.alignment = hdr_font, hdr_fill, center_a
                for row_num in range(2, log_ws.max_row + 1):
                    fill = stripe_f if row_num % 2 == 0 else None
                    level = log_ws.cell(row=row_num, column=3).value
                    if level == "ERROR": fill = error_f
                    elif level == "WARN": fill = warn_f
                    for col_num in range(1, 5):
                        c = log_ws.cell(row=row_num, column=col_num)
                        c.alignment = wrap_a if col_num == 4 else center_a
                        if fill: c.fill = fill

                for col, width in [('A', 12), ('B', 12), ('C', 10), ('D', 100)]:
                    log_ws.column_dimensions[col].width = width
                log_ws.freeze_panes = 'A2'

                # ── Save ──────────────────────────────────────────────────────
                final_fp = validated_filepath
                logger.log("Saving workbook to: {}".format(final_fp))
                try:
                    wb.save(filename=final_fp)
                except PermissionError:
                    logger.warning("Save failed — file is open. Saving with timestamp suffix.")
                    p        = Path(validated_filepath)
                    final_fp = p.with_name("{}_{}{}".format(
                        p.stem, datetime.now().strftime('%Y%m%d_%H%M%S'), p.suffix))
                    wb.save(filename=final_fp)

                if platform.system() == "Windows":
                    os.startfile(final_fp)

                return True, "Excel report with {} sheet(s) created: {}".format(
                    sheet_count, os.path.basename(final_fp))

            except Exception as e:
                msg = "Unexpected error: {}\n{}".format(e, traceback.format_exc())
                logger.error(msg)
                return False, msg

# ═══════════════════════════════════════════════════════════════════════════════
# SECTION 9 — MAIN ENTRY POINT
#
#   Parses inputs, classifies each data package (Simple vs Comparison),
#   auto-generates an "All Updates Only" companion sheet for any Comparison
#   sheet (filtering to rows where Update Status = "Updated"), then
#   calls the workbook orchestrator.
# ═══════════════════════════════════════════════════════════════════════════════

        def main():
            try:
                if len(IN) < 3:
                    raise ValueError("Insufficient inputs. Expected filepath, sheet_names, theme.")

                filepath, sheet_names, theme_input = IN[0], IN[1], IN[2]
                data_packages = IN[3:]
                theme_config  = get_theme_config(theme_input, logger)
                sheet_names   = [sheet_names] if isinstance(sheet_names, str) else sheet_names

                if not isinstance(sheet_names, list):
                    raise TypeError("Sheet names (IN[1]) must be a list.")

                n_names    = len(sheet_names)
                n_packages = len(data_packages)
                n_process  = min(n_names, n_packages)
                if n_names != n_packages:
                    logger.warning("Name/package count mismatch ({} vs {}). "
                                   "Processing {}.".format(n_names, n_packages, n_process))

                total_changed_counter = [0]
                sheet_configs         = []

                # ── Build sheet configs ───────────────────────────────────────
                for i in range(n_process):
                    sheet_name = sheet_names[i]
                    package    = data_packages[i]
                    headers, data_columns, error = normalize_data_package(package, logger)

                    if error:
                        logger.error("Invalid data for sheet '{}': {}".format(sheet_name, error))
                        sheet_configs.append({
                            'name': sheet_name,
                            'type': 'Error',
                            'error_message': ("The data package for this sheet was null or "
                                              "in an unrecognized format. See Script Log.")
                        })
                        continue

                    config       = {'name': sheet_name, 'headers': headers, 'columns': data_columns}
                    header_str   = ' '.join(str(h) for h in headers).lower()
                    is_sow_log   = isinstance(package, dict) and 'debug_log' in package

                    if is_sow_log:
                        config['type']           = 'Simple'
                        summary_data             = {k: (v[0] if isinstance(v, list) and len(v) == 1 else v)
                                                    for k, v in package.items() if k != 'debug_log'}
                        config['summary_header'] = summary_data
                        config['headers']        = ['Log Messages']
                        config['columns']        = [package.get('debug_log', [])]
                    elif 'original' in header_str and 'updated' in header_str:
                        logger.log("Classifying '{}' as Comparison report.".format(sheet_name))
                        config['type']           = 'Comparison'
                        config['summary_header'] = None
                    else:
                        logger.log("Classifying '{}' as Simple report.".format(sheet_name))
                        config['type']           = 'Simple'
                        config['summary_header'] = None

                    sheet_configs.append(config)

                # ── Auto-add "All Updates Only" for Comparison sheets ─────────
                # Includes rows where Update Status == "Updated" (param changes)
                # OR Moved == "Moved" (position changed), so nothing is missed.
                auto_sheets = []
                for i in range(n_process):
                    cfg = sheet_configs[i] if i < len(sheet_configs) else None
                    if not cfg or cfg.get('type') != 'Comparison':
                        continue
                    raw_pkg = data_packages[i]
                    if not (isinstance(raw_pkg, list) and len(raw_pkg) > 1 and
                            isinstance(raw_pkg[0], list)):
                        continue

                    hdr        = raw_pkg[0]
                    status_idx = next(
                        (j for j, h in enumerate(hdr) if str(h).strip().lower() == 'update status'),
                        None
                    )
                    moved_idx  = next(
                        (j for j, h in enumerate(hdr) if str(h).strip().lower() == 'moved'),
                        None
                    )
                    if status_idx is None and moved_idx is None:
                        continue

                    def row_has_any_change(r):
                        was_updated = (status_idx is not None and
                                       len(r) > status_idx and
                                       str(r[status_idx]).strip() == 'Updated')
                        was_moved   = (moved_idx is not None and
                                       len(r) > moved_idx and
                                       str(r[moved_idx]).strip() == 'Moved')
                        return was_updated or was_moved

                    filtered = [hdr] + [r for r in raw_pkg[1:] if row_has_any_change(r)]
                    if len(filtered) <= 1:
                        logger.log("No updated rows found for 'All Updates Only' sheet.")
                        continue

                    fh, fc, ferr = normalize_data_package(filtered, logger)
                    if ferr:
                        continue

                    auto_sheets.append({
                        'name':           'All Updates Only',
                        'type':           'Comparison',
                        'headers':        fh,
                        'columns':        fc,
                        'summary_header': None,
                    })
                    logger.log("Auto-added 'All Updates Only' with {} updated row(s).".format(
                        len(filtered) - 1))

                sheet_configs.extend(auto_sheets)

                if not sheet_configs:
                    logger.warning("No sheet configurations assembled.")

                success, message = create_multi_sheet_excel_report(
                    filepath, sheet_configs, logger, theme_config, total_changed_counter)

                logger.log("Script {}.".format("completed successfully" if success else "completed with errors"))
                return [message, logger.get_messages(), str(total_changed_counter[0])]

            except Exception as e:
                err = "Fatal error in main(): {}\n{}".format(e, traceback.format_exc())
                logger.error(err)
                return [err, logger.get_messages(), "0"]

        OUT = main()
# ----------------------------------------
watch_excelgen = Watch(excelGen)
