# Dynamo graph PlaceMCCOneLine.dyn "claude1" (Dynamo 2.16.4.10216)
# claude1: geministepping bus dropdown + precise centering, plus test2's Excel pick, sheet pick, and motor placement. Motor positions are placeholder; tune the MOTOR LAYOUT constants once measurements are confirmed.

# group: 1. Pick workbook
pick_excel_file = Python()  # CPython3
# ---------- pick_excel_file.python (31 lines) ----------
import clr
clr.AddReference('System.Windows.Forms')

from System import Environment
from System.Windows.Forms import (
    OpenFileDialog, DialogResult, MessageBox,
    MessageBoxButtons, MessageBoxIcon
)

MessageBox.Show(
    'Select your MCC/Motor data excel sheet.\n\n'
    'The workbook must contain a sheet named "MCC Info" '
    'with columns: MCC, BUCKET, EQUIP ID, DESCRIPTION, '
    'BUCKET TYPE, REVIT FAMILY, FAMILY TYPE.',
    'claude1 - MCC One-Line Layout',
    MessageBoxButtons.OK,
    MessageBoxIcon.Information
)

dialog = OpenFileDialog()
dialog.Title = 'Select your MCC/Motor data excel sheet'
dialog.Filter = 'Excel workbooks (*.xlsm;*.xlsx)|*.xlsm;*.xlsx|All files (*.*)|*.*'
dialog.CheckFileExists = True
dialog.Multiselect = False
dialog.RestoreDirectory = True
dialog.InitialDirectory = Environment.GetFolderPath(Environment.SpecialFolder.Desktop)

if dialog.ShowDialog() != DialogResult.OK:
    raise Exception('Excel file selection was cancelled.')

OUT = dialog.FileName
# ----------------------------------------

# group: 2. Layout controls
header_row_index = DoubleInput(0)
family_type_column = DoubleInput(6)
motor_gap_additive_ft = DoubleInput(0)
unused_1 = DoubleInput(0)
unused_2 = DoubleInput(0)

# group: 3. Pick bus + sheet, place bus precisely, place motors
claude1_place_bus_motors = Python(IN[0]=pick_excel_file, IN[1]=header_row_index, IN[2]=family_type_column, IN[3]=motor_gap_additive_ft, IN[4]=unused_1, IN[5]=unused_2)  # CPython3
# ---------- claude1_place_bus_motors.python (722 lines) ----------
import clr
import math
import posixpath
import re
import zipfile
import xml.etree.ElementTree as ET

clr.AddReference('System.Windows.Forms')
clr.AddReference('System.Drawing')
clr.AddReference('RevitAPI')
clr.AddReference('RevitServices')
clr.AddReference('RevitNodes')

from Autodesk.Revit.DB import *
from RevitServices.Persistence import DocumentManager
from RevitServices.Transactions import TransactionManager
from System.Collections.Generic import List
from System.Drawing import Point, Size
from System.Windows.Forms import (
    Form as WinForm, Label, ComboBox, Button, DialogResult,
    FormStartPosition, ComboBoxStyle
)

# ===== claude1: geministepping (bus dropdown + precise centering) =====
# combined with test2 (Excel pick, sheet pick, motor placement).
# Motor placement is PLACEHOLDER - user will provide exact measurements
# and they should be applied to the constants in the "MOTOR LAYOUT" block.

MAIN_NS = 'http://schemas.openxmlformats.org/spreadsheetml/2006/main'
REL_NS = 'http://schemas.openxmlformats.org/officeDocument/2006/relationships'
PKG_REL_NS = 'http://schemas.openxmlformats.org/package/2006/relationships'
DESIRED_SHEET = 'MCC Info'

# ----- BUS PLACEMENT (from geministepping, do not change without remeasuring) -----
# Offsets applied to titleblock center to land the bus where geministepping put it.
BUS_CENTER_X_OFFSET = -1.4765603
BUS_CENTER_Y_OFFSET = -1.302083

# ----- MOTOR LAYOUT (PLACEHOLDER - tune after user provides measurements) -----
# Vertical pitch between adjacent bus lines (5-1/4" from test2).
BUS_LINE_VERTICAL_SPACING_FT = 0.520833  # 0' 6-1/4" measured between MCC bus lines
# Y of the topmost bus line, measured DOWN from the bus family origin point
# (i.e. from the placement coordinate, not from the bbox).
TOP_LINE_OFFSET_FROM_BUS_ORIGIN_FT = 0.0
# Where the motor band starts horizontally, measured from the bus origin.
MOTOR_BAND_LEFT_FROM_ORIGIN_FT = 0.35
# Width of the motor band in feet. From test2: 2' 0-13/16" = 2.0677 ft.
MOTOR_BAND_WIDTH_FT = 2.0677
# Default additive gap between motors (negative tightens, positive loosens).
MOTOR_DEFAULT_GAP_FT = 0.0

MAX_BUS_LINES = 4
BUS_OPTIONS = ['MCC_MB-Bus1', 'MCC_MB-Bus2', 'MCC_MB-Bus3', 'MCC_MB-Bus4']


# ===== helpers =====
def qname(ns, name):
    return '{%s}%s' % (ns, name)


def safe_text(value):
    if value is None:
        return ''
    return str(value).strip()


def as_int(value, default=0):
    try:
        return int(round(float(value)))
    except:
        return default


def as_float(value, default=0.0):
    try:
        return float(value)
    except:
        return default


def normalize_name(value):
    return ''.join(safe_text(value).lower().split())


def normalize_header(value):
    return ' '.join(safe_text(value).replace('\n', ' ').split()).upper()


def workbook_part_path(target):
    target = safe_text(target).replace('\\', '/')
    if target.startswith('/'):
        return target.lstrip('/')
    return posixpath.normpath(posixpath.join('xl', target))


def col_ref_to_index(cell_ref):
    letters = ''.join(ch for ch in safe_text(cell_ref) if ch.isalpha()).upper()
    if not letters:
        return None
    index = 0
    for ch in letters:
        index = index * 26 + (ord(ch) - ord('A') + 1)
    return index - 1


def read_shared_strings(zf):
    if 'xl/sharedStrings.xml' not in zf.namelist():
        return []
    root = ET.fromstring(zf.read('xl/sharedStrings.xml'))
    strings = []
    for si in root.findall(qname(MAIN_NS, 'si')):
        text = ''.join(t.text or '' for t in si.iter(qname(MAIN_NS, 't')))
        strings.append(text)
    return strings


def cell_value(cell, shared_strings):
    cell_type = cell.attrib.get('t', '')
    if cell_type == 'inlineStr':
        inline = cell.find(qname(MAIN_NS, 'is'))
        if inline is None:
            return ''
        return ''.join(t.text or '' for t in inline.iter(qname(MAIN_NS, 't')))
    value_node = cell.find(qname(MAIN_NS, 'v'))
    if value_node is None or value_node.text is None:
        return ''
    raw = value_node.text
    if cell_type == 's':
        try:
            return shared_strings[int(float(raw))]
        except:
            return raw
    if cell_type == 'b':
        return 'TRUE' if raw in ('1', 'true', 'TRUE') else 'FALSE'
    return raw


def read_xlsx_sheet(file_path, desired_sheet):
    if not zipfile.is_zipfile(file_path):
        raise Exception('Selected workbook is not a .xlsx/.xlsm package. Save it as .xlsx or .xlsm and run again.')
    with zipfile.ZipFile(file_path, 'r') as zf:
        workbook_root = ET.fromstring(zf.read('xl/workbook.xml'))
        rels_root = ET.fromstring(zf.read('xl/_rels/workbook.xml.rels'))
        rel_targets = {}
        for rel in rels_root.findall(qname(PKG_REL_NS, 'Relationship')):
            rel_targets[rel.attrib.get('Id')] = rel.attrib.get('Target')
        sheets = []
        sheets_parent = workbook_root.find(qname(MAIN_NS, 'sheets'))
        if sheets_parent is not None:
            for sheet in sheets_parent.findall(qname(MAIN_NS, 'sheet')):
                name = sheet.attrib.get('name', '')
                rel_id = sheet.attrib.get(qname(REL_NS, 'id'))
                target = rel_targets.get(rel_id)
                if target:
                    sheets.append((name, workbook_part_path(target)))
        if not sheets:
            raise Exception('No worksheets in workbook.')
        wanted = normalize_name(desired_sheet)
        selected = None
        for name, target in sheets:
            if normalize_name(name) == wanted:
                selected = (name, target)
                break
        if selected is None:
            for name, target in sheets:
                normalized = normalize_name(name)
                if 'mcc' in normalized and 'info' in normalized:
                    selected = (name, target)
                    break
        if selected is None:
            available = ', '.join(name for name, _t in sheets)
            raise Exception('Could not find an MCC Info worksheet. Available: ' + available)
        sheet_name, sheet_path = selected
        shared_strings = read_shared_strings(zf)
        sheet_root = ET.fromstring(zf.read(sheet_path))
        rows = []
        sheet_data = sheet_root.find(qname(MAIN_NS, 'sheetData'))
        if sheet_data is not None:
            for row in sheet_data.findall(qname(MAIN_NS, 'row')):
                values = []
                next_col = 0
                for cell in row.findall(qname(MAIN_NS, 'c')):
                    col_index = col_ref_to_index(cell.attrib.get('r', ''))
                    if col_index is None:
                        col_index = next_col
                    while len(values) <= col_index:
                        values.append('')
                    values[col_index] = safe_text(cell_value(cell, shared_strings))
                    next_col = col_index + 1
                rows.append(values)
        return rows, sheet_name, [name for name, _t in sheets]


def parse_int_text(value):
    text = safe_text(value)
    if not text:
        return None
    try:
        return int(round(float(text)))
    except:
        match = re.search(r'-?\d+', text)
        if match:
            try:
                return int(match.group(0))
            except:
                return None
    return None


def is_mcc_bus_type(type_name):
    return re.match(r'^MCC_(MB|MLO)-Bus\d+$', safe_text(type_name), re.IGNORECASE) is not None


def sheet_label(sheet):
    try:
        number = safe_text(sheet.SheetNumber)
    except:
        number = ''
    try:
        name = safe_text(sheet.Name)
    except:
        name = ''
    if number and name:
        return '{} - {}'.format(number, name)
    return number or name or 'Unnamed Sheet'


def is_drawingsheet(view):
    try:
        return view is not None and view.ViewType == ViewType.DrawingSheet
    except:
        return False


def current_revit_view(doc):
    try:
        uidoc = DocumentManager.Instance.CurrentUIApplication.ActiveUIDocument
        if uidoc is not None and uidoc.ActiveView is not None:
            return uidoc.ActiveView
    except:
        pass
    try:
        return doc.ActiveView
    except:
        return None


def collect_target_sheets(doc):
    sheets = []
    for sheet in FilteredElementCollector(doc).OfClass(ViewSheet):
        try:
            if sheet.IsPlaceholder:
                continue
        except:
            pass
        sheets.append(sheet)
    sheets.sort(key=lambda s: sheet_label(s))
    return sheets


def same_element_id(left, right):
    try:
        return left is not None and right is not None and left.IntegerValue == right.IntegerValue
    except:
        return False


def prompt_for_sheet(doc, active_view, diag):
    sheets = collect_target_sheets(doc)
    if not sheets:
        raise Exception('No non-placeholder sheets in this Revit model.')
    form = WinForm()
    form.Text = 'claude1 - select target sheet'
    form.StartPosition = FormStartPosition.CenterScreen
    form.Size = Size(560, 155)
    form.MinimizeBox = False
    form.MaximizeBox = False
    label = Label()
    label.Text = 'Select the sheet to place the MCC layout on. Active sheet preselected when detected.'
    label.Location = Point(12, 12)
    label.Size = Size(525, 22)
    form.Controls.Add(label)
    combo = ComboBox()
    combo.DropDownStyle = ComboBoxStyle.DropDownList
    combo.Location = Point(12, 40)
    combo.Size = Size(525, 24)
    selected_index = 0
    for idx, sheet in enumerate(sheets):
        combo.Items.Add(sheet_label(sheet))
        if is_drawingsheet(active_view) and same_element_id(sheet.Id, active_view.Id):
            selected_index = idx
    combo.SelectedIndex = selected_index
    form.Controls.Add(combo)
    ok_button = Button()
    ok_button.Text = 'OK'
    ok_button.Location = Point(375, 78)
    ok_button.Size = Size(75, 26)
    form.Controls.Add(ok_button)
    cancel_button = Button()
    cancel_button.Text = 'Cancel'
    cancel_button.Location = Point(462, 78)
    cancel_button.Size = Size(75, 26)
    form.Controls.Add(cancel_button)

    def on_ok(s, a):
        form.DialogResult = DialogResult.OK
        form.Close()

    def on_cancel(s, a):
        form.DialogResult = DialogResult.Cancel
        form.Close()

    ok_button.Click += on_ok
    cancel_button.Click += on_cancel
    form.AcceptButton = ok_button
    form.CancelButton = cancel_button
    if form.ShowDialog() != DialogResult.OK:
        raise Exception('Sheet selection cancelled.')
    picked = sheets[combo.SelectedIndex]
    diag.append('Sheet picked: {}'.format(sheet_label(picked)))
    return picked


def titleblock_box(sheet, diag):
    try:
        titleblocks = (FilteredElementCollector(doc)
                       .OwnedByView(sheet.Id)
                       .OfCategory(BuiltInCategory.OST_TitleBlocks)
                       .WhereElementIsNotElementType())
        boxes = []
        for titleblock in titleblocks:
            box = titleblock.get_BoundingBox(sheet)
            if box is not None:
                boxes.append(box)
        if boxes:
            min_x = min(b.Min.X for b in boxes)
            min_y = min(b.Min.Y for b in boxes)
            max_x = max(b.Max.X for b in boxes)
            max_y = max(b.Max.Y for b in boxes)
            diag.append('Titleblock box Min=({},{}) Max=({},{})'.format(
                round(min_x, 4), round(min_y, 4), round(max_x, 4), round(max_y, 4)))
            return min_x, min_y, max_x, max_y
    except Exception as ex:
        diag.append('Could not read titleblock: {}'.format(ex))
    return None


def bbox_dims(element, view):
    try:
        box = element.get_BoundingBox(view)
        if box is None:
            return None
        width = abs(box.Max.X - box.Min.X)
        height = abs(box.Max.Y - box.Min.Y)
        center_x = (box.Min.X + box.Max.X) / 2.0
        center_y = (box.Min.Y + box.Max.Y) / 2.0
        return box, width, height, center_x, center_y
    except:
        return None


def _write(param, value):
    try:
        st = param.StorageType
        if st == StorageType.String:
            param.Set(value)
            return True
        if st == StorageType.Double:
            param.Set(float(value))
            return True
        if st == StorageType.Integer:
            param.Set(int(round(float(value))))
            return True
    except:
        pass
    return False


def set_param(element, param_name, value):
    val = safe_text(value)
    if val == '' or val.lower() == 'none':
        return 'skip'
    targets = [element]
    type_id = element.GetTypeId()
    if type_id != ElementId.InvalidElementId:
        targets.append(doc.GetElement(type_id))
    wanted = param_name.lower().replace(' ', '')
    for t in targets:
        if t is None:
            continue
        p = t.LookupParameter(param_name)
        if p is not None and not p.IsReadOnly and _write(p, val):
            return 'OK'
        for c in t.Parameters:
            if c.Definition.Name.lower().replace(' ', '') == wanted and not c.IsReadOnly:
                if _write(c, val):
                    return 'OK-fuzzy'
    return 'FAIL'


def zoom_to_created(element_ids, diag):
    if not element_ids:
        return
    try:
        uidoc = DocumentManager.Instance.CurrentUIApplication.ActiveUIDocument
        ids = List[ElementId]()
        for eid in element_ids:
            ids.Add(eid)
        uidoc.ShowElements(ids)
        diag.append('Zoomed to {} elements.'.format(len(element_ids)))
    except Exception as ex:
        diag.append('Zoom failed: {}'.format(ex))


# ===== inputs =====
excel_file_path = safe_text(IN[0])
header_row_index = as_int(IN[1], 0)
familytype_col_input = as_int(IN[2], 6)
minimum_gap = as_float(IN[3], MOTOR_DEFAULT_GAP_FT)
# IN[4]/IN[5] retained for graph compatibility but unused (placement is offset-driven).
_unused_x = as_float(IN[4], 0.0)
_unused_y = as_float(IN[5], 0.0)

doc = DocumentManager.Instance.CurrentDBDocument
diag = ['Excel file: {}'.format(excel_file_path)]
placed = []
errors = []
param_log = []

try:
    excel_data, sheet_used, available_sheets = read_xlsx_sheet(excel_file_path, DESIRED_SHEET)
except Exception as ex:
    OUT = [placed, ['Excel read failed: {}'.format(ex)], param_log, diag]
else:
    diag.append('Sheet used: {}'.format(sheet_used))
    diag.append('Row count: {}'.format(len(excel_data)))

    headers = []
    if len(excel_data) > header_row_index:
        headers = [safe_text(h) for h in excel_data[header_row_index]]
        diag.append('Headers: {}'.format(headers))

    header_lookup = {}
    for idx, header in enumerate(headers):
        key = normalize_header(header)
        if key and key not in header_lookup:
            header_lookup[key] = idx

    def col_index(name):
        return header_lookup.get(normalize_header(name), -1)

    def read_cell(row, col):
        if col < 0 or col >= len(row):
            return ''
        return safe_text(row[col])

    familytype_col = col_index('FAMILY TYPE')
    if familytype_col < 0:
        familytype_col = familytype_col_input
    diag.append('Family Type column: {}'.format(familytype_col))

    PARAM_MAP = [
        ('EQUIP ID', 'Equipment ID'),
        ('MCC', 'MCC'),
        ('BUCKET', 'Unit Number'),
        ('BUCKET TYPE', 'Unit Type'),
        ('DESCRIPTION', 'Equipment Description'),
        ('SF', 'Space Factor'),
        ('MOTOR HP', 'Motor HP'),
        ('STARTER HP RATING', 'Elec Starter Size'),
        ('STARTER SIZE', 'Elec Starter Size'),
        ('VFD AMP RATING', 'VFD Output Current'),
        ('CB TRIP', 'Breaker Trip'),
        ('CB FRAME', 'Breaker Frame'),
        ('FUSE TRIP', 'Fuse Trip'),
        ('CABLE', 'Wire Size'),
        ('NOTES', 'Notes'),
    ]
    col_map = []
    seen_revit = set()
    for excel_name, revit_name in PARAM_MAP:
        idx = col_index(excel_name)
        if idx >= 0 and revit_name not in seen_revit:
            col_map.append((excel_name, revit_name, idx))
            seen_revit.add(revit_name)
    diag.append('Active parameter mappings: {}'.format(len(col_map)))

    equip_col = col_index('EQUIP ID')


    active = current_revit_view(doc)
    target_sheet = prompt_for_sheet(doc, active, diag)

    if not is_drawingsheet(target_sheet):
        OUT = [placed, ['Target view is not a sheet.'], param_log, diag]
    else:
        devices = []
        for source_index, row in enumerate(excel_data[header_row_index + 1:], start=header_row_index + 2):
            if familytype_col >= len(row):
                continue
            type_name = read_cell(row, familytype_col)
            if not type_name or type_name.lower() == 'none':
                continue
            if is_mcc_bus_type(type_name):
                continue
            devices.append({
                'source_index': source_index,
                'row': row,
                'type_name': type_name,
                'equipment_id': read_cell(row, equip_col) or '?',
            })
        diag.append('Device rows to place: {}'.format(len(devices)))
        # ----- Auto-select MCC Bus family based on motor count -----
        num_motors = len(devices)
        # Capacity logic: Row 0 = 15, Row 1+ = 17 each
        if num_motors <= 15:
            chosen_bus = 'MCC_MB-Bus1'
        elif num_motors <= 15 + 17:
            chosen_bus = 'MCC_MB-Bus2'
        elif num_motors <= 15 + 17 + 17:
            chosen_bus = 'MCC_MB-Bus3'
        else:
            chosen_bus = 'MCC_MB-Bus4'
        diag.append('Auto-selected bus: {} ({} motors)'.format(chosen_bus, num_motors))


        collector = (FilteredElementCollector(doc)
                     .OfClass(FamilySymbol)
                     .OfCategory(BuiltInCategory.OST_GenericAnnotation))
        symbol_dict = {}
        for sym in collector:
            symbol_dict[sym.get_Name()] = sym

        if chosen_bus not in symbol_dict:
            OUT = [placed, ['Bus family symbol not loaded: ' + chosen_bus], param_log, diag]
        else:
            tb_box = titleblock_box(target_sheet, diag)
            if tb_box:
                min_x, min_y, max_x, max_y = tb_box
                center_x = (min_x + max_x) / 2.0
                center_y = (min_y + max_y) / 2.0
            else:
                center_x, center_y = 0.0, 0.0
                diag.append('No titleblock found, defaulting to (0,0).')

            target_x = center_x + BUS_CENTER_X_OFFSET
            target_y = center_y + BUS_CENTER_Y_OFFSET
            diag.append('Bus origin target: ({}, {})'.format(round(target_x, 4), round(target_y, 4)))

            placed_ids = []
            transaction_started = False
            try:
                TransactionManager.Instance.EnsureInTransaction(doc)
                transaction_started = True

                bus_symbol = symbol_dict[chosen_bus]
                if not bus_symbol.IsActive:
                    bus_symbol.Activate()
                    doc.Regenerate()
                bus_inst = doc.Create.NewFamilyInstance(XYZ(target_x, target_y, 0), bus_symbol, target_sheet)
                placed_ids.append(bus_inst.Id)
                doc.Regenerate()

                # Read actual bbox top and right after placement (test2 approach)
                bus_top = target_y
                bus_left = target_x - 1.0
                bus_right = target_x + 1.0
                bdims = bbox_dims(bus_inst, target_sheet)
                if bdims:
                    bb, bw, bh, bcx, bcy = bdims
                    bus_top = bb.Max.Y
                    bus_left = bb.Min.X
                    bus_right = bb.Max.X
                    diag.append('Bus bbox Min=({},{}) Max=({},{}) size=({}x{})'.format(
                        round(bb.Min.X, 4), round(bb.Min.Y, 4),
                        round(bb.Max.X, 4), round(bb.Max.Y, 4),
                        round(bw, 4), round(bh, 4)))

                placed.append('Bus {} placed at origin ({}, {}) | bus_top={}'.format(
                    chosen_bus, round(target_x, 4), round(target_y, 4), round(bus_top, 4)))

                m = re.match(r'^MCC_(?:MB|MLO)-Bus(\d+)$', chosen_bus)
                bus_line_count = int(m.group(1)) if m else 1
                bus_line_count = max(1, min(MAX_BUS_LINES, bus_line_count))
                diag.append('Bus line count: {}'.format(bus_line_count))

                # ----- pre-measure unique motor symbols -----
                unique_types = []
                seen_types = set()
                for d in devices:
                    t = d['type_name']
                    if t and t not in seen_types and t in symbol_dict:
                        seen_types.add(t)
                        unique_types.append(t)

                max_motor_w = 0.0
                max_motor_h = 0.0
                motor_meta = {}
                stage_x = (tb_box[2] if tb_box else target_x + 50.0) + 50.0
                stage_y = (tb_box[1] if tb_box else target_y) - 50.0
                for tname in unique_types:
                    sym = symbol_dict[tname]
                    if not sym.IsActive:
                        sym.Activate()
                        doc.Regenerate()
                    try:
                        ti = doc.Create.NewFamilyInstance(XYZ(stage_x, stage_y, 0), sym, target_sheet)
                        doc.Regenerate()
                        td = bbox_dims(ti, target_sheet)
                        if td:
                            bb, w, h, _, _ = td
                            origin_to_left = bb.Min.X - stage_x
                            origin_to_top = bb.Max.Y - stage_y
                            motor_meta[tname] = (origin_to_left, origin_to_top, w, h)
                            if w > max_motor_w:
                                max_motor_w = w
                            if h > max_motor_h:
                                max_motor_h = h
                            diag.append('Motor {}: w={} h={} otl={} ott={}'.format(
                                tname, round(w, 4), round(h, 4),
                                round(origin_to_left, 4), round(origin_to_top, 4)))
                        doc.Delete(ti.Id)
                        doc.Regenerate()
                    except Exception as ex:
                        diag.append('Could not measure {}: {}'.format(tname, ex))

                if max_motor_w <= 0:
                    max_motor_w = 0.28
                if max_motor_h <= 0:
                    max_motor_h = max_motor_w

                # Fixed center-to-center spacing: 0' 1-9/16" = 0.130208 ft
                col_spacing = 0.130208
                diag.append('col_spacing={} (max_w={} + gap={})'.format(
                    round(col_spacing, 4), round(max_motor_w, 4), round(minimum_gap, 4)))

                # Row 0: 15 motors. Row 1+: 17 motors (bus graphic has 2 built-in on left)
                ROW0_CAPACITY   = 15
                ROW1PLUS_CAPACITY = 17
                # Row 1+ starts 2 motor spacings to the LEFT of row 0
                ROW1PLUS_X_SHIFT = -2 * col_spacing
                # Drop all motors down by 0' 2-15/16" = 0.244792 ft
                MOTOR_Y_DROP_FT = 0.244792
                diag.append('motors per row (top/others): {}/{}'.format(ROW0_CAPACITY, ROW1PLUS_CAPACITY))

                # Bus line Y positions from ACTUAL bbox top, exactly like test2.dyn
                bus_line_ys = []
                for i in range(bus_line_count):
                    bus_line_ys.append(bus_top - i * BUS_LINE_VERTICAL_SPACING_FT)
                diag.append('Bus line Ys (top->bottom): {}'.format([round(y, 4) for y in bus_line_ys]))

                # Motor band X: from bus bbox right edge, shifted left to close gap to 1-9/16"
                # Measured gap was 2-7/8", target 1-9/16", shift = 1-5/16" = 0.109375 ft
                motor_band_left = bus_right - MOTOR_BAND_WIDTH_FT - 0.109375
                diag.append('Motor band left X: {}'.format(round(motor_band_left, 4)))

                # Per-row placement: row 0 = 15 motors at motor_band_left
                #                    row 1+ = 17 motors, shifted 2 slots left
                cur_line = 0
                cur_col  = 0
                for d in devices:
                    type_name = d['type_name']
                    if type_name not in symbol_dict:
                        errors.append("Excel row {}: '{}' not loaded.".format(d['source_index'], type_name))
                        continue

                    line_capacity = ROW0_CAPACITY if cur_line == 0 else ROW1PLUS_CAPACITY
                    if cur_col >= line_capacity:
                        cur_line += 1
                        cur_col   = 0
                        if cur_line >= bus_line_count:
                            cur_line = bus_line_count - 1

                    row_x_start = motor_band_left if cur_line == 0 else motor_band_left + ROW1PLUS_X_SHIFT
                    bus_y       = bus_line_ys[cur_line]
                    target_left = row_x_start + cur_col * col_spacing
                    line        = cur_line
                    col         = cur_col

                    if type_name in motor_meta:
                        otl, ott, _w, _h = motor_meta[type_name]
                        place_x = target_left - otl
                        place_y = bus_y - ott - MOTOR_Y_DROP_FT
                    else:
                        place_x = target_left
                        place_y = bus_y - max_motor_h - MOTOR_Y_DROP_FT

                    sym = symbol_dict[type_name]
                    if not sym.IsActive:
                        sym.Activate()
                        doc.Regenerate()
                    inst = doc.Create.NewFamilyInstance(XYZ(place_x, place_y, 0), sym, target_sheet)
                    placed_ids.append(inst.Id)

                    row_log = []
                    for excel_name, revit_name, ci in col_map:
                        cell = read_cell(d['row'], ci)
                        result = set_param(inst, revit_name, cell)
                        row_log.append("{} = '{}' [{}]".format(revit_name, cell, result))
                    param_log.extend(row_log)
                    doc.Regenerate()
                    placed.append('{} | {} line={} col={} target=({},{})'.format(
                        d['equipment_id'], type_name, line, col,
                        round(target_left, 4), round(bus_y, 4)))
                    cur_col += 1
            finally:
                if transaction_started:
                    TransactionManager.Instance.TransactionTaskDone()

            zoom_to_created(placed_ids, diag)

            try:
                import os
                log_dir = os.path.dirname(excel_file_path) if excel_file_path else 'C:\\Temp'
                log_path = os.path.join(log_dir, 'mcc_diag_claude1.txt')
                with open(log_path, 'w') as f:
                    f.write('\n'.join(str(x) for x in diag))
                diag.append('Diag log: ' + log_path)
            except Exception as ex:
                diag.append('Could not write diag: {}'.format(ex))

            OUT = [placed, errors, param_log, diag]
# ----------------------------------------
