# Dynamo graph Script1.dyn (Dynamo 2.16.4.10216)
# Graph 1 - v11: two-transaction insert then regenerate then param write. Fixes element freshness on first run.
# packages: Data-Shapes 2026.4.2

# group: File Selector Prompt
string = StringInput("Select/Browse Matrix Excel File")
string_2 = StringInput("Select/Browse Matrix Excel File")
filepath_data = Custom[FilePath Data](InputName=string, ButtonText=string_2)  # package Data-Shapes; Create filepath input for UI.MultipleInputForm ++ . Check out www.data-shapes.net for more infos !
relocate_connectors = BoolSelector(true)  # graph input
multipleinputform = Custom[MultipleInputForm ++](Inputs=filepath_data, Toggle=relocate_connectors)  # package Data-Shapes; Create a form with multiple inputs. see www.data-shapes.net for tutorials and infos!
firstItem = List.FirstItem(list=multipleinputform.User_Inputs)

# group: Excel Data Extractor-reads the utility matrix and organizes it to hand off
# Description:
# Opens the Utility Matrix Excel file and reads the Main sheet, pulling only the columns defined in the mapping list. Filters rows down to recognized Connection ID prefixes (CA, DRN, EL, EX, HH, INT, PCW, PHW, TD) and automatically excludes anything marked Obsolete. The extracted data is packaged into a structured dictionary with flat and grouped outputs for clean consumption by downstream nodes. If the file is open in Excel when the script runs, it prompts the user to close it before retrying rather than failing silently.
extractor_config = CodeBlock()
# ---------- extractor_config.designscript (36 lines) ----------
// Graph 1 - Insert & Locate Connectors
// Extractor Configuration

"Main";
 // OUT[0] -> Extractor.IN[1];

// Full 9-field mapping — feeds BOTH Extractor (validation) and ConMan inline writes
[
    ["Equipment ID",           "Equipment ID"],
    ["Equipment Description",  "Equipment Description"],
    ["Connection ID",          "Connection ID"],
    ["Equipment Condition",    "Condition"],
    ["Voltage & Phase",        "System Voltage"],
    ["Connection Size",        "Nominal Diameter"],
    ["Functional Area",        "Functional Area"],
    ["Line Number",            "Line Designator"],
    ["Service",                "Service"]
];
 // OUT[1] -> Extractor.IN[2];

4;
 // OUT[2] -> Extractor.IN[3];

["Connection ID",
    [
        "CA", "DRN", "EL", "EX", "HH",
        "INT", "PCW", "PHW", "TD"
    ]
];
 // OUT[3] -> Extractor.IN[4];

{
    "logic": "AND",
    "filters": [["Obsolete", [""]]]
};
 // OUT[4] -> Extractor.IN[5];
# ----------------------------------------
excel_data_extractor = Python(IN[0]=firstItem, IN[1]=extractor_config.out0, IN[2]=extractor_config.out1, IN[3]=extractor_config.out2, IN[4]=extractor_config.out3, IN[5]=extractor_config.out4)  # CPython3
# ---------- excel_data_extractor.python (194 lines) ----------
# Excel Data Extractor ## Revit 2023 / Dynamo 2.16 / CPython3

# Developed By - Chris Staker
# v2.0.0 - Semantic Versioning. Output structured as a Dictionary for seamless downstream consumption. Fixed column name casing bug.

import sys
import os
import ctypes

# Add custom Python support packages path
# v1.0.0 (Kevin branch) - fixed sys.path for multi-machine support
_pkg_paths = [
    r"C:\Dynamo\2.16\Python Support Pckg",
    r"K:\CAD\_Revit2023\Add_Ins\Python Support Pckg",
]
for _p in _pkg_paths:
    import os as _os
    if _os.path.isdir(_p) and _p not in sys.path:
        sys.path.insert(0, _p)
        break

try:
    from openpyxl import load_workbook
except ImportError:
    raise ImportError(
        "openpyxl not found. The Python Support Package must be installed at one of:\n"
        "  C:\\Dynamo\\2.16\\Python Support Pckg\n"
        "  K:\\CAD\\_Revit2023\\Add_Ins\\Python Support Pckg\n"
        "Ask your BIM manager to set up the Python Support Package on this machine."
    )

# Get inputs from Dynamo
file_path = IN[0]
table_name = IN[1]
excel_to_revit_mapping_list = IN[2]
header_row_index_input = IN[3] if len(IN) > 3 else None
primary_filter_input = IN[4] if len(IN) > 4 else None
supplementary_filter_input = IN[5] if len(IN) > 5 else None

def show_popup_message(title, message, icon_type=0, button_type=0):
    try:
        return ctypes.windll.user32.MessageBoxW(0, message, title, icon_type | button_type)
    except:
        return 1

def matches_filter_value(cell_value, filter_value):
    if cell_value is None:
        cell_str = ""
    else:
        cell_str = str(cell_value).strip().lower()
    filter_str = str(filter_value).strip().lower()
    return filter_str in cell_str

def check_supplementary_filters(record, supp_filter_config, column_indices):
    if not supp_filter_config or 'filters' not in supp_filter_config:
        return True 
    
    logic = supp_filter_config.get('logic', 'AND').upper()
    filters = supp_filter_config['filters']
    matches = []
    
    for filter_column, filter_values in filters:
        column_lower = filter_column.strip().lower()
        if column_lower not in column_indices:
            matches.append(False)
            continue
        
        cell_value = record.get(column_lower)
        column_match = any(matches_filter_value(cell_value, fv) for fv in filter_values)
        matches.append(column_match)
    
    return all(matches) if logic == 'AND' else any(matches)

def group_data_by_filters(data, primary_filter_config, supp_filter_config, column_indices):
    if not primary_filter_config or len(primary_filter_config) != 2:
        return {'All': data}
    
    primary_column, primary_values = primary_filter_config
    primary_column_lower = primary_column.strip().lower()
    
    if primary_column_lower not in column_indices:
        return {'All': data}
    
    grouped = {filter_val: [] for filter_val in primary_values}
    grouped['Other'] = []
    
    for record in data:
        cell_value = record.get(primary_column_lower)
        matched_group = None
        
        for filter_val in primary_values:
            if matches_filter_value(cell_value, filter_val):
                matched_group = filter_val
                break
        
        if matched_group is None:
            grouped['Other'].append(record)
            continue
        
        if check_supplementary_filters(record, supp_filter_config, column_indices):
            grouped[matched_group].append(record)
        else:
            grouped['Other'].append(record)
            
    return grouped

def build_output_structure(grouped_data, formatted_mapping):
    flat_data = []
    log_entries = []
    
    sorted_groups = sorted([k for k in grouped_data.keys() if k != 'Other'])
    if 'Other' in grouped_data:
        sorted_groups.append('Other')
    
    for idx, group_name in enumerate(sorted_groups):
        group_data = grouped_data[group_name]
        if group_data:
            flat_data.extend(group_data)
            log_entries.append({
                'Group': group_name,
                'Count': len(group_data),
                'Output Index': idx
            })
            
    # Output cleanly as a dictionary for downstream nodes
    return {
        "GroupedData": grouped_data,
        "FlatData": flat_data,
        "Mapping": formatted_mapping,
        "Log": log_entries
    }

def read_excel_data(file_path, table_name, mapping_list, header_row_input=None, primary_filter=None, supp_filter=None):
    if not os.path.exists(file_path):
        return {"Error": f"File not found at {file_path}"}
    
    while True:
        workbook = None
        try:
            try:
                workbook = load_workbook(file_path, read_only=True, keep_vba=True, data_only=True)
                if table_name not in workbook.sheetnames:
                    return {"Error": f"'{table_name}' sheet not found."}
                            
                worksheet = workbook[table_name]

                def coerce_header_row_index(val):
                    if val is None: return 1
                    try:
                        idx = int(float(str(val).strip()))
                        return max(idx, 1)
                    except: return 1

                header_row_index = coerce_header_row_index(header_row_input)
                max_rows = worksheet.max_row if worksheet.max_row is not None else 1
                if header_row_index > max_rows: header_row_index = 1
                            
                headers = [str(cell.value).strip().lower() if cell.value else None for cell in worksheet[header_row_index]]
                excel_columns = [item[0] for item in mapping_list]
                column_indices = {}
                            
                for col in excel_columns:
                    try:
                        column_indices[col] = headers.index(col.strip().lower())
                    except ValueError:
                        return {"Error": f"Column '{col}' not found."}
                
                all_column_indices = {header: idx for idx, header in enumerate(headers) if header}
                data = []
                
                for row_num, row in enumerate(worksheet.iter_rows(min_row=header_row_index + 1), start=header_row_index + 1):
                    record = {}
                    for col_name, col_idx in all_column_indices.items():
                        if col_idx < len(row):
                            record[col_name] = row[col_idx].value
                            
                    if any(record.get(headers[column_indices[col]]) is not None for col in excel_columns if col in column_indices):
                        data.append(record)
                                
            finally:
                if workbook: workbook.close()
            
            grouped_data = group_data_by_filters(data, primary_filter, supp_filter, all_column_indices)
            formatted_mapping = [{'Excel Header': pair[0], 'Revit Parameter': pair[1]} for pair in mapping_list]
            return build_output_structure(grouped_data, formatted_mapping)
        
        except (PermissionError, OSError):
            res = show_popup_message("File Access Error", f"Excel file '{os.path.basename(file_path)}' is open.", 0, 53)
            if res == 4: continue
            else: return {"Error": "Operation cancelled by user."}
        except Exception as e:
            return {"Error": str(e)}

OUT = read_excel_data(file_path, table_name, excel_to_revit_mapping_list, header_row_index_input, primary_filter_input, supplementary_filter_input)
# ----------------------------------------

# group: Move Connectors prompt yes/no
string_3 = StringInput("Move ALL connectors?")
string_4 = StringInput("Move NO connectors?")
list_create = List.Create(item0=string_3, item1=string_4)
boolean = BoolSelector(true)
boolean_2 = BoolSelector(false)
list_create_2 = List.Create(item0=boolean, item1=boolean_2)
radiobuttons_data = Custom[RadioButtons Data](Keys=list_create, Values=list_create_2)  # package Data-Shapes; Create radio buttons input for UI.MultipleInputForm ++ .
relocate_connectors_2 = BoolSelector(true)  # graph input
multipleinputform_2 = Custom[MultipleInputForm ++](Inputs=radiobuttons_data, Toggle=relocate_connectors_2)
watch = Watch(radiobuttons_data)
watch_2 = Watch(multipleinputform_2.User_Inputs)

# group: Finds & Places Connectors & Parameters
# Description:
# Reads the Utility Matrix Excel file to determine what process connectors are needed for each piece of equipment. For each equipment item (Data Cube) in the model, it checks what connectors already exist and what's missing, then inserts any missing connector families at the correct location. Existing connectors can optionally be repositioned to align with their parent equipment. After placement, all connector parameters (service, functional area, line number, etc.) are automatically populated from the Utility Matrix using the UM-Revit Mapping sheet to ensure the right data goes to the right connector type. Any connectors found in the model that don't match the Matrix are flagged as rogues in the output report.
conman_config = CodeBlock()
# ---------- conman_config.designscript (24 lines) ----------
"Equipment ID";
// Anchor parameter name;

[
"Data Devices",
"Electrical Equipment",
"Mechanical Equipment"
];
// Revit categories to search for existing connectors;

// Insertion config: [filter_param, [[prefix, family_name], ...]];
["Connection ID",
    [
        ["CA",  "Process Pipe Connector"],
        ["DRN", "Process Pipe Connector"],
        ["EL",  "Process Electrical Connector"],
        ["EX",  "Process Duct Connector"],
        ["HH",  "Process Pipe Connector"],
        ["INT", "Process Duct Connector"],
        ["PCW", "Process Pipe Connector"],
        ["PHW", "Process Pipe Connector"],
        ["TD",  "Process Data Connector"]
    ]
];
# ----------------------------------------
conMan = Python(IN[0]=conman_config.out0, IN[1]=conman_config.out1, IN[2]=conman_config.out2, IN[3]=excel_data_extractor, IN[4]=multipleinputform_2.User_Inputs, IN[5]=firstItem)  # CPython3
# ---------- conMan.python (485 lines) ----------
# ConMan
# Connector Manager for Process Data Cubes
# Revit 2023 / Dynamo 2.16 / CPython3
# Developed By - Chris Staker & Kevin Levasseur
# v3.0.0 - Replaced static param_mapping with UM-Revit Mapping read from Excel.
#           Initial param writes on new inserts now use read_um_revit_mapping()
#           with family applicability checks and unlisted-family fallback,
#           matching Script 2 v9.9.0 logic.

import sys
import clr
import re

from System.Collections.Generic import List

clr.AddReference('RevitAPI')
import Autodesk.Revit.DB as DB
from Autodesk.Revit.DB import (XYZ, ElementId, FilteredElementCollector,
    BuiltInParameter, BuiltInCategory, ElementMulticategoryFilter,
    FamilySymbol, LocationPoint)
import Autodesk.Revit.DB.Structure as DBStruct

clr.AddReference('RevitServices')
import RevitServices
from RevitServices.Persistence import DocumentManager
from RevitServices.Transactions import TransactionManager

# Inputs
anchor_param_name = IN[0]
target_categories  = IN[1]
if isinstance(target_categories, str): target_categories = [target_categories]

insertion_config = IN[2]
script1_output   = IN[3]
raw = IN[4] if len(IN) > 4 else True
move_enabled = bool(raw[0]) if isinstance(raw, list) else bool(raw)
excel_file_path  = IN[5] if len(IN) > 5 else None   # was param_mapping

doc = DocumentManager.Instance.CurrentDBDocument

# ═══════════════════════════════════════════════════════════════════════════════
# SECTION 1 — HELPER FUNCTIONS
# ═══════════════════════════════════════════════════════════════════════════════

def safe_get(obj, key, default=None):
    try:
        if hasattr(obj, "get"):
            val = obj.get(key)
            return val if val is not None else default
        elif hasattr(obj, "ContainsKey"):
            if obj.ContainsKey(key):
                val = obj[key]
                return val if val is not None else default
        elif hasattr(obj, "Keys"):
            for k in obj.Keys:
                if str(k) == str(key):
                    val = obj.GetValueAtKey(k) if hasattr(obj, "GetValueAtKey") else obj[k]
                    return val if val is not None else default
    except: pass
    return default

def get_param_value(elem, name):
    p = elem.LookupParameter(name)
    if p:
        if p.StorageType == DB.StorageType.Double: return p.AsDouble()
        elif p.StorageType == DB.StorageType.Integer: return p.AsInteger()
        else: return p.AsString()
    return None

def get_family_name(elem):
    try:
        fn_p = elem.Symbol.get_Parameter(BuiltInParameter.SYMBOL_FAMILY_NAME_PARAM)
        return fn_p.AsString() if fn_p else ""
    except:
        return ""

def build_param_map(elem_or_type):
    """Returns a lowercase-name → parameter dict."""
    pm = {}
    if not elem_or_type: return pm
    try:
        for p in elem_or_type.Parameters:
            try: pm[p.Definition.Name.strip().lower()] = p
            except: pass
    except: pass
    return pm

def set_location(elem, new_xyz):
    try:
        loc = elem.Location
        if isinstance(loc, LocationPoint):
            old_pt = loc.Point
            old_str = "X:{:.2f}, Y:{:.2f}, Z:{:.2f}".format(old_pt.X, old_pt.Y, old_pt.Z)
            if not old_pt.IsAlmostEqualTo(new_xyz, 0.0026):
                loc.Point = new_xyz
                return True, old_str
            return False, old_str
        return False, "N/A"
    except: return False, "Error"

def extract_flat_data(data_input):
    flat_data = safe_get(data_input, "FlatData")
    if flat_data is not None:
        return flat_data
    is_list_like = isinstance(data_input, list) or (hasattr(data_input, '__iter__') and not isinstance(data_input, str) and not hasattr(data_input, 'ContainsKey') and not hasattr(data_input, 'keys'))
    if is_list_like:
        flat = []
        for item in data_input:
            is_item_list = isinstance(item, list) or (hasattr(item, '__iter__') and not isinstance(item, str) and not hasattr(item, 'ContainsKey') and not hasattr(item, 'keys'))
            if is_item_list:
                flat.extend(extract_flat_data(item))
            else:
                if safe_get(item, "Excel Header") is None and safe_get(item, "Log") is None:
                    flat.append(item)
        return flat
    return [data_input] if (hasattr(data_input, 'keys') or hasattr(data_input, 'ContainsKey')) else []

# ═══════════════════════════════════════════════════════════════════════════════
# SECTION 2 — UM-REVIT MAPPING READER  (matches Script 2 v9.9.0)
# ═══════════════════════════════════════════════════════════════════════════════

def read_um_revit_mapping(file_path):
    """
    Reads the UM-Revit Mapping sheet from the Utility Matrix Excel file.
    Returns dict keyed by lowercase Excel column name:
      { "connection size": {"params": [...], "families": [...]} }
    Entries with no "Yes" in any family column are excluded.
    """
    um_map = {}
    if not file_path:
        return um_map
    try:
        _pkg_paths = [
            r"C:\Dynamo\2.16\Python Support Pckg",
            r"K:\CAD\_Revit2023\Add_Ins\Python Support Pckg",
        ]
        for _p in _pkg_paths:
            import os as _os
            if _os.path.isdir(_p) and _p not in sys.path:
                sys.path.insert(0, _p)
                break
        from openpyxl import load_workbook
        wb = load_workbook(file_path, read_only=True, data_only=True)
        if 'UM-Revit Mapping' not in wb.sheetnames:
            wb.close()
            return um_map

        ws = wb['UM-Revit Mapping']
        header_row  = [c.value for c in next(ws.iter_rows(min_row=3, max_row=3))]
        family_cols = [str(h).strip() for h in header_row[2:] if h]

        for row in ws.iter_rows(min_row=4, values_only=True):
            excel_col   = row[0]
            revit_param = row[1]
            if not excel_col or not revit_param:
                continue
            key         = str(excel_col).strip().lower()
            params_list = [p.strip() for p in str(revit_param).strip().split(',') if p.strip()]

            applicable = []
            for i, fam_name in enumerate(family_cols):
                col_idx = i + 2
                if col_idx < len(row):
                    cell_val = row[col_idx]
                    if cell_val and str(cell_val).strip().lower() == "yes":
                        applicable.append(fam_name)

            if not applicable:
                continue   # No "Yes" for any family — skip

            if key not in um_map:
                um_map[key] = {"params": [], "families": set()}
            for p in params_list:
                if p not in um_map[key]["params"]:
                    um_map[key]["params"].append(p)
            for f in applicable:
                um_map[key]["families"].add(f)

        wb.close()
        for k in um_map:
            um_map[k]["families"] = list(um_map[k]["families"])

    except Exception:
        pass

    return um_map


def family_is_applicable(elem_family_name, applicable_families):
    """
    Substring match (case-insensitive) of elem_family_name against applicable_families.
    Returns True if any entry matches, or if applicable_families is empty.
    """
    if not applicable_families:
        return True
    efn = elem_family_name.strip().lower()
    for fam in applicable_families:
        fam_lower = fam.strip().lower()
        if fam_lower in efn or efn in fam_lower:
            return True
    return False


def write_params_via_um_mapping(inst, excel_row, um_revit_map):
    """
    Write parameters to a newly inserted connector element using the UM-Revit
    Mapping. Applies family applicability checks with the same unlisted-family
    fallback used in Script 2 v9.9.0: if the family is not in the mapping but
    the mapped parameter physically exists on the element, allow the write.
    Called inside an open transaction.
    """
    if not um_revit_map:
        return
    elem_fn  = get_family_name(inst)
    inst_pm  = build_param_map(inst)
    el_type  = doc.GetElement(inst.GetTypeId())
    type_pm  = build_param_map(el_type) if el_type else {}

    for col_lower, mapping_entry in um_revit_map.items():
        val = safe_get(excel_row, col_lower)
        if val is None or str(val).strip() in ('', '-', 'None', 'null'):
            continue

        revit_param_names   = mapping_entry['params']
        applicable_families = mapping_entry['families']

        # Applicability check — with fallback for families not in the mapping
        if applicable_families and not family_is_applicable(elem_fn, applicable_families):
            param_exists = any(
                inst_pm.get(rpn.strip().lower()) is not None or
                type_pm.get(rpn.strip().lower()) is not None
                for rpn in revit_param_names
            )
            if not param_exists:
                continue  # Param genuinely not on this element — skip

        for rpn in revit_param_names:
            p = inst_pm.get(rpn.strip().lower())
            if p and not p.IsReadOnly:
                val_str = str(val).strip()
                try:
                    if p.StorageType == DB.StorageType.String:
                        p.Set(val_str.upper())
                    elif p.StorageType == DB.StorageType.Double:
                        if not p.SetValueString(val_str):
                            try: p.Set(float(val))
                            except: pass
                    elif p.StorageType == DB.StorageType.Integer:
                        try: p.Set(int(float(val)))
                        except: pass
                except: pass


# ═══════════════════════════════════════════════════════════════════════════════
# SECTION 3 — METRICS & REPORT SETUP
# ═══════════════════════════════════════════════════════════════════════════════

metrics = {
    "Total Cubes": 0, "Excel Conns": 0, "Model Conns": 0,
    "Moved": 0, "Inserted": 0, "Skipped": 0,
    "Rogues Detected": [], "Errors": []
}
report_data = [["Revit Element ID", "Action", "Equipment ID",
                "Connection ID", "Previous Location", "New Location"]]

# ═══════════════════════════════════════════════════════════════════════════════
# SECTION 4 — DATA PREPARATION
# ═══════════════════════════════════════════════════════════════════════════════

excel_data = extract_flat_data(script1_output)
if not excel_data:
    OUT = [["Error: Invalid data structure from Script 1."]], [["Metric", "Value"]]
    sys.exit()

filter_param_revit = insertion_config[0]
filter_param_excel = filter_param_revit.strip().lower()
filter_rules       = insertion_config[1]
anchor_param_excel = anchor_param_name.strip().lower()

req_map = {}
for row in excel_data:
    val = str(safe_get(row, filter_param_excel, "")).strip()
    if val not in ["-", "None", "", "null"]:
        metrics["Excel Conns"] += 1
        eid_key = str(safe_get(row, anchor_param_excel, "")).strip().upper()
        if eid_key not in req_map: req_map[eid_key] = []
        req_map[eid_key].append(row)

cubes_coll = FilteredElementCollector(doc).OfCategory(BuiltInCategory.OST_GenericModel).WhereElementIsNotElementType().ToElements()
data_cubes = [c for c in cubes_coll if "Process Data Cube - Generic" in c.Symbol.Family.Name]
metrics["Total Cubes"] = len(data_cubes)

cat_map = {}
for c_name in target_categories:
    for cat in doc.Settings.Categories:
        if cat.Name == c_name:
            cat_map[cat.Id] = c_name
            break

existing_connectors = []
if cat_map:
    typed_ids = List[ElementId](cat_map.keys())
    multi_filter = ElementMulticategoryFilter(typed_ids)
    raw_conns = FilteredElementCollector(doc).WherePasses(multi_filter).WhereElementIsNotElementType().ToElements()
    existing_connectors = [e for e in raw_conns if "Connector" in e.Symbol.Family.Name]
metrics["Model Conns"] = len(existing_connectors)

symbol_cache = {}
for ec in existing_connectors:
    try:
        symbol = ec.Symbol
        fn_p = symbol.get_Parameter(BuiltInParameter.SYMBOL_FAMILY_NAME_PARAM)
        family_name = fn_p.AsString() if fn_p else ""
        if family_name and family_name not in symbol_cache:
            symbol_cache[family_name] = symbol.Id
    except: continue

target_search_terms = set(str(rule[1]).strip().lower() for rule in filter_rules if len(rule) > 1)
for fs in FilteredElementCollector(doc).OfClass(FamilySymbol):
    try:
        fn_p = fs.get_Parameter(BuiltInParameter.SYMBOL_FAMILY_NAME_PARAM)
        fn = fn_p.AsString() if fn_p else ""
        if any(term in fn.lower() for term in target_search_terms):
            if fn and fn not in symbol_cache:
                symbol_cache[fn] = fs.Id
    except: continue

def get_symbol_id_from_cache(target_name):
    t_clean = target_name.strip().lower()
    for fam_name, sym_id in symbol_cache.items():
        if t_clean == fam_name.lower(): return sym_id
    for fam_name, sym_id in symbol_cache.items():
        if t_clean in fam_name.lower(): return sym_id
    return None

conn_map = {}
conn_by_connection_id = {}
for ec in existing_connectors:
    eid = get_param_value(ec, anchor_param_name)
    if eid:
        key = str(eid).strip().upper()
        if key not in conn_map: conn_map[key] = []
        conn_map[key].append(ec)
        conn_id_val = str(get_param_value(ec, filter_param_revit) or "").strip().upper()
        if conn_id_val and conn_id_val not in ["-", "NONE", "", "NULL"]:
            if key not in conn_by_connection_id: conn_by_connection_id[key] = {}
            conn_by_connection_id[key][conn_id_val] = ec

# ═══════════════════════════════════════════════════════════════════════════════
# SECTION 5 — BUILD QUEUE
# ═══════════════════════════════════════════════════════════════════════════════

full_queue = []

for cube in data_cubes:
    eid_raw = get_param_value(cube, anchor_param_name)
    if not eid_raw: continue
    eid_key = str(eid_raw).strip().upper()

    cube_reqs   = req_map.get(eid_key, [])
    model_conns = conn_map.get(eid_key, [])
    conn_lookup = conn_by_connection_id.get(eid_key, {})
    if not cube_reqs and not model_conns: continue

    f,  bk = get_param_value(cube, "Offset Front") or 0.0, get_param_value(cube, "Offset Back")  or 0.0
    l,  r  = get_param_value(cube, "Offset Left")  or 0.0, get_param_value(cube, "Offset Right") or 0.0
    t      = get_param_value(cube, "Offset Top")   or 0.0
    length_dim, width_dim = abs(f) + abs(bk), abs(l) + abs(r)
    lx, ly, lz = (r - l) / 2.0, (f - bk) / 2.0, t

    unified_queue      = []
    consumed_model_ids = set()

    for row in cube_reqs:
        conn_id       = str(safe_get(row, filter_param_excel, "")).strip()
        conn_id_upper = conn_id.upper()
        target_fam    = next((f_name for f_text, f_name in filter_rules if f_text.lower() in conn_id.lower()), None)
        if not target_fam: continue
        if conn_id_upper in conn_lookup:
            ec = conn_lookup[conn_id_upper]
            unified_queue.append([ec, 0, conn_id, row])
            consumed_model_ids.add(ec.Id)
        else:
            symbol_id = get_symbol_id_from_cache(target_fam)
            if symbol_id:
                unified_queue.append([symbol_id, 1, conn_id, row])
            else:
                metrics["Errors"].append("ID {}: Missing family '{}'".format(eid_key, target_fam))

    for ec in model_conns:
        if ec.Id not in consumed_model_ids:
            unified_queue.append([ec, 2, None, None])
            cat_name = cat_map.get(ec.Category.Id, "Unknown")
            r_type = ("Data" if cat_name == "Data Devices" else
                      "Electrical" if cat_name == "Electrical Equipment" else
                      "Duct" if "Duct" in ec.Symbol.Family.Name else "Pipe")
            metrics["Rogues Detected"].append("ID {}: Rogue {} (ID: {})".format(eid_key, r_type, ec.Id))

    total_n = len(unified_queue)
    if total_n == 0: continue

    is_len       = length_dim >= width_dim
    axis_dim     = length_dim if is_len else width_dim
    spacing      = max(0.333, axis_dim / (total_n + 1))
    start_offset = -((total_n - 1) * spacing) / 2.0
    trans        = cube.GetTransform()

    for i, (item, type_code, val, excel_row) in enumerate(unified_queue):
        if type_code == 2: continue
        step     = start_offset + (i * spacing)
        local_pt = XYZ(lx, ly + step, lz) if is_len else XYZ(lx + step, ly, lz)
        world_pt = trans.OfPoint(local_pt)
        full_queue.append([item, type_code, val, eid_raw, excel_row, world_pt, cube])

# ═══════════════════════════════════════════════════════════════════════════════
# SECTION 6 — TRANSACTION 1: INSERT & MOVE
# ═══════════════════════════════════════════════════════════════════════════════

TransactionManager.Instance.EnsureInTransaction(doc)
app_create = doc.Create
inserted_items = []  # [(new_inst, excel_row, eid_raw, val, new_loc_str)]

for item, type_code, val, eid_raw, excel_row, world_pt, cube in full_queue:
    new_loc_str = "X:{:.2f}, Y:{:.2f}, Z:{:.2f}".format(world_pt.X, world_pt.Y, world_pt.Z)
    if type_code == 1:
        try:
            symbol = doc.GetElement(item)
            if not symbol.IsActive: symbol.Activate()
            new_inst = app_create.NewFamilyInstance(world_pt, symbol, cube, DBStruct.StructuralType.NonStructural)
            new_inst.LookupParameter(anchor_param_name).Set(str(eid_raw))
            new_inst.LookupParameter(filter_param_revit).Set(str(val))
            inserted_items.append((new_inst, excel_row, eid_raw, val, new_loc_str))
            metrics["Inserted"] += 1
        except Exception as ex:
            metrics["Errors"].append("Insert failed {}: {}".format(str(eid_raw), str(ex)))
    elif type_code == 0:
        if move_enabled:
            moved, old_loc_str = set_location(item, world_pt)
            if moved:
                report_data.append([item.Id.ToString(), "Moved", str(eid_raw), str(val), old_loc_str, new_loc_str])
                metrics["Moved"] += 1
            else:
                report_data.append([item.Id.ToString(), "No Change", str(eid_raw), str(val), old_loc_str, old_loc_str])
                metrics["Skipped"] += 1
        else:
            loc = item.Location
            old_loc_str = ("X:{:.2f}, Y:{:.2f}, Z:{:.2f}".format(loc.Point.X, loc.Point.Y, loc.Point.Z)
                           if isinstance(loc, LocationPoint) else "N/A")
            report_data.append([item.Id.ToString(), "No Change (Move Disabled)", str(eid_raw), str(val), old_loc_str, old_loc_str])
            metrics["Skipped"] += 1

TransactionManager.Instance.TransactionTaskDone()

# ═══════════════════════════════════════════════════════════════════════════════
# SECTION 7 — REGENERATE + TRANSACTION 2: WRITE PARAMS TO NEW INSERTS
#
#   Reads the UM-Revit Mapping from Excel and writes all applicable parameters
#   to newly inserted connector elements. Uses family applicability checks with
#   the same unlisted-family fallback as Script 2 v9.9.0.
# ═══════════════════════════════════════════════════════════════════════════════

doc.Regenerate()

if inserted_items:
    um_revit_map = read_um_revit_mapping(excel_file_path)
    TransactionManager.Instance.EnsureInTransaction(doc)
    for new_inst, excel_row, eid_raw, val, new_loc_str in inserted_items:
        try:
            write_params_via_um_mapping(new_inst, excel_row, um_revit_map)
            report_data.append([new_inst.Id.ToString(), "Inserted New",
                                 str(eid_raw), str(val), "N/A", new_loc_str])
        except Exception as ex:
            metrics["Errors"].append("Param write failed {}: {}".format(str(val), str(ex)))
    TransactionManager.Instance.TransactionTaskDone()

if len(report_data) == 1:
    report_data = [["No connection items processed."]]

metrics_table = [["Metric", "Value"]]
for key, value in metrics.items():
    value_str = (" | ".join(str(v) for v in value) if isinstance(value, list) and value
                 else "None" if isinstance(value, list) else str(value))
    metrics_table.append([key, value_str])

OUT = [report_data, metrics_table]
# ----------------------------------------

watch_conman_output = Watch(conMan)

# group: Excel Report Generator
# Description:
# Takes the output data from upstream nodes and writes it into a formatted, multi-sheet Excel workbook. Automatically detects the data type for each sheet — if headers contain Original/Updated column pairs it formats the sheet as a Comparison report with row-level change highlighting and a summary block, otherwise it formats it as a clean Simple table with alternating row striping. Saves to the specified path and falls back to the Desktop if the path is invalid, or saves a timestamped copy if the file is already open. Always opens the file automatically on completion. Includes a Script Log sheet on every run showing timestamped execution details, warnings, and errors.
report_config = CodeBlock()
# ---------- report_config.designscript (10 lines) ----------
// Graph 1 - Report Configuration

// Sheet names (one per data package from ConMan)
["Connector Actions", "Metrics"];

"Insert_Connectors_Report.xlsx";
 // Saves to Desktop if just filename;

"Blue";
 // Theme: Blue / Green / Red / Purple / Orange / Teal / custom hex;
# ----------------------------------------
conman_index_0_report_data = CodeBlock(x=conMan) { x[0]; }
conman_index_1_metrics_table = CodeBlock(x=conMan) { x[1]; }
param_writer = Python(IN[0]=report_config.out1, IN[1]=report_config.out0, IN[2]=report_config.out2, IN[3]=conman_index_0_report_data, IN[4]=conman_index_1_metrics_table)  # CPython3
# ---------- param_writer.python (589 lines) ----------
# ExcelGen
#
# Excel Report Generator
# 
# Revit 2023 / Dynamo 2.16 / CPython3
# Developed By - Chris Staker
# Developed On - 06/13/2025
# v1.0.0 - Initial Release
# v1.1.0 - Added Table Color / Theme Input (07/09/2025)
# v1.2.0 - Added support for multiple input formats (07/15/2025)
#        - Simple List of values
#        - Single Dictionary
#        - List of Dictionaries (Rows) or a Dictionary of Lists (Columns)
#        - Implemented logic for Simple/Log and Comparison reports
# v1.3.0 - Added support for List of Lists (table) format (07/17/25)
# v1.4.0 - Added updated counter output (08/10/2025)
# v1.5.0 - Updated highlight logic (08/15/2025)
#        - Fixed bug causing duplicate Excel files with default path
#        - Enhanced column auto-sizing logic
#        - Added configuration, data shape validation, and comments
# v1.6.0 - Ensured Excel report is always created, adding placeholder
#          sheets for invalid data packages (08/15/2025)
# v1.7.0 - Replaced desktop folder logic with local 'C' drive path
#          for Python Support Package location (08/22/2025)
# v1.7.1 - Fixed row striping for Simple reports. (09/10/2025)
# v1.7.2 - Added center alignment for single values or short text
#          (≤35 chars) in Simple report data cells (09/12/2025)

# --- SCRIPT CONFIGURATION ---
# Central location for settings that might need to be changed.
DEPENDENCY_FOLDER_NAME = "Python Support Pckg"
LOCAL_LIBRARY_PATH = r"C:\Dynamo\2.16\Python Support Pckg"
NETWORK_LIBRARY_PATH = r"K:\CAD\_Revit2023\Add_Ins\Python Support Pckg"

# --- Standard Library Imports ---
import sys
import os
import platform
import time
from datetime import datetime
from pathlib import Path
import re
import traceback
import colorsys

# --- Helper Classes ---
class Logger:
    """A simple class to handle logging with timestamps and execution time."""
    def __init__(self):
        """Initializes the logger and records the start time."""
        self.messages = []
        self.start_time = time.time()

    def log(self, message, level="INFO"):
        """Records a log message with a timestamp, elapsed time, and level."""
        timestamp = datetime.now().strftime("%H:%M:%S")
        elapsed = round(time.time() - self.start_time, 2)
        try:
            # Safely encode and decode the message to handle potential special characters.
            msg_str = str(message).encode('utf-8', 'replace').decode('utf-8')
            formatted_msg = "[{}][{}s][{}] {}".format(timestamp, elapsed, level, msg_str)
            self.messages.append(formatted_msg)
        except Exception:
            self.messages.append("[{}][{}s][ERROR] Error formatting log message.".format(timestamp, elapsed))
    
    def error(self, message): self.log(message, "ERROR")
    def warning(self, message): self.log(message, "WARN")
    def get_messages(self): return self.messages

# --- DEPENDENCY PATH HANDLING (WITH LOGGING) ---
def setup_library_paths(logger):
    """
    Checks for the required dependency folder in standard locations (Local C Drive, Network) and adds it to the system path if found.
    Uses constants defined in the SCRIPT CONFIGURATION section.
    Returns:
        tuple: (found_status, found_path, location_name)
    """
    logger.log("--- Running Dependency Check ---")
    
    # First, check the local C drive location.
    logger.log("Checking local C drive for libraries...")
    if os.path.isdir(LOCAL_LIBRARY_PATH):
        logger.log(f"✓ Found library path on Local C Drive: {LOCAL_LIBRARY_PATH}")
        if LOCAL_LIBRARY_PATH not in sys.path: sys.path.insert(0, LOCAL_LIBRARY_PATH)
        return True, LOCAL_LIBRARY_PATH, "Local C Drive"

    # If not found on local C drive, check the predefined network drive location.
    logger.log("Local C drive path not found. Checking network drive...")
    if os.path.isdir(NETWORK_LIBRARY_PATH):
        logger.log(f"✓ Found library path on Network Drive: {NETWORK_LIBRARY_PATH}")
        if NETWORK_LIBRARY_PATH not in sys.path: sys.path.insert(0, NETWORK_LIBRARY_PATH)
        return True, NETWORK_LIBRARY_PATH, "Network Drive"
    
    # If the library is not found in any location, log an error.
    logger.error("[X] FAILURE: Could not find the required library folder in any predefined location.")
    return False, None, None

# --- SCRIPT EXECUTION CONTROL FLOW ---
logger = Logger()
logger.log("Multi-Sheet Excel Report Script Started")
path_found, found_path, location_name = setup_library_paths(logger)

# Main guard clause: exit if the required 'openpyxl' library cannot be imported.
if not path_found:
    error_message = ("FATAL ERROR: Could not find the required 'openpyxl' library.")
    OUT = [error_message, logger.get_messages(), "0"]
else:
    try:
        # Attempt to import the library now that the path has been added.
        import openpyxl
        from openpyxl.styles import PatternFill, Font, Alignment
        from openpyxl.utils import get_column_letter
        from openpyxl.worksheet.table import Table, TableStyleInfo
        logger.log(f"✓ Successfully imported 'openpyxl' from {location_name}.")
    except ImportError as e:
        error_message = (f"FATAL ERROR: Import failed from '{found_path}'. Details: {e}")
        logger.error(error_message)
        OUT = [error_message, logger.get_messages(), "0"]

    else:
        # --- CONSTANTS ---
        # Defines static values used throughout the Excel creation process.
        MAX_SHEET_NAME_LENGTH, MAX_COLUMN_WIDTH = 31, 120
        CHANGED_HIGHLIGHT_COLOR_A = "FFFFFF99" # Soft Yellow 1
        CHANGED_HIGHLIGHT_COLOR_B = "FFFFFFCC" # Soft Yellow 2
        BASE_TABLE_STYLE = "TableStyleMedium2" # A neutral black/white/gray style

        # --- THEME AND COLOR LOGIC ---
        def create_theme_shades(hex_color):
            """Generates lighter shades for a given hex color for UI theming."""
            try:
                hex_color = hex_color.lstrip('#')
                r, g, b = (int(hex_color[i:i+2], 16) / 255.0 for i in (0, 2, 4))
                h, l, s = colorsys.rgb_to_hls(r, g, b)
                summary_l = l + (1 - l) * 0.7 
                summary_r, summary_g, summary_b = [int(c * 255) for c in colorsys.hls_to_rgb(h, summary_l, s)]
                stripe_l = l + (1 - l) * 0.9
                stripe_s = s * 0.5
                stripe_r, stripe_g, stripe_b = [int(c * 255) for c in colorsys.hls_to_rgb(h, stripe_l, stripe_s)]
                return { "summary": f"FF{summary_r:02X}{summary_g:02X}{summary_b:02X}", "stripe": f"FF{stripe_r:02X}{stripe_g:02X}{stripe_b:02X}" }
            except Exception:
                return {"summary": "FFF0F0F0", "stripe": "FFF9F9F9"}

        def get_theme_config(theme_input, logger):
            """
            Resolves a user-provided theme name or hex code into a full color configuration dictionary.
            """
            THEMES = { "blue": "4472C4", "green": "70AD47", "red": "C5504B", "purple": "7030A0", "orange": "ED7D31", "teal": "264653" }
            theme_input = str(theme_input).lower().strip() if theme_input else "blue"
            hex_color = THEMES.get(theme_input)
            
            if not hex_color:
                hex_color = theme_input.lstrip('#')
                if not (len(hex_color) == 6 and all(c in '0123456789abcdef' for c in hex_color)):
                    logger.warning(f"Invalid theme or color '{str(theme_input)}'. Using default 'blue' theme.")
                    hex_color = THEMES["blue"]
                else: 
                    logger.log(f"Using custom hex color: #{hex_color.upper()}")
            else: 
                logger.log(f"Using predefined theme: '{theme_input.capitalize()}'")
            
            shades = create_theme_shades(hex_color)
            return { "header_color": f"FF{hex_color.upper()}", "summary_background": shades["summary"], "stripe_background": shades["stripe"], "log_header_color": f"FF{hex_color.upper()}" }
        
        # --- HELPER FUNCTIONS ---
        def safe_cell_value(value):
            """Sanitizes a value to be safely written to an Excel cell."""
            if value is None: return ""
            try: str_value = str(value)
            except: str_value = repr(value)
            str_value = re.sub(r'[\x00-\x08\x0B\x0C\x0E-\x1F\x7F]', '', str_value)
            return str_value[:32767]
        
        def create_safe_table_name(sheet_name):
            """Creates a valid Excel table name from a sheet name."""
            safe_name = re.sub(r'[^\w]', '', sheet_name)
            if not safe_name or not safe_name[0].isalpha(): safe_name = "Table" + safe_name
            return safe_name[:250] + "Data"

        def should_center_align_data(value):
            """
            Determines if a data value should be center-aligned based on content.
            Returns True for single values or text with ≤30 characters.
            """
            if value is None or value == "":
                return True
            
            str_value = str(value).strip()
            return len(str_value) <= 35

        def validate_filepath(filepath, logger):
            """
            Validates a user-provided filepath. If invalid, generates a default path on the Desktop.
            Returns:
                tuple: (is_valid, final_filepath, was_path_generated_by_script)
            """
            logger.log(f"Received filepath input: '{filepath}'")
            is_valid, is_default_path = False, False
            if filepath and isinstance(filepath, str) and filepath.strip():
                filepath = filepath.strip()
                dir_name = os.path.dirname(filepath)
                if dir_name and os.path.isdir(dir_name):
                    is_valid = True; logger.log(f"✓ Directory exists, using provided filepath: '{filepath}'")
                elif not dir_name:
                    logger.log("Filename only provided, creating default save location...")
                else: 
                    logger.warning(f"The directory in the provided filepath does not exist: '{dir_name}'")
            else: 
                logger.warning("Filepath is empty, None, or invalid type.")
            
            if not is_valid:
                is_default_path = True
                logger.log("Creating default save location on user's Desktop...")
                try:
                    home_dir = os.path.expanduser("~")
                    desktop_path = os.path.join(home_dir, "Desktop")
                    for item in os.listdir(home_dir):
                        if "onedrive" in item.lower():
                            onedrive_desktop = os.path.join(home_dir, item, "Desktop")
                            if os.path.isdir(onedrive_desktop):
                                desktop_path = onedrive_desktop; break
                    base_name = os.path.basename(filepath.strip()) if filepath and isinstance(filepath, str) and filepath.strip() else ""
                    if not base_name:
                        logger.log("Creating a default filename with timestamp.")
                        base_name = f"Multi_Sheet_Report_{datetime.now().strftime('%Y%m%d_%H%M%S')}.xlsx"
                    else: 
                        logger.log(f"Preserving original filename: '{base_name}'")
                    if not base_name.lower().endswith('.xlsx'): base_name = os.path.splitext(base_name)[0] + ".xlsx"
                    filepath = os.path.join(desktop_path, base_name)
                    logger.log(f"Generated new valid filepath on Desktop: {filepath}")
                except Exception as e:
                    logger.error(f"Could not create a default path on the Desktop. Error: {e}"); return False, None, False
            
            if not filepath.lower().endswith('.xlsx'): filepath += '.xlsx'
            logger.log(f"Final validated filepath: {filepath}")
            return True, filepath, is_default_path

        def validate_sheet_name(sheet_name, logger):
            """Sanitizes a string to be a valid Excel sheet name."""
            if not sheet_name: logger.warning("Sheet name is empty, using default"); return "Report Sheet"
            sheet_name = str(sheet_name)
            sheet_name = re.sub(r'[\\/?*\[\]:]', '_', sheet_name)
            sheet_name = sheet_name.strip("'\"")
            if len(sheet_name) > MAX_SHEET_NAME_LENGTH:
                sheet_name = sheet_name[:MAX_SHEET_NAME_LENGTH]
                logger.warning(f"Sheet name truncated to {MAX_SHEET_NAME_LENGTH} characters.")
            return sheet_name

        def normalize_data_package(package, logger):
            """
            Inspects the input data package and converts it into a standardized format.
            Standard Format: (headers_list, list_of_data_columns, error_message)
            Handles multiple common data structures from Dynamo.
            """
            if (isinstance(package, list) and len(package) > 0 and
                all(isinstance(row, list) for row in package)):
                logger.log("Detected list of lists (table) format.")
                headers = package[0]
                data_rows = package[1:]
                num_headers = len(headers)
                
                sanitized_rows = []
                for i, row in enumerate(data_rows):
                    num_items = len(row)
                    if num_items != num_headers:
                        logger.warning(f"Row {i+1} has {num_items} items, but header has {num_headers}. Row will be adjusted.")
                        if num_items < num_headers:
                            sanitized_rows.append(row + [''] * (num_headers - num_items))
                        else:
                            sanitized_rows.append(row[:num_headers])
                    else:
                        sanitized_rows.append(row)
                
                if not sanitized_rows: 
                    return headers, [[] for _ in headers], None
                data_columns = list(map(list, zip(*sanitized_rows)))
                return headers, data_columns, None
            
            if isinstance(package, list) and len(package) == 2 and isinstance(package[0], list) and isinstance(package[1], dict):
                logger.log("Detected legacy data format: [headers_list, data_dict].")
                headers = package[0]
                data_dict = package[1]
                data_columns = [data_dict.get(h, []) for h in headers]
                return headers, data_columns, None

            if isinstance(package, dict):
                logger.log("Detected column-oriented dictionary format.")
                if not package: return [], [], None
                headers = list(package.keys())
                data_columns = [v if isinstance(v, list) else [v] for v in package.values()]
                return headers, data_columns, None

            if isinstance(package, list) and (not package or all(isinstance(i, dict) for i in package)):
                logger.log("Detected row-oriented list of dictionaries format.")
                if not package: return [], [], None
                ordered_headers = []
                header_set = set()
                for row in package:
                    for key in row.keys():
                        if key not in header_set:
                            header_set.add(key); ordered_headers.append(key)
                data_columns = [[row.get(header) for row in package] for header in ordered_headers]
                return ordered_headers, data_columns, None
            
            if isinstance(package, list):
                logger.log("Detected simple list format."); return ["Value"], [package], None

            err_msg = "Data package has an unrecognized format or is null."
            logger.error(err_msg)
            return None, None, err_msg
            
        def process_element_data(data_inputs, headers, logger):
            """
            Processes columnar data for a 'Comparison' report.
            Identifies 'original' and 'updated' columns, compares their values row-by-row, and calculates statistics.
            """
            report_data, stats = [], {"total": 0, "changed": 0, "no_change": 0, "errors": 0}
            if not data_inputs or not any(data_inputs): return report_data, stats
            
            comparison_pairs, original_cols, updated_cols = [], {}, {}
            for idx, header in enumerate(headers):
                h_lower = str(header).lower()
                if 'original' in h_lower: original_cols[h_lower.replace('original', '').strip()] = idx
                if 'updated' in h_lower: updated_cols[h_lower.replace('updated', '').strip()] = idx
            for key, orig_idx in original_cols.items():
                if key in updated_cols: comparison_pairs.append((orig_idx, updated_cols[key]))
            
            num_rows = len(data_inputs[0]) if data_inputs and data_inputs[0] else 0
            for i in range(num_rows):
                stats["total"] += 1
                try:
                    row_data = [(data_list[i] if i < len(data_list) else "") for data_list in data_inputs]
                    has_changed = any(str(row_data[orig_idx]).strip() != str(row_data[upd_idx]).strip() for orig_idx, upd_idx in comparison_pairs)
                    row_data.append("Changed" if has_changed else "No Change")
                    if has_changed: stats["changed"] += 1
                    else: stats["no_change"] += 1
                    report_data.append({'data': row_data, 'changed': has_changed})
                except Exception as e:
                    stats["errors"] += 1; logger.error(f"Error processing data at index {i}: {e}")
            logger.log(f"Data processing completed. Stats: {stats}"); return report_data, stats

        def process_and_create_sheet(wb, sheet_config, logger, used_table_names, theme_config, total_changed_counter):
            """
            Creates and formats a single worksheet based on a configuration dictionary.
            Handles 'Simple', 'Comparison', and 'Error' report types.
            """
            validated_sheet_name = ""
            try:
                config_name = sheet_config.get('name', 'Report Sheet')
                report_type = sheet_config.get('type')

                validated_sheet_name = validate_sheet_name(config_name, logger)
                logger.log(f"--- Processing Sheet: '{validated_sheet_name}' (Type: {report_type or 'Unknown'}) ---")
                ws = wb.create_sheet(title=validated_sheet_name)
                
                # --- Logic for 'Error' Report Type ---
                if report_type == 'Error':
                    error_message = sheet_config.get('error_message', 'An unspecified error occurred.')
                    ws['A1'] = "Data Error"
                    ws['A1'].font = Font(bold=True, size=16, color="C00000") # Red, bold font
                    ws['A2'] = error_message
                    ws.column_dimensions['A'].width = 100
                    ws['A2'].alignment = Alignment(wrap_text=True, vertical='top')
                    logger.log(f"Created placeholder error sheet for '{validated_sheet_name}'.")
                    return True

                # Unpack remaining data and define styles for valid report types.
                data_headers = sheet_config.get('headers', [])
                data_columns = sheet_config.get('columns', [])
                fills = { 
                    "header": PatternFill(start_color=theme_config['header_color'], fill_type='solid'), 
                    "summary": PatternFill(start_color=theme_config['summary_background'], fill_type='solid'), 
                    "stripe": PatternFill(start_color=theme_config['stripe_background'], fill_type='solid'), 
                    "changed_a": PatternFill(start_color=CHANGED_HIGHLIGHT_COLOR_A, fill_type='solid'),
                    "changed_b": PatternFill(start_color=CHANGED_HIGHLIGHT_COLOR_B, fill_type='solid')
                }
                fonts = {"header": Font(bold=True, color="FFFFFF"), "bold": Font(bold=True), "italic": Font(italic=True)}
                center_align, right_align = Alignment(horizontal='center', vertical='center'), Alignment(horizontal='right', vertical='center')

                # --- Logic for 'Simple' Report Type ---
                if report_type == 'Simple':
                    summary_header_data = sheet_config.get('summary_header')
                    start_col = 2 if summary_header_data else 1
                    data_start_row = 8 if summary_header_data else 1
                    if summary_header_data:
                        title_cell = ws.cell(row=1, column=1, value="Execution Summary"); title_cell.font = fonts['bold']; title_cell.alignment = center_align; ws.merge_cells(start_row=1, start_column=1, end_row=1, end_column=2)
                        for r_idx, (key, value) in enumerate(summary_header_data.items(), 2):
                            ws.cell(row=r_idx, column=1, value=key).font = fonts['bold']; ws.cell(row=r_idx, column=2, value=safe_cell_value(value))
                        for row in ws.iter_rows(min_row=1, max_row=len(summary_header_data) + 1, min_col=1, max_col=2):
                            for cell in row: cell.fill = fills['summary']
                    if data_headers:
                        for i, value in enumerate(data_headers, start_col): ws.cell(row=data_start_row, column=i, value=value).font, ws.cell(row=data_start_row, column=i, value=value).fill, ws.cell(row=data_start_row, column=i, value=value).alignment = fonts['header'], fills['header'], center_align
                        num_rows = len(data_columns[0]) if data_columns and data_columns[0] else 0
                        for i in range(num_rows):
                            for j, col in enumerate(data_columns, start_col): 
                                cell_value = safe_cell_value(col[i] if i < len(col) else "")
                                cell = ws.cell(row=data_start_row + 1 + i, column=j, value=cell_value)
                                # Apply center alignment for individual parameter-like data
                                if should_center_align_data(cell_value):
                                    cell.alignment = center_align
                        
                        end_col_idx = start_col + len(data_headers) - 1
                        
                        # Manually apply row striping for better file integrity
                        if num_rows > 0:
                            data_rows_for_styling = ws.iter_rows(min_row=data_start_row + 1, max_row=data_start_row + 1 + num_rows -1, min_col=start_col, max_col=end_col_idx)
                            for i, row_obj in enumerate(data_rows_for_styling):
                                if (i + 1) % 2 == 0:
                                    for cell in row_obj:
                                        cell.fill = fills['stripe']

                        table_range_str = f"{get_column_letter(start_col)}{data_start_row}:{get_column_letter(end_col_idx)}{data_start_row + num_rows}"
                        safe_table_name = create_safe_table_name(validated_sheet_name)
                        table = Table(displayName=safe_table_name, ref=table_range_str); table.tableStyleInfo = TableStyleInfo(name=BASE_TABLE_STYLE, showFirstColumn=False, showLastColumn=False, showRowStripes=False, showColumnStripes=False); ws.add_table(table)
                
                # --- Logic for 'Comparison' Report Type ---
                elif report_type == 'Comparison':
                    report_data, stats = process_element_data(data_columns, data_headers, logger)
                    report_headers = data_headers + ["Update Status"]
                    total_changed_counter[0] += stats['changed']
                    
                    suppress_highlighting = stats['changed'] > 0 and stats['changed'] == stats['total']
                    if suppress_highlighting: logger.log("All rows have changed; suppressing yellow highlight for clarity on first run.")
                    
                    ws['A1'] = "Report Summary"; ws['A1'].font = fonts['bold']; ws.merge_cells('A1:B1'); ws['A1'].alignment = center_align
                    summary_data = {"Total Rows:": stats['total'], "Changed:": stats['changed'], "No Change:": stats['no_change'], "Errors:": stats['errors']}
                    for i, (key, value) in enumerate(summary_data.items(), 2): ws.cell(row=i, column=1, value=key).font = fonts['bold']; ws.cell(row=i, column=2, value=value).alignment = right_align
                    timestamp_str = datetime.now().strftime("%Y-%m-%d %H:%M:%S"); ws.merge_cells('A6:B6'); ws['A6'].value = f"Generated: {timestamp_str}"; ws['A6'].font = fonts['italic']; ws['A6'].alignment = center_align
                    for row in ws['A1:B6']:
                        for cell in row: cell.fill = fills['summary']
                    
                    data_start_row = 8
                    for i, value in enumerate(report_headers, 1): cell = ws.cell(row=data_start_row, column=i, value=value); cell.font, cell.fill, cell.alignment = fonts['header'], fills['header'], center_align
                    for i, row_info in enumerate(report_data):
                        for j, value in enumerate(row_info['data'], 1): ws.cell(row=data_start_row + 1 + i, column=j, value=safe_cell_value(value)).alignment = center_align
                    
                    if report_data:
                        data_rows = ws.iter_rows(min_row=data_start_row + 1, max_row=ws.max_row, min_col=1, max_col=len(report_headers))
                        changed_row_counter = 0
                        for i, row_obj in enumerate(data_rows):
                            if (i + 1) % 2 == 0:
                                for cell in row_obj: cell.fill = fills['stripe']
                            if not suppress_highlighting and report_data[i]['changed']:
                                highlight_fill = fills['changed_a'] if changed_row_counter % 2 == 0 else fills['changed_b']
                                for cell in row_obj: cell.fill = highlight_fill
                                changed_row_counter += 1
                        
                        table_range_str = f"A{data_start_row}:{get_column_letter(len(report_headers))}{data_start_row + len(report_data)}"
                        safe_table_name = create_safe_table_name(validated_sheet_name); counter = 1
                        while safe_table_name in used_table_names: safe_table_name = f"{safe_table_name}{counter}"; counter += 1
                        used_table_names.add(safe_table_name)
                        table = Table(displayName=safe_table_name, ref=table_range_str); table.tableStyleInfo = TableStyleInfo(name=BASE_TABLE_STYLE, showFirstColumn=False, showLastColumn=False, showRowStripes=False, showColumnStripes=False); ws.add_table(table)
                        ws.freeze_panes = ws.cell(row=data_start_row + 1, column=1); logger.log(f"Table '{safe_table_name}' created for Comparison report.")
                
                # --- Column Auto-Sizing Logic (for valid reports) ---
                column_widths = {}
                for row in ws.rows:
                    for cell in row:
                        if cell.value:
                            adjusted_len = (len(str(cell.value)) * 1.15) + 1
                            column_widths[cell.column] = max(column_widths.get(cell.column, 0), adjusted_len)
                
                for col_idx, max_len in column_widths.items():
                    ws.column_dimensions[get_column_letter(col_idx)].width = min(max_len, MAX_COLUMN_WIDTH)
                
                logger.log("Auto-sized columns successfully."); return True
            except Exception as e:
                logger.error(f"Failed to process sheet '{validated_sheet_name or 'Unknown'}': {e}\n{traceback.format_exc()}"); return False

        def create_multi_sheet_excel_report(filepath, sheet_configs, logger, theme_config, total_changed_counter):
            """
            Main function to orchestrate the creation of the Excel workbook.
            It validates the filepath, creates sheets, adds a log sheet, and saves the file.
            """
            is_path_valid, validated_filepath, is_default_path = validate_filepath(filepath, logger)
            if not is_path_valid: return False, "Filepath validation failed."
            
            try:
                wb = openpyxl.Workbook(); wb.remove(wb.active)
                used_sheet_names, used_table_names, sheet_count = set(), set(), 0
                
                for config in sheet_configs:
                    original_name = config.get('name', 'Report Sheet'); validated_name = validate_sheet_name(original_name, logger); final_name = validated_name; counter = 1
                    while final_name in used_sheet_names: 
                        suffix = f"_{counter}"; final_name = validated_name[:MAX_SHEET_NAME_LENGTH - len(suffix)] + suffix; counter += 1
                    if final_name != original_name: logger.warning(f"Sheet '{original_name}' renamed to '{final_name}' for uniqueness.")
                    config['name'] = final_name; used_sheet_names.add(final_name)
                    if process_and_create_sheet(wb, config, logger, used_table_names, theme_config, total_changed_counter): sheet_count += 1
                
                if sheet_count == 0: logger.warning("No data sheets were created. Report will only contain the script log.")
                
                # --- Create and Format the Log Sheet ---
                log_ws = wb.create_sheet(title="Script Log"); log_ws.append(["Timestamp", "Elapsed (s)", "Level", "Message"]); log_pattern = re.compile(r"\[(.*?)\]\[(.*?)s\]\[(.*?)\] (.*)", re.DOTALL)
                for msg in logger.get_messages():
                    match = log_pattern.match(msg)
                    if match: log_ws.append([match.group(1), float(match.group(2)), match.group(3), match.group(4)])
                    else: log_ws.append(["", "", "", msg])
                header_fill = PatternFill(start_color=theme_config['log_header_color'], fill_type='solid'); stripe_fill, error_fill, warning_fill = PatternFill(start_color='FFEAEAEA', fill_type='solid'), PatternFill(start_color='FFFFC7CE', fill_type='solid'), PatternFill(start_color='FFFFEB9C', fill_type='solid'); header_font, header_align, data_align, indent_align = Font(bold=True, color="FFFFFF"), Alignment(horizontal='center', vertical='center'), Alignment(horizontal='center', vertical='center'), Alignment(horizontal='left', vertical='top', indent=1, wrap_text=True)
                for cell in log_ws["1:1"]: cell.font, cell.fill, cell.alignment = header_font, header_fill, header_align
                for row_num in range(2, log_ws.max_row + 1):
                    fill = stripe_fill if row_num % 2 == 0 else None
                    level = log_ws.cell(row=row_num, column=3).value
                    if level == "ERROR": fill = error_fill
                    elif level == "WARN": fill = warning_fill
                    for col_num in range(1, 5): log_ws.cell(row=row_num, column=col_num).alignment = data_align if col_num < 4 else indent_align
                    if fill:
                        for col_num in range(1, 5): log_ws.cell(row=row_num, column=col_num).fill = fill
                log_ws.column_dimensions['A'].width, log_ws.column_dimensions['B'].width, log_ws.column_dimensions['C'].width, log_ws.column_dimensions['D'].width = 12, 12, 10, 100; log_ws.freeze_panes = 'A2'
                
                # --- Save the Workbook ---
                final_filepath = validated_filepath; logger.log(f"Attempting to save workbook to: {final_filepath}")
                if is_default_path:
                    wb.save(filename=final_filepath)
                else:
                    try: 
                        wb.save(filename=final_filepath)
                    except PermissionError:
                        logger.warning(f"SAVE FAILED: '{os.path.basename(final_filepath)}' is open or permission is denied.")
                        p = Path(validated_filepath); final_filepath = p.with_name(f"{p.stem}_{datetime.now().strftime('%Y%m%d_%H%M%S')}{p.suffix}"); logger.log(f"Attempting to save to a new file: {final_filepath}"); wb.save(filename=final_filepath)
                
                if platform.system() == "Windows": os.startfile(final_filepath)
                return True, f"Excel report with {sheet_count} sheet(s) created: {os.path.basename(final_filepath)}"
            except Exception as e:
                error_msg = f"An unexpected error occurred: {e}"; logger.error(f"{error_msg}\n{traceback.format_exc()}"); return False, error_msg

        def main():
            """
            The main entry point for the script.
            It parses inputs, builds sheet configurations, and calls the report creation function.
            """
            try:
                # --- Input Parsing and Validation ---
                if len(IN) < 3: raise ValueError("Insufficient inputs. Expected filepath, sheet_names, and theme.")
                filepath, sheet_names, theme_input, data_packages = IN[0], IN[1], IN[2], IN[3:]
                theme_config = get_theme_config(theme_input, logger)
                sheet_names = [sheet_names] if isinstance(sheet_names, str) else sheet_names
                if not isinstance(sheet_names, list): raise TypeError(f"Sheet names (IN[1]) must be a list.")
                num_names, num_packages = len(sheet_names), len(data_packages)
                if num_names != num_packages:
                    sheets_to_process = min(num_names, num_packages); logger.warning(f"Input Mismatch: Found {num_names} names and {num_packages} data packages. Processing {sheets_to_process} sheets.")
                else: 
                    sheets_to_process = num_names
                
                total_changed_counter = [0]
                sheet_configs = []
                
                # --- Sheet Configuration Assembly ---
                for i in range(sheets_to_process):
                    sheet_name, package = sheet_names[i], data_packages[i]
                    headers, data_columns, error = normalize_data_package(package, logger)
                    
                    if error:
                        logger.error(f"Data for sheet '{sheet_name}' is invalid. Creating a placeholder sheet. Reason: {error}")
                        config = {
                            'name': sheet_name,
                            'type': 'Error', 
                            'error_message': f"The data package provided for this sheet was null or in an unrecognized format. See the Script Log tab for details."
                        }
                    else:
                        is_sow_log_report = isinstance(package, dict) and 'debug_log' in package
                        config = {'name': sheet_name, 'headers': headers, 'columns': data_columns}
                        header_string = ' '.join(str(h) for h in headers).lower()
                        
                        if is_sow_log_report:
                            logger.log(f"Classifying '{sheet_name}' as a Simple/Log report.")
                            config['type'] = 'Simple'
                            summary_data = {k: (v[0] if isinstance(v, list) and len(v)==1 else v) for k, v in package.items() if k != 'debug_log'}
                            log_data = package.get('debug_log', [])
                            config['summary_header'] = summary_data; config['headers'] = ['Log Messages']; config['columns'] = [log_data]
                        elif 'original' in header_string and 'updated' in header_string:
                            logger.log(f"Classifying '{sheet_name}' as a Comparison report."); config['type'] = 'Comparison'
                        else:
                            logger.log(f"Classifying '{sheet_name}' as a Simple report."); config['type'] = 'Simple'; config['summary_header'] = None
                    
                    sheet_configs.append(config)
                    
                logger.log(f"Successfully assembled {len(sheet_configs)} sheet configurations.")
                if not sheet_configs:
                    logger.warning("No sheet names provided. Report will only contain logs.")
                
                success, message = create_multi_sheet_excel_report(filepath, sheet_configs, logger, theme_config, total_changed_counter)
                if success: logger.log("Script completed successfully.")
                else: logger.error("Script completed with errors.")
                return [message, logger.get_messages(), str(total_changed_counter[0])]
            except Exception as e:
                error_msg = f"Fatal error in main execution: {e}\n{traceback.format_exc()}"
                logger.error(error_msg); return [error_msg, logger.get_messages(), "0"]

        OUT = main()
# ----------------------------------------
watch_excelgen_output = Watch(param_writer)

# group: Updates the parameters according to util matrix
# Description:
# Runs after ConMan has finished placing and moving connectors. Reads the UM-Revit Mapping sheet directly from the Utility Matrix Excel file to determine which parameters apply to which connector family, then compares every mapped field against what's currently in Revit and writes only what has changed. Matches connectors from the specified categories to Excel rows using Connection ID as the key. Includes a fallback for connector families not listed in the mapping sheet — if the parameter physically exists on the element it gets written regardless. Outputs a full before/after report for every connector processed, ready for the Excel report generator.
paramwriter_config = CodeBlock()
# ---------- paramwriter_config.designscript (12 lines) ----------
// Parameter Writer Config

// OUT[0]: Categories
[
    "Electrical Equipment",
    "Data Devices",
    "Mechanical Equipment",
    "Generic Models"
];

// OUT[1]: Key parameter
"Connection ID";
# ----------------------------------------
param_writer_2 = Python(IN[0]=excel_data_extractor, IN[2]=paramwriter_config.out0, IN[3]=paramwriter_config.out1, IN[4]=conMan, IN[5]=firstItem)  # CPython3; unwired: IN[1]
# ---------- param_writer_2.python (491 lines) ----------
# Script 1 — Parameter Writer
# Revit 2023 / Dynamo 2.16 / CPython3
# Developed By - Chris Staker & Kevin Levasseur
# v1.0.0 - Full rewrite. Replaces static mapping with UM-Revit Mapping read
#           directly from the Utility Matrix Excel file. Matches Script 2
#           v9.9.0 logic: existing_connectors element lookup, family
#           applicability checks, unlisted-family fallback, idempotent writes,
#           Original/Updated report columns for ExcelGen.
#
# INPUTS:
#   IN[0] = extractor_output   — structured dict from Excel Data Extractor
#   IN[1] = unused             — legacy (was raw_mapping_table)
#   IN[2] = categories_input   — list of Revit category name strings
#   IN[3] = key_parameter      — Revit parameter name for matching (Connection ID)
#   IN[4] = conman_dependency  — ConMan output (ordering only, not consumed)
#   IN[5] = excel_file_path    — path to Utility Matrix .xlsx

import sys
import clr

clr.AddReference('RevitAPI')
from Autodesk.Revit.DB import (
    FilteredElementCollector, StorageType, BuiltInParameter
)

clr.AddReference('RevitServices')
import RevitServices
from RevitServices.Persistence import DocumentManager
from RevitServices.Transactions import TransactionManager

doc              = DocumentManager.Instance.CurrentDBDocument
extractor_output = IN[0]
# IN[1] intentionally not consumed — legacy raw_mapping_table
categories_input = IN[2]
key_parameter    = IN[3]
# IN[4] intentionally not consumed — ConMan ordering dependency
excel_file_path  = IN[5] if len(IN) > 5 else None

# ═══════════════════════════════════════════════════════════════════════════════
# SECTION 1 — HELPER FUNCTIONS  (mirrors Script 2 v9.9.0)
# ═══════════════════════════════════════════════════════════════════════════════

def safe_get(obj, key, default=None):
    try:
        if hasattr(obj, "get"):
            val = obj.get(key)
            return val if val is not None else default
        elif hasattr(obj, "ContainsKey"):
            if obj.ContainsKey(key):
                val = obj[key]
                return val if val is not None else default
        elif hasattr(obj, "Keys"):
            for k in obj.Keys:
                if str(k) == str(key):
                    val = obj.GetValueAtKey(k) if hasattr(obj, "GetValueAtKey") else obj[k]
                    return val if val is not None else default
    except: pass
    return default

def get_param_display_value(param):
    if not param: return ""
    st = param.StorageType
    if st == StorageType.String:
        return param.AsString() or ""
    elif st == StorageType.Double:
        try:
            v = param.AsValueString()
            if v: return v
        except: pass
        return str(round(param.AsDouble(), 4)) if param.AsDouble() is not None else ""
    elif st == StorageType.Integer:
        return str(param.AsInteger())
    elif st == StorageType.ElementId:
        return str(param.AsElementId().IntegerValue)
    return ""

def check_param_match(param, target_val):
    if not param or target_val is None: return False
    st         = param.StorageType
    target_str = str(target_val).strip()
    if st == StorageType.String:
        return (param.AsString() or "").strip().upper() == target_str.upper()
    elif st == StorageType.Double:
        revit_str = param.AsValueString()
        if revit_str:
            if revit_str == target_str:        return True
            if revit_str == target_str + '"':  return True
            if revit_str == target_str + "'":  return True
        try:
            if param.AsDouble() is not None and abs(param.AsDouble() - float(target_val)) < 0.0001:
                return True
        except: pass
        return False
    elif st == StorageType.Integer:
        try:   return param.AsInteger() == int(float(target_val))
        except: return False
    return False

def compare_and_set_param(param, value):
    """Idempotent setter — writes only when value differs from current."""
    if not param or param.IsReadOnly or value is None:
        return False, get_param_display_value(param)
    st        = param.StorageType
    value_str = str(value).strip()
    try:
        if st == StorageType.String:
            before_norm = (param.AsString() or "").strip().upper()
            target_norm = value_str.upper()
            if before_norm == target_norm:
                return False, param.AsString() or ""
            param.Set(target_norm)
            return True, param.AsString() or ""
        elif st == StorageType.Double:
            before = param.AsDouble()
            if param.SetValueString(value_str):
                after   = param.AsDouble()
                changed = (before is None) or (abs(before - after) > 0.0001)
                return changed, get_param_display_value(param)
            try:
                target_float = float(value)
                if before is not None and abs(before - target_float) < 0.0001:
                    return False, get_param_display_value(param)
                param.Set(target_float)
                after   = param.AsDouble()
                changed = (before is None) or (abs(before - after) > 0.0001)
                return changed, get_param_display_value(param)
            except:
                return False, get_param_display_value(param)
        elif st == StorageType.Integer:
            try:
                target_int = int(float(value))
                if param.AsInteger() == target_int:
                    return False, get_param_display_value(param)
                param.Set(target_int)
                changed = param.AsInteger() == target_int
                return changed, get_param_display_value(param)
            except:
                return False, get_param_display_value(param)
        return False, get_param_display_value(param)
    except:
        return False, get_param_display_value(param)

def extract_flat_data(data_input):
    flat_data = safe_get(data_input, "FlatData")
    if flat_data is not None:
        return flat_data
    is_list_like = (isinstance(data_input, list) or
                    (hasattr(data_input, '__iter__') and
                     not isinstance(data_input, str) and
                     not hasattr(data_input, 'ContainsKey') and
                     not hasattr(data_input, 'keys')))
    if is_list_like:
        flat = []
        for item in data_input:
            is_item_list = (isinstance(item, list) or
                            (hasattr(item, '__iter__') and
                             not isinstance(item, str) and
                             not hasattr(item, 'ContainsKey') and
                             not hasattr(item, 'keys')))
            if is_item_list:
                flat.extend(extract_flat_data(item))
            elif safe_get(item, "Excel Header") is None and safe_get(item, "Log") is None:
                flat.append(item)
        return flat
    return ([data_input]
            if (hasattr(data_input, 'keys') or hasattr(data_input, 'ContainsKey'))
            else [])

def get_family_name(elem):
    try:
        fn_p = elem.Symbol.get_Parameter(BuiltInParameter.SYMBOL_FAMILY_NAME_PARAM)
        return fn_p.AsString() if fn_p else ""
    except:
        return ""

def build_param_map(elem_or_type):
    pm = {}
    try:
        for p in elem_or_type.Parameters:
            try: pm[p.Definition.Name.strip().lower()] = p
            except: pass
    except: pass
    return pm

def get_representative_display(param_names, inst_pm, type_pm, preferred_name=None):
    ordered = []
    if preferred_name:
        ordered.append(preferred_name.strip().lower())
    ordered.extend(n.strip().lower() for n in param_names
                   if n and n.strip().lower() not in ordered)
    first_display = ""
    for name in ordered:
        param = inst_pm.get(name) or type_pm.get(name)
        display = get_param_display_value(param) if param is not None else ""
        if first_display == "":
            first_display = display
        if str(display).strip() != "":
            return display
    return first_display

# ═══════════════════════════════════════════════════════════════════════════════
# SECTION 2 — UM-REVIT MAPPING READER  (identical to Script 2 v9.9.0)
# ═══════════════════════════════════════════════════════════════════════════════

def read_um_revit_mapping(file_path):
    um_map = {}
    if not file_path:
        return um_map
    try:
        _pkg_paths = [
            r"C:\Dynamo\2.16\Python Support Pckg",
            r"K:\CAD\_Revit2023\Add_Ins\Python Support Pckg",
        ]
        for _p in _pkg_paths:
            import os as _os
            if _os.path.isdir(_p) and _p not in sys.path:
                sys.path.insert(0, _p)
                break
        from openpyxl import load_workbook
        wb = load_workbook(file_path, read_only=True, data_only=True)
        if 'UM-Revit Mapping' not in wb.sheetnames:
            wb.close()
            return um_map
        ws = wb['UM-Revit Mapping']
        header_row  = [c.value for c in next(ws.iter_rows(min_row=3, max_row=3))]
        family_cols = [str(h).strip() for h in header_row[2:] if h]
        for row in ws.iter_rows(min_row=4, values_only=True):
            excel_col   = row[0]
            revit_param = row[1]
            if not excel_col or not revit_param:
                continue
            key         = str(excel_col).strip().lower()
            params_list = [p.strip() for p in str(revit_param).strip().split(',') if p.strip()]
            applicable  = []
            for i, fam_name in enumerate(family_cols):
                col_idx = i + 2
                if col_idx < len(row):
                    cell_val = row[col_idx]
                    if cell_val and str(cell_val).strip().lower() == "yes":
                        applicable.append(fam_name)
            if not applicable:
                continue
            if key not in um_map:
                um_map[key] = {"params": [], "families": set()}
            for p in params_list:
                if p not in um_map[key]["params"]:
                    um_map[key]["params"].append(p)
            for f in applicable:
                um_map[key]["families"].add(f)
        wb.close()
        for k in um_map:
            um_map[k]["families"] = list(um_map[k]["families"])
    except Exception:
        pass
    return um_map


def family_is_applicable(elem_family_name, applicable_families):
    if not applicable_families:
        return True
    efn = elem_family_name.strip().lower()
    for fam in applicable_families:
        fam_lower = fam.strip().lower()
        if fam_lower in efn or efn in fam_lower:
            return True
    return False

# ═══════════════════════════════════════════════════════════════════════════════
# SECTION 3 — COLLECT CONNECTOR ELEMENTS
# ═══════════════════════════════════════════════════════════════════════════════

all_doc_categories    = {c.Name: c for c in doc.Settings.Categories}
categories_to_process = categories_input if isinstance(categories_input, list) else [categories_input]
all_elements = []
for item in categories_to_process:
    cat_obj = None
    if hasattr(item, 'Id'):
        cat_obj = item
    elif isinstance(item, str) and item in all_doc_categories:
        cat_obj = all_doc_categories[item]
    if cat_obj:
        collector = (FilteredElementCollector(doc)
                     .OfCategoryId(cat_obj.Id)
                     .WhereElementIsNotElementType()
                     .ToElements())
        all_elements.extend(collector)

# Restrict to connector families only — prevents Data Cubes from overwriting
# connector entries in the lookup when both have Connection ID set.
existing_connectors = [
    e for e in all_elements
    if e.Symbol and "Connector" in (e.Symbol.Family.Name or "")
]

# ═══════════════════════════════════════════════════════════════════════════════
# SECTION 4 — PARAMETER WRITE FUNCTION  (matches Script 2 v9.9.0 Section 9)
# ═══════════════════════════════════════════════════════════════════════════════

def write_parameters_to_revit(data_input, key_param_name, file_path):
    data = extract_flat_data(data_input)
    if not data or not key_param_name:
        return [["Error: Inputs are empty."]], [], 0, 0

    um_revit_map = read_um_revit_mapping(file_path)

    # Connection ID lowercase → connector element (connectors only)
    element_lookup = {}
    for el in existing_connectors:
        p = el.LookupParameter(key_param_name)
        if p:
            val = get_param_display_value(p)
            if val:
                element_lookup[val.strip().lower()] = el

    # Recover display-case column names from extractor Mapping metadata
    col_case_map = {}
    mapping_entries = safe_get(data_input, "Mapping")
    if mapping_entries:
        try:
            for entry in mapping_entries:
                orig = safe_get(entry, "Excel Header") or ""
                if orig:
                    col_case_map[str(orig).strip().lower()] = str(orig).strip()
        except: pass

    all_excel_cols = []
    seen_lower     = set()
    for mapped_lower, mapped_display in col_case_map.items():
        if mapped_lower not in seen_lower:
            seen_lower.add(mapped_lower)
            all_excel_cols.append(mapped_display)

    key_col_lower  = key_param_name.strip().lower()
    writable_cols  = [c for c in all_excel_cols if c.strip().lower() != key_col_lower]
    not_found_keys = set()
    params_written = 0
    params_skipped = 0

    header_row = ["Revit Element ID", "Connection ID", "Family",
                  "Update Status", "Parameters Changed"]
    for col in writable_cols:
        header_row.extend(["Original: " + col, "Updated: " + col])
    processed_report = [header_row]

    TransactionManager.Instance.EnsureInTransaction(doc)

    for data_row in data:
        key_value = safe_get(data_row, key_col_lower)
        if key_value is None:
            continue

        element = element_lookup.get(str(key_value).strip().lower())
        if not element:
            not_found_keys.add(key_value)
            continue

        elem_fn        = get_family_name(element)
        el_type        = doc.GetElement(element.GetTypeId())
        inst_param_map = build_param_map(element)
        type_param_map = build_param_map(el_type) if el_type else {}

        element_was_updated = False
        changed_excel_cols  = []
        values_row = [element.Id.ToString(), str(key_value), elem_fn, "Unchanged", ""]

        for col in writable_cols:
            col_lower = col.strip().lower()
            new_val   = safe_get(data_row, col_lower)

            mapping_entry = um_revit_map.get(col_lower)
            if mapping_entry:
                revit_param_names   = mapping_entry["params"]
                applicable_families = mapping_entry["families"]
            else:
                if col_lower in inst_param_map or col_lower in type_param_map:
                    revit_param_names   = [col]
                    applicable_families = []
                else:
                    values_row.extend(["", ""])
                    continue

            # Applicability check with unlisted-family fallback
            if applicable_families and not family_is_applicable(elem_fn, applicable_families):
                param_exists_on_elem = any(
                    inst_param_map.get(rpn.strip().lower()) is not None or
                    type_param_map.get(rpn.strip().lower()) is not None
                    for rpn in revit_param_names
                )
                if not param_exists_on_elem:
                    values_row.extend(["", ""])
                    continue

            # Pre-read before values
            param_records = []
            for rpn in revit_param_names:
                rpn_lower = rpn.strip().lower()
                p  = inst_param_map.get(rpn_lower)
                tp = type_param_map.get(rpn_lower)
                before = (get_param_display_value(p)  if p  is not None else
                          get_param_display_value(tp) if tp is not None else "")
                param_records.append((rpn_lower, p, tp, before))

            primary_before = param_records[0][3] if param_records else ""

            if new_val is None or str(new_val).strip() in ("", "-", "None", "null"):
                values_row.extend([primary_before, primary_before])
                params_skipped += 1
                continue

            first_changed_before = None
            first_changed_param  = None
            col_was_updated      = False

            for rpn_lower, param_to_set, tp_match, before_display in param_records:
                if param_to_set is not None and not param_to_set.IsReadOnly:
                    changed, _ = compare_and_set_param(param_to_set, new_val)
                    if changed:
                        if first_changed_before is None:
                            first_changed_before = before_display
                            first_changed_param  = rpn_lower
                        element_was_updated = True
                        col_was_updated     = True
                        params_written     += 1
                    else:
                        params_skipped += 1
                elif tp_match is not None:
                    if check_param_match(tp_match, new_val):
                        params_skipped += 1
                    else:
                        family = el_type.Family
                        for sym_id in family.GetFamilySymbolIds():
                            sym    = doc.GetElement(sym_id)
                            sym_pm = build_param_map(sym)
                            sym_p  = sym_pm.get(rpn_lower)
                            if sym_p and check_param_match(sym_p, new_val):
                                if not sym.IsActive: sym.Activate()
                                element.ChangeTypeId(sym_id)
                                if first_changed_before is None:
                                    first_changed_before = before_display
                                    first_changed_param  = rpn_lower
                                element_was_updated = True
                                col_was_updated     = True
                                el_type        = sym
                                type_param_map = build_param_map(el_type)
                                params_written += 1
                                break

            if element_was_updated:
                doc.Regenerate()

            current_type   = doc.GetElement(element.GetTypeId())
            cur_inst_pm    = build_param_map(element)
            cur_type_pm    = build_param_map(current_type) if current_type else {}
            current_display = get_representative_display(
                revit_param_names, cur_inst_pm, cur_type_pm,
                preferred_name=first_changed_param
            )

            if first_changed_before is not None:
                original_val_str = first_changed_before
                final_val_str    = current_display
            else:
                original_val_str = primary_before
                final_val_str    = (current_display if str(current_display).strip() != ""
                                    else primary_before)

            if col_was_updated:
                changed_excel_cols.append(col)

            values_row.extend([original_val_str, final_val_str])

        if element_was_updated:
            values_row[3] = "Updated"
        values_row[4] = ", ".join(changed_excel_cols)

        processed_report.append(values_row)

    TransactionManager.Instance.TransactionTaskDone()

    not_found_report = [["Key Value", "Status"]]
    for key in sorted(not_found_keys):
        not_found_report.append([key, "Element Not Found in Revit"])

    if len(processed_report) <= 1:
        processed_report = [["No matching elements were found to process."]]

    return processed_report, not_found_report, params_written, params_skipped


param_results = write_parameters_to_revit(extractor_output, key_parameter, excel_file_path)
OUT = [param_results[0], param_results[1]]
# ----------------------------------------
watch_pw_output = Watch(param_writer_2)
