# Dynamo graph PlaceOneline_FromExcel.dyn (Dynamo 2.16.4.10216)
# Place one-line annotation families on active sheet from Excel data
# packages: Data-Shapes 2026.4.2

# group: File Selector Prompt
string = StringInput("Select/Browse Matrix Excel File")
string_2 = StringInput("Select/Browse Matrix Excel File")
filepath_data = Custom[FilePath Data](InputName=string, ButtonText=string_2)  # package Data-Shapes; Create filepath input for UI.MultipleInputForm ++ . Check out www.data-shapes.net for more infos !
relocate_connectors = BoolSelector(true)  # graph input
multipleinputform = Custom[MultipleInputForm ++](Inputs=filepath_data, Toggle=relocate_connectors)  # package Data-Shapes; Create a form with multiple inputs. see www.data-shapes.net for tutorials and infos!
firstItem = List.FirstItem(list=multipleinputform.User_Inputs)

file_from_path = FileObject(path=multipleinputform.User_Inputs)
string_3 = StringInput("MCC Info")
boolean = BoolSelector(true)
boolean_2 = BoolSelector(false)
importExcel = Data.ImportExcel(file=file_from_path, sheetName=string_3, readAsStrings=boolean, showExcel=boolean_2)
number = DoubleInput(0)
number_2 = DoubleInput(6)
number_3 = DoubleInput(0.15)
# note: Adjust this node for spacing
# left-right spacing
number_4 = DoubleInput(0)
number_5 = DoubleInput(-0.3)
python_script = Python(IN[0]=importExcel, IN[1]=number, IN[2]=number_2, IN[3]=number_3, IN[4]=number_4, IN[5]=number_5)  # CPython3
# ---------- python_script.python (217 lines) ----------
# ╔══════════════════════════════════════════════════════════════════╗
# ║  MCC Annotation Placer + Parameter Filler                      ║
# ║  Revit 2023 / Dynamo 2.x                                      ║
# ║  Groups of 13, new row every 13 (drops Y, resets X)            ║
# ╚══════════════════════════════════════════════════════════════════╝

import clr
clr.AddReference('RevitAPI')
clr.AddReference('RevitServices')
clr.AddReference('RevitNodes')

from Autodesk.Revit.DB import *
from RevitServices.Persistence import DocumentManager
from RevitServices.Transactions import TransactionManager

# ── DYNAMO INPUTS ────────────────────────────────────────────────
# IN[0] : Excel Data         — Data.ImportExcel output (list of lists)
#                               Sheet: "MCC Info"
# IN[1] : Header Row Index   — Row index of headers (0-based), typically 0
# IN[2] : Family Type Column — Column index for Family Type (col G = 6)
# IN[3] : Spacing (ft)       — Horizontal distance between placed families
# IN[4] : Start X (ft)       — X origin for first placement
# IN[5] : Start Y (ft)       — Y origin for placement row
# ─────────────────────────────────────────────────────────────────

raw_excel = IN[0]
header_row_index = int(IN[1])
familytype_col   = int(IN[2])
spacing          = float(IN[3])
start_x          = float(IN[4])
start_y          = float(IN[5])

# ── LAYOUT CONFIG ────────────────────────────────────────────────
GROUP_SIZE = 13        # families per row
ROW_DROP   = .75       # Y offset (feet) between rows (negative = downward)

doc = DocumentManager.Instance.CurrentDBDocument
active_view = doc.ActiveView

# ── FLATTEN EXCEL DATA ───────────────────────────────────────────
def flatten_excel(data):
    rows = []
    try:
        for row in data:
            r = []
            for cell in row:
                r.append(str(cell) if cell is not None else "")
            rows.append(r)
    except:
        pass
    return rows

excel_data = flatten_excel(raw_excel)

# ── DIAGNOSTIC ───────────────────────────────────────────────────
diag = []
diag.append("Row count: {}".format(len(excel_data)))
if len(excel_data) > header_row_index:
    diag.append("Headers: {}".format(excel_data[header_row_index]))

# ── PARSE HEADERS ────────────────────────────────────────────────
headers = []
if len(excel_data) > header_row_index:
    headers = [str(h).strip() for h in excel_data[header_row_index]]

def col_index(name):
    try:
        return headers.index(name)
    except ValueError:
        return -1

# ── EXCEL HEADER → REVIT PARAMETER NAME ──────────────────────────
PARAM_MAP = [
    ("EQUIP ID",         "Equipment ID"),
    ("MCC",              "MCC"),
    ("BUCKET",           "Unit Number"),
    ("BUCKET TYPE",      "Unit Type"),
    ("DESCRIPTION",      "Equipment Description"),
    ("SF",               "Space Factor"),
    ("MOTOR HP",         "Motor HP"),
    ("STARTER HP RATING","Elec Starter Size"),
    ("STARTER SIZE",     "Elec Starter Size"),
    ("VFD AMP RATING",   "VFD Output Current"),
    ("CB TRIP",          "Breaker Trip"),
    ("CB FRAME",         "Breaker Frame"),
    ("FUSE TRIP",        "Fuse Trip"),
    ("CABLE",            "Wire Size"),
]

col_map = []
seen_revit = set()
for excel_name, revit_name in PARAM_MAP:
    idx = col_index(excel_name)
    if idx >= 0 and revit_name not in seen_revit:
        col_map.append((excel_name, revit_name, idx))
        seen_revit.add(revit_name)

diag.append("Active mappings: {}".format(len(col_map)))

# ── FAMILY SYMBOL LOOKUP ─────────────────────────────────────────
collector = (FilteredElementCollector(doc)
             .OfClass(FamilySymbol)
             .OfCategory(BuiltInCategory.OST_GenericAnnotation))

symbol_dict = {}
for sym in collector:
    symbol_dict[sym.get_Name()] = sym

# ── SET PARAMETER ────────────────────────────────────────────────
def set_param(element, param_name, value):
    val = str(value).strip() if value is not None else ""
    if val == "" or val.lower() == "none":
        return "skip"

    targets = [element]
    tid = element.GetTypeId()
    if tid != ElementId.InvalidElementId:
        targets.append(doc.GetElement(tid))

    for target in targets:
        if target is None:
            continue
        p = target.LookupParameter(param_name)
        if p is not None and not p.IsReadOnly:
            if _write(p, val):
                return "OK"
        key = param_name.lower().replace(" ", "")
        for p in target.Parameters:
            if p.Definition.Name.lower().replace(" ", "") == key:
                if not p.IsReadOnly and _write(p, val):
                    return "OK-fuzzy"

    return "FAIL"

def _write(p, val):
    try:
        st = p.StorageType
        if st == StorageType.String:
            p.Set(val)
            return True
        elif st == StorageType.Double:
            p.Set(float(val))
            return True
        elif st == StorageType.Integer:
            p.Set(int(round(float(val))))
            return True
    except:
        pass
    return False

# ── PLACE & FILL ─────────────────────────────────────────────────
data_rows = excel_data[header_row_index + 1:]
placed = []
errors = []
param_log = []

TransactionManager.Instance.EnsureInTransaction(doc)

x_pos = start_x
y_pos = start_y
count_in_row = 0  # tracks how many placed in current row

for i, row in enumerate(data_rows):
    if familytype_col >= len(row):
        errors.append("Row {}: col out of range".format(i))
        continue

    type_name = row[familytype_col].strip()
    if not type_name or type_name == "None":
        continue

    if type_name not in symbol_dict:
        errors.append("Row {}: '{}' not in project".format(i, type_name))
        continue

    symbol = symbol_dict[type_name]
    if not symbol.IsActive:
        symbol.Activate()
        doc.Regenerate()

    # Check if we need to start a new row
    if count_in_row >= GROUP_SIZE:
        x_pos = start_x
        y_pos -= ROW_DROP  # drop down (negative Y = down in Revit)
        count_in_row = 0

    # Place
    point = XYZ(x_pos, y_pos, 0)
    instance = doc.Create.NewFamilyInstance(point, symbol, active_view)
    doc.Regenerate()

    # Fill parameters
    row_log = []
    for excel_name, revit_name, ci in col_map:
        if ci >= len(row):
            continue
        cell = row[ci]
        result = set_param(instance, revit_name, cell)
        row_log.append("{} = '{}' [{}]".format(revit_name, cell, result))

    equip_col = col_index("EQUIP ID")
    eid = row[equip_col].strip() if 0 <= equip_col < len(row) else "?"
    placed.append("{} | {} @ ({}, {})".format(eid, type_name, round(x_pos, 2), round(y_pos, 2)))
    param_log.append("--- {} ---".format(eid))
    param_log.extend(row_log)

    x_pos += spacing
    count_in_row += 1

TransactionManager.Instance.TransactionTaskDone()

# ── OUTPUT ───────────────────────────────────────────────────────
# OUT[0] = placed summary (now shows X,Y coords)
# OUT[1] = errors
# OUT[2] = parameter fill log
# OUT[3] = diagnostics
OUT = [placed, errors, param_log, diag]
# ----------------------------------------
